# Grasshopper definition 20160323_楼梯new01.gh (Grasshopper 0.9.14)

楼梯踏面长度 = Slider(3, range=0..11)
台阶高度 = Slider(1.5, range=0..1.5)
休息平台长度 = Slider(15, range=0..21)
楼梯节数 = Slider(10, range=0..10)
楼梯宽度 = Slider(11, range=0..21)
pt = Point(Point(2.551947641, 1.409284518, 0))
series = Series(Start=0, Step=楼梯踏面长度, Count=楼梯节数)
series_2 = Series(Start=0, Step=台阶高度, Count=楼梯节数)
X = UnitX(Factor=series)
Z = UnitZ(Factor=series_2)
multiplication = Multiplication(A=台阶高度, B="-1")
move = Move(Geometry=pt, Motion=X)  # -> Geometry, Transform
Z_2 = UnitZ(Factor=multiplication)
move_2 = Move(Geometry=move.Geometry, Motion=Z)  # -> Geometry, Transform
item = ListItem(List=reverse(move_2.Geometry), Index=0, Wrap=False)
Z_3 = UnitZ(Factor=台阶高度)
move_3 = Move(Geometry=move_2.Geometry, Motion=Z_3)  # -> Geometry, Transform
shift = ShiftList(List=move_2.Geometry, Shift=1, Wrap=False)
shift_2 = ShiftList(List=move_3.Geometry, Shift=-1, Wrap=False)
ln = Line(StartPoint=move_3.Geometry, EndPoint=move_2.Geometry)
item_2 = ListItem(List=move.Geometry, Index=expr("1", 0), Wrap=False)
shift_3 = ShiftList(List=reverse(ln), Shift=1, Wrap=False)
ln_2 = Line(StartPoint=item_2, EndPoint=pt)
ln_3 = Line(StartPoint=shift_2, EndPoint=shift)
Y = UnitY(Factor=楼梯宽度)
yz = YZPlane(Origin=pt)
X_2 = UnitX(Factor=台阶高度)
multiplication_2 = Multiplication(A=楼梯踏面长度, B=楼梯节数)
Y_2 = UnitY(Factor=楼梯宽度)
move_4 = Move(Geometry=item, Motion=Z_2)  # -> Geometry, Transform
ln_4 = Line(StartPoint=item, EndPoint=move_4.Geometry)
ln_5 = Line(StartPoint=item_2, EndPoint=move_4.Geometry)
planar = PlanarSrf(Edges=flatten([ln_4, ln_5, ln_2, ln_3, shift_3]))
X_3 = UnitX(Factor=multiplication_2)
multiplication_3 = Multiplication(A=楼梯节数, B=台阶高度)
item_3 = ListItem(List=reverse(move_3.Geometry), Index=0, Wrap=False)
move_5 = Move(Geometry=move_4.Geometry, Motion=X_2)  # -> Geometry, Transform
Z_4 = UnitZ(Factor=台阶高度)
X_4 = UnitX(Factor=休息平台长度)
Z_5 = UnitZ(Factor=multiplication_3)
move_6 = Move(Geometry=move_5.Geometry, Motion=Z_4)  # -> Geometry, Transform
move_7 = Move(Geometry=item_3, Motion=X_4)  # -> Geometry, Transform
multiplication_4 = Multiplication(A=台阶高度, B="-1")
Z_6 = UnitZ(Factor=multiplication_4)
move_8 = Move(Geometry=move_7.Geometry, Motion=Z_6)  # -> Geometry, Transform
ln_6 = Line(StartPoint=move_4.Geometry, EndPoint=move_5.Geometry)
ln_7 = Line(StartPoint=move_8.Geometry, EndPoint=move_6.Geometry)
ln_8 = Line(StartPoint=item_3, EndPoint=move_7.Geometry)
ln_9 = Line(StartPoint=move_8.Geometry, EndPoint=move_7.Geometry)
ln_10 = Line(StartPoint=item_3, EndPoint=move_4.Geometry)
ln_11 = Line(StartPoint=move_5.Geometry, EndPoint=move_6.Geometry)
multiplication_5 = Multiplication(A=楼梯宽度, B="2")
planar_2 = PlanarSrf(Edges=[ln_6, ln_10, ln_8, ln_9, ln_11, ln_7])
Y_3 = UnitY(Factor=multiplication_5)
extr = Extrude(Base=planar_2, Direction=Y_3)
extr_2 = Extrude(Base=planar, Direction=Y)
mirror = Mirror(Geometry=extr_2, Plane=yz)  # -> Geometry, Transform
move_9 = Move(Geometry=mirror.Geometry, Motion=Y_2)  # -> Geometry, Transform
move_10 = Move(Geometry=move_9.Geometry, Motion=X_3)  # -> Geometry, Transform
move_11 = Move(Geometry=move_10.Geometry, Motion=Z_5)  # -> Geometry, Transform
