# Grasshopper definition 20160329_小茶室测绘.gh (Grasshopper 0.9.76)

box = DomainBox(Base=PlaneXY(0, 0, 0), X=Slider(1.787, range=0..20.001), Y=Slider(2.119, range=0..11), Z=Slider(20.561, range=0..21))
Y = UnitY(Factor=Slider(4.43, range=0..11))
number_slider = Slider(2.7, range=0..11)
X = UnitX(Factor=Slider(22.64, range=0..41))
pt = ConstructPoint(XCoordinate=Slider(-1.448, range=-10..10.001), YCoordinate=Slider(-1.563, range=-10..10.001), ZCoordinate=number_slider)
move = Move(Geometry=pt, Motion=X)  # -> Geometry, Transform
move_2 = Move(Geometry=pt, Motion=Y)  # -> Geometry, Transform
pt_2 = ConstructPoint(XCoordinate=0, YCoordinate=0, ZCoordinate=0)
move_3 = Move(Geometry=pt_2, Motion=Vector(0, 0, 10))  # -> Geometry, Transform
move_4 = Move(Geometry=move.Geometry, Motion=Y)  # -> Geometry, Transform
Y_2 = UnitY(Factor=Slider(45, range=0..101))
Y_3 = UnitY(Factor=Slider(25, range=0..101))
Z = UnitZ(Factor=number_slider)
X_2 = UnitX(Factor=Slider(42.484, range=0..51))
move_5 = Move(Geometry=box, Motion=Y_3)  # -> Geometry, Transform
move_6 = Move(Geometry=box, Motion=Y_2)  # -> Geometry, Transform
X_3 = UnitX(Factor=Slider(20, range=0..61))
move_7 = Move(Geometry=box, Motion=X_3)  # -> Geometry, Transform
ln = Line(StartPoint=pt_2, EndPoint=move_3.Geometry)
Y_4 = UnitY(Factor=Slider(3.083, range=0..11))
pline = PolyLine(Vertices=[pt, move_2.Geometry, move_4.Geometry, move.Geometry], Closed=move.Geometry)
X_4 = UnitX(Factor=Slider(21, range=0..21))
Y_5 = UnitY(Factor=Slider(0.76, range=0..1))
boundary = BoundarySurfaces(Edges=pline)
Z_2 = UnitZ(Factor=Slider(0.5, range=0..1))
X_5 = UnitX(Factor=Slider(40, range=0..101))
move_8 = Move(Geometry=box, Motion=X_5)  # -> Geometry, Transform
move_9 = Move(Geometry=move_8.Geometry, Motion=Y_2)  # -> Geometry, Transform
pt_3 = ConstructPoint(XCoordinate=Slider(-0.763, range=-10..11), YCoordinate=Slider(-1.026, range=-10..11), ZCoordinate=0)
move_10 = Move(Geometry=pt_3, Motion=Y_4)  # -> Geometry, Transform
move_11 = Move(Geometry=pt_3, Motion=X_4)  # -> Geometry, Transform
move_12 = Move(Geometry=move_11.Geometry, Motion=Y_4)  # -> Geometry, Transform
extr = Extrude(Base=boundary, Direction=Z_2)
X_6 = UnitX(Factor=Slider(41.642, range=0..101))
move_13 = Move(Geometry=extr, Motion=X_6)  # -> Geometry, Transform
pline_2 = PolyLine(Vertices=[pt_3, move_11.Geometry, move_12.Geometry, move_10.Geometry], Closed=move_10.Geometry)
X_7 = UnitX(Factor=Slider(60, range=0..111))
move_14 = Move(Geometry=box, Motion=X_7)  # -> Geometry, Transform
move_15 = Move(Geometry=move_14.Geometry, Motion=Y_2)  # -> Geometry, Transform
debrep = DeconstructBrep(Brep=move_13.Geometry)  # -> Faces, Edges, Vertices
boundary_2 = BoundarySurfaces(Edges=pline_2)
extr_2 = Extrude(Base=boundary_2, Direction=Z)
move_16 = Move(Geometry=extr_2, Motion=X_2)  # -> Geometry, Transform
rotax = RotateAxis(Geometry=extr_2, Angle=1.570796327, Axis=ln)  # -> Geometry, Transform
move_17 = Move(Geometry=rotax.Geometry, Motion=Y_5)  # -> Geometry, Transform
move_18 = Move(Geometry=extr_2, Motion=X_7)  # -> Geometry, Transform
Y_6 = UnitY(Factor=1)
Z_3 = UnitZ(Factor=Slider(3.2, range=0..11))
X_8 = UnitX(Factor=Slider(1.6, range=0..11))
Y_7 = UnitY(Factor=Slider(0.813, range=0..11))
item = ListItem(List=debrep.Faces, Index=Slider(3.415, range=0..11), Wrap=True)
X_9 = UnitX(Factor=Slider(80, range=0..101))
move_19 = Move(Geometry=move_5.Geometry, Motion=X_9)  # -> Geometry, Transform
move_20 = Move(Geometry=box, Motion=X_9)  # -> Geometry, Transform
move_21 = Move(Geometry=move_20.Geometry, Motion=Y_2)  # -> Geometry, Transform
pt_4 = ConstructPoint(XCoordinate=X_8, YCoordinate=Y_7, ZCoordinate=Z_3)
move_22 = Move(Geometry=pt_4, Motion=Y_6)  # -> Geometry, Transform
X_10 = UnitX(Factor=Slider(19.619, range=0..21))
extr_3 = Extrude(Base=item, Direction=X_10)
X_11 = UnitX(Factor=Slider(2.3, range=0..6))
move_23 = Move(Geometry=pt_4, Motion=X_11)  # -> Geometry, Transform
move_24 = Move(Geometry=move_23.Geometry, Motion=Y_6)  # -> Geometry, Transform
pline_3 = PolyLine(Vertices=[pt_4, move_23.Geometry, move_24.Geometry, move_22.Geometry], Closed=move_22.Geometry)
Z_4 = UnitZ(Factor=Slider(16.154, range=0..51))
boundary_3 = BoundarySurfaces(Edges=pline_3)
extr_4 = Extrude(Base=boundary_3, Direction=Z_4)
series = Series(Start=0, Step=Slider(2.3, range=0..11), Count=Slider(8.29, range=0..11))
X_12 = UnitX(Factor=series)
item_2 = ListItem(Index=0, Wrap=True)
move_25 = Move(Geometry=extr_4, Motion=X_12)  # -> Geometry, Transform
X_13 = UnitX(Factor=Slider(40, range=0..121))
move_26 = Move(Geometry=extr_4, Motion=X_13)  # -> Geometry, Transform
X_14 = UnitX(Factor=Slider(18.2, range=0..31))
Y_8 = UnitY(Factor=Slider(0.648, range=0..1))
pt_5 = ConstructPoint(XCoordinate=Slider(21.79, range=0..31), YCoordinate=Slider(0.625, range=0..4), ZCoordinate=0)
move_27 = Move(Geometry=pt_5, Motion=Y_8)  # -> Geometry, Transform
move_28 = Move(Geometry=pt_5, Motion=X_14)  # -> Geometry, Transform
move_29 = Move(Geometry=move_28.Geometry, Motion=Y_8)  # -> Geometry, Transform
Y_9 = UnitY(Factor=Slider(31.399, range=-50..50.001))
pline_4 = PolyLine(Vertices=[pt_5, move_27.Geometry, move_29.Geometry, move_28.Geometry], Closed=move_28.Geometry)
Y_10 = UnitY(Factor=Slider(22.368, range=-60..60.001))
Z_5 = UnitZ(Factor=Slider(14.272, range=0..21))
pt_6 = ConstructPoint(
    XCoordinate=Slider(-3.935, range=-60..60.001),
    YCoordinate=Slider(-4.51, range=-60..60.001),
    ZCoordinate=Slider(24.601, range=-60..60.001))
move_30 = Move(Geometry=pt_6, Motion=Y_9)  # -> Geometry, Transform
move_31 = Move(Geometry=move_30.Geometry, Motion=Z_5)  # -> Geometry, Transform
move_32 = Move(Geometry=move_30.Geometry, Motion=Y_10)  # -> Geometry, Transform
boundary_4 = BoundarySurfaces(Edges=pline_4)
Z_6 = UnitZ(Factor=Slider(1.35, range=0..11))
extr_5 = Extrude(Base=boundary_4, Direction=Z_6)
pline_5 = PolyLine(Vertices=[pt_6, move_31.Geometry, move_32.Geometry], Closed=False)
Z_7 = UnitZ(Factor=1)
extr_6 = Extrude(Base=pline_5, Direction=Z_7)
move_33 = Move(Geometry=pt_5, Motion=Z_6)  # -> Geometry, Transform
X_15 = UnitX(Factor=Slider(91.15, range=0..101))
X_16 = UnitX(Factor=Slider(0.6, range=0..1))
extr_7 = Extrude(Base=extr_6, Direction=X_15)
move_34 = Move(Geometry=move_33.Geometry, Motion=X_16)  # -> Geometry, Transform
move_35 = Move(Geometry=move_34.Geometry, Motion=Vector(0, 0, 10))  # -> Geometry, Transform
ln_2 = Line(StartPoint=move_33.Geometry, EndPoint=move_34.Geometry)
number_slider_2 = Slider(8.5, range=0..21)
ln_3 = Line(StartPoint=move_35.Geometry, EndPoint=move_34.Geometry)
extr_8 = Extrude(Base=ln_2, Direction=Y_8)
Z_8 = UnitZ(Factor=Slider(19.63, range=0..51))
extr_9 = Extrude(Base=extr_8, Direction=Z_8)
X_17 = UnitX(Factor=Slider(17.6, range=0..31))
move_36 = Move(Geometry=extr_9, Motion=X_17)  # -> Geometry, Transform
X_18 = UnitX(Factor=number_slider_2)
move_37 = Move(Geometry=move_34.Geometry, Motion=X_18)  # -> Geometry, Transform
ln_4 = Line(StartPoint=move_37.Geometry, EndPoint=move_34.Geometry)
Z_9 = UnitZ(Factor=Slider(19.16, range=0..61))
extr_10 = Extrude(Base=ln_4, Direction=Y_8)
extr_11 = Extrude(Base=extr_10, Direction=Z_9)
X_19 = UnitX(Factor=number_slider_2)
move_38 = Move(Geometry=extr_11, Motion=X_19)  # -> Geometry, Transform
rotax_2 = RotateAxis(Geometry=extr_11, Angle=Slider(1, range=0..1), Axis=ln_3)  # -> Geometry, Transform
