# Grasshopper definition 20160329_楼梯平台.gh (Grasshopper 0.9.76)

genes = GenePool(Decimals=2, Maximum=3900, Minimum=300, Value=[3900, 2538.73])
平台宽度 = Slider(2875, range=200..10000)
梁的宽度 = Slider(235, range=100..1000)
平台厚度 = Slider(134, range=100..150)
梁的厚度 = Slider(408.5, range=300..1000)
number_slider = Slider(309.4, range=250..1000)
梯段宽 = Slider(3607.39, range=800..10000)
厚度 = Slider(285.11, range=150..450)
md_slider = MDSlider(
    slider_value=Point(0.2520951875, 0.1524661286, 0.5),
    SliderMode=0,
    x_domain=Domain(-10000, 10000),
    y_domain=Domain(-10000, 10000),
    z_domain=Domain(0, 1))
间距 = Slider(950, range=0..1000)

panel = Panel("""1.位置对了，旋转出错了。
2.基平面改变位置后连入程序，崩溃。""")
dispatch = Dispatch(List=genes, DispatchPattern=[True, False])  # -> ListA, ListB

panel_2 = Panel("怎么在R graft的情况下，dispatch出两个数据")
list = ValueList({"One": 1, "Two": 2, "Three": 2² - 1, "Four": Sqrt(16)}, selected="Two")
multiplication = Multiplication(A=[梯段宽, 间距], B=list)  # -> graft(Result)
平台长度 = Addition(B=multiplication)
dispatch_2 = Dispatch(List=multiplication, DispatchPattern=False)  # -> ListA, ListB

remap = RemapNumbers(Value=Slider(0, range=0..1), Source=Domain(0, 1), Target=Domain(0, 6.283185307))  # -> Mapped, Clipped
division = Division(A=dispatch.ListA, B=number_slider)
cos = Cosine(Value=0.5235987756)
list_2 = ValueList({"One": 1, "Two": 2, "Three": 2² - 1, "Four": Sqrt(16)}, selected="One")
踏步数 = Integer(division)
series = Series(Start=平台厚度, Step=梁的厚度, Count=2)
prot = RotatePlane(Plane=md_slider, Angle=remap.Mapped)
panel_3 = Panel("应该设置基点为中点对称点，而不是一个楼梯的某一基点")
panel_4 = Panel("怎么移动一个平面")
division_2 = Division(A=厚度, B=cos)
踢面数 = Addition(A=踏步数, B=list_2)
division_3 = Division(A=dispatch.ListB, B=踢面数)
multiplication_2 = Multiplication(A=division_3, B=0)
multiplication_3 = Multiplication(A=division_3, B=0)
neg = Negative(Value=division_2)
neg_2 = Negative(Value=series)
panel_5 = Panel("better")
subtraction = Subtraction(A=平台宽度, B=梁的宽度)
series_2 = Series(Start=[multiplication_2, division_3, neg], Step=division_3, Count=踏步数)  # -> simplify(Series)
series_3 = Series(Start=0, Step=number_slider, Count=踏步数)
panel_6 = Panel("由于此处导致无法旋转，该怎么旋转")
series_4 = Series(Start=0, Step=[梁的宽度, subtraction, 平台宽度], Count=2)
pt = PointOriented(BasePlane=prot, UComponent=series_3, VComponent=间距, WComponent=series_2)
bang = ExplodeTree(Data=pt)  # -> Branch0, Branch1, Branch2
item = ListItem(List=bang.Branch2, Index=-1, Wrap=True)
item_2 = ListItem(List=bang.Branch0, Index=0, Wrap=True)
item_3 = ListItem(List=bang.Branch2, Index=0, Wrap=True)
weave = Weave(Pattern=[0, 1], Stream0=bang.Branch0, Stream1=bang.Branch1, NullGaps=False)
平台 = ListItem(List=weave, Index=-1, Wrap=True)
pt_2 = Point(平台)
pt_3 = PointOriented(BasePlane=pt_2, UComponent=0, VComponent=梯段宽, WComponent=0)
pt_4 = PointOriented(BasePlane=pt_3, UComponent=0, VComponent=0, WComponent=neg_2)
dispatch_3 = Dispatch(List=pt_4, DispatchPattern=[True, False])  # -> ListA, ListB
pt_5 = Point([dispatch_3.ListB, pt_4])
pt_6 = Point([pt_3, dispatch_3.ListA])
pt_7 = PointOriented(BasePlane=pt_6, UComponent=平台宽度, VComponent=0, WComponent=0)
pt_8 = PointOriented(BasePlane=pt_5, UComponent=series_4, VComponent=0, WComponent=0)  # -> simplify(Point)
rev = ReverseList(List=pt_6)
bang_2 = ExplodeTree(Data=pt_8)  # -> Branch0, Branch1, Branch2
shift = ShiftList(List=bang_2.Branch0, Shift=1, Wrap=False)
shift_2 = ShiftList(List=bang_2.Branch1, Shift=1, Wrap=False)  # -> flatten(List)
shift_3 = ShiftList(List=bang_2.Branch2, Shift=1, Wrap=False)  # -> flatten(List)
item_4 = ListItem(List=pt_5, Index=[1, 2], Wrap=True)
rev_2 = ReverseList(List=shift_3)
rev_3 = ReverseList(List=shift)
panel_9 = Panel("这个地方拍与不拍什么区别")

item_5 = ListItem(List=weave, Index=0, Wrap=True)
item_6 = ListItem(List=weave, Index=-1, Wrap=True)
vec2pt = Vector2Pt(PointA=item_5, PointB=item_6, Unitize=False)  # -> Vector, Length
move = Move(Geometry=prot, Motion=vec2pt.Vector)  # -> Geometry, Transform

pt_9 = PointOriented(BasePlane=move.Geometry, UComponent=expr("-x", series_3), VComponent=expr("-x", 间距), WComponent=series_2)  # -> simplify(Point)
bang_3 = ExplodeTree(Data=pt_9)  # -> Branch0, Branch1, Branch2
item_7 = ListItem(List=bang_3.Branch2, Index=-1, Wrap=True)
weave_2 = Weave(Pattern=[0, 1], Stream0=bang_3.Branch0, Stream1=bang_3.Branch1, NullGaps=False)
item_8 = ListItem(List=bang_3.Branch2, Index=0, Wrap=True)
item_9 = ListItem(List=bang_3.Branch0, Index=0, Wrap=True)
shift_4 = ShiftList(List=weave_2, Shift=-1, Wrap=False)
merge = Merge(Data1=shift_4, Data2=item_7, Data3=item_8, Data4=item_9)
shift_5 = ShiftList(List=weave, Shift=-1, Wrap=False)
merge_2 = Merge(Data1=shift_5, Data2=item, Data3=item_3, Data4=item_2)
graft = GraftTree(Tree=shift_5, IncludeEmptyLists=True, IncludeNullItems=True)
bang_4 = ExplodeTree(Data=graft)  # -> _0000, _0001, _0002, _0003, _0004
flatten = FlattenTree(Tree=graft, Path="{0}")
number_slider_2 = Slider(40, range=0..100)
series_5 = Series(Start=0, Step=1, Count=10)
series_6 = Series(Start=0, Step=1, Count=10)
series_7 = Series(Start=0, Step=1, Count=10)
series_8 = Series(Start=number_slider_2, Step=number_slider_2, Count=10)
entwine = Entwine(Branch00=series_5, Branch01=series_6, Branch02=series_7, FlattenInputs=True)
pt_10 = ConstructPoint(XCoordinate=series_8, YCoordinate=0, ZCoordinate=0)
sift = SiftPattern(List=pt_10, SiftPattern=[0, 0, 1, 1])  # -> Output0, Output1
bang_5 = ExplodeTree(Data=entwine)  # -> Branch0, Branch1, Branch2
pt_11 = Point(sift.Output0)
pt_12 = Point(sift.Output1)

pline = PolyLine(Vertices=[rev, pt_7], Closed=True)
pline_2 = PolyLine(Vertices=[item_4, rev_3], Closed=True)
pline_3 = PolyLine(Vertices=[shift_2, rev_2], Closed=True)
neg_3 = Negative(Value=梯段宽)
pline_4 = PolyLine(Vertices=flatten(merge_2), Closed=True)
pline_5 = PolyLine(Vertices=flatten(merge), Closed=True)
boundary = BoundarySurfaces(Edges=[pline_4, pline_5])
boundary_2 = BoundarySurfaces(Edges=[pline, pline_2, pline_3])
panel_10 = Panel("旋转的修改")
multiplication_4 = Multiplication(A=梯段宽, B=2)  # -> graft(Result)
multiplication_5 = Multiplication(A=间距, B=2)
平台长度_2 = Addition(A=multiplication_5, B=multiplication_4)
Y = UnitY(Factor=平台长度_2)
rev_4 = Reverse(Vector=Y)
dispatch_4 = Dispatch(List=multiplication_4, DispatchPattern=False)  # -> ListA, ListB
extr = Extrude(Base=boundary_2, Direction=rev_4)

deplane = DeconstructPlane(Plane=prot)  # -> Origin, XAxis, YAxis, ZAxis
amp = Amplitude(Vector=deplane.YAxis, Amplitude=[梯段宽, neg_3])

extr_2 = Extrude(Base=boundary, Direction=amp)

pxs = PlaneThroughShape(Plane=prot, Shape=extr_2, Inflate=1, SectionLogic=False)
