# Grasshopper definition 20160404_楼梯升级.gh (Grasshopper 0.9.76)

genes = GenePool(Decimals=2, Maximum=1000, Minimum=0, Value=[873.18, 363.84])
楼梯厚度 = Slider(31.274, range=0..200)
number_slider = Slider(52.762, range=0..101)
number_slider_2 = Slider(0, range=0..301)
楼梯宽 = Slider(185.733, range=0..401)
md_slider = MDSlider(
    slider_value=Point(0.6173781418, 0.7050305808, 0.5),
    SliderMode=0,
    x_domain=Domain(0, 1000),
    y_domain=Domain(0, 1000),
    z_domain=Domain(0, 1))

number_slider_3 = Slider(0.25, range=0..1)
stack = StackData(Data=["A", "B", "C", "D"], Stack=[1, 2, 3, 4])
dispatch = Dispatch(List=genes, DispatchPattern=[True, False])  # -> ListA, ListB
dispatch_2 = Dispatch(List=genes, DispatchPattern=[True, False])  # -> ListA, ListB
prot = RotatePlane(Plane=md_slider, Angle=Slider(0, range=0..11))
division = Division(A=dispatch.ListB, B=dispatch.ListA)
division_2 = Division(A=dispatch_2.ListA, B=number_slider)
series = Series(Start=Slider(13, range=0..21), Step=Slider(14.873, range=0..31), Count=10)
cos = Cosine(Value=division)
int = Integer(division_2)
division_3 = Division(A=楼梯厚度, B=cos)
neg = Negative(Value=division_3)
addition = Addition(A=int, B=Slider(1, range=0..1))
division_4 = Division(A=dispatch_2.ListB, B=addition)
multiplication = Multiplication(A=division_4, B=0)
pt = Point(md_slider)
series_2 = Series(Start=0, Step=number_slider, Count=int)
series_3 = Series(Start=[division_4, neg, multiplication], Step=division_4, Count=int)  # -> simplify(Series)
pt_2 = PointOriented(BasePlane=prot, UComponent=series_2, VComponent=number_slider_2, WComponent=series_3)
bang = ExplodeTree(Data=pt_2)  # -> Branch0, Branch1, Branch2
pt_3 = Point(bang.Branch0)
item = ListItem(List=reverse(pt_3), Index=0, Wrap=True)
subtraction = Subtraction(A=item, B=pt)
pdecon = Deconstruct(Point=subtraction)  # -> XComponent, YComponent, ZComponent
subtraction_2 = Subtraction(A=pdecon.YComponent, B=楼梯宽)
pt_4 = PointOriented(BasePlane=prot, UComponent=pdecon.XComponent, VComponent=subtraction_2, WComponent=pdecon.ZComponent)
item_2 = ListItem(List=bang.Branch1, Index=-1, Wrap=True)
item_3 = ListItem(List=bang.Branch1, Index=0, Wrap=True)
item_4 = ListItem(List=bang.Branch2, Index=0, Wrap=True)
weave = Weave(Pattern=[0, 1], Stream0=bang.Branch2, Stream1=bang.Branch0, NullGaps=False)
item_5 = ListItem(List=weave, Index=0, Wrap=True)
shift = ShiftList(List=weave, Shift=-1, Wrap=False)
merge = Merge(Data1=flatten(shift), Data2=item_2, Data3=item_3, Data4=item_4)

item_6 = ListItem(List=weave, Index=0, Wrap=True)
item_7 = ListItem(List=weave, Index=-1, Wrap=True)
vec2pt = Vector2Pt(PointA=item_6, PointB=item_7, Unitize=False)  # -> Vector, Length
move = Move(Geometry=prot, Motion=vec2pt.Vector)  # -> Geometry, Transform

pt_5 = PointOriented(BasePlane=move.Geometry, UComponent=expr("-x", series_2), VComponent=expr("-x", number_slider_2), WComponent=series_3)
bang_2 = ExplodeTree(Data=pt_5)  # -> Branch0, Branch1, Branch2
item_8 = ListItem(List=bang_2.Branch1, Index=0, Wrap=True)
weave_2 = Weave(Pattern=[0, 1], Stream0=bang_2.Branch2, Stream1=bang_2.Branch0, NullGaps=False)
item_9 = ListItem(List=bang_2.Branch2, Index=0, Wrap=True)
item_10 = ListItem(List=bang_2.Branch1, Index=-1, Wrap=True)
shift_2 = ShiftList(List=weave_2, Shift=-1, Wrap=False)
merge_2 = Merge(Data1=flatten(shift_2), Data2=item_10, Data3=item_8, Data4=item_9)

pline = PolyLine(Vertices=flatten(merge_2), Closed=False)
pline_2 = PolyLine(Vertices=flatten(merge), Closed=False)
neg_2 = Negative(Value=楼梯宽)
deplane = DeconstructPlane(Plane=prot)  # -> Origin, XAxis, YAxis, ZAxis
boundary = BoundarySurfaces(Edges=[pline_2, pline])
amp = Amplitude(Vector=deplane.YAxis, Amplitude=[neg_2, 楼梯宽])
extr = Extrude(Base=boundary, Direction=amp)
