# Grasshopper definition 20160405_初始楼梯.gh (Grasshopper 1.0.7)

楼梯间距 = Slider(-61.899, range=-1000..1000.001)
踏面宽 = Slider(300, range=0..300)
踢面高 = Slider(150, range=0..150)
踏步数 = Slider(13.941, range=0..21)
楼梯厚度 = Slider(47, range=0..150)
楼梯宽度 = Slider(1466.15, range=0..2800)
division = Division(A=楼梯间距, B=2)
addition = Addition(A=division, B=楼梯宽度)
pt = Point(Point(7.376623224, 10.10345403, 0))
num = Number(踢面高)
int = Integer(踏步数)
num_2 = Number(踏面宽)
num_3 = Number(楼梯间距)
remap = RemapNumbers(Value=Slider(0, range=0..1), Source=Domain(0, 1), Target=Domain(0, 6.283185307))  # -> Mapped, Clipped
addition_2 = Addition(A=int, B=1)
division_2 = Division(A=num_2, B=num)
prot = RotatePlane(Plane=pt, Angle=remap.Mapped)
series = Series(Start=0, Step=num_2, Count=int)
atan = ArcTangent(Value=division_2)
series_2 = Series(Start=0, Step=num, Count=addition_2)
deplane = DeconstructPlane(Plane=prot)  # -> Origin, XAxis, YAxis, ZAxis
cos = Cosine(Value=atan)
stack = StackData(Data=series_2, Stack=2)
item = ListItem(List=series_2, Index=-1, Wrap=True)
stack_2 = StackData(Data=series, Stack=2)
rev = Reverse(Vector=deplane.YAxis)
rev_2 = Reverse(Vector=deplane.XAxis)
item_2 = ListItem(List=reverse(series_2), Index=1, Wrap=True)
division_3 = Division(A=楼梯厚度, B=cos)
shift = ShiftList(List=stack, Shift=1, Wrap=False)
item_3 = ListItem(List=reverse(series), Index=0, Wrap=True)
pt_2 = Point(prot)
series_3 = Series(Start=0, Step=item_2, Count=2)
shift_2 = ShiftList(List=shift, Shift=-1, Wrap=False)
pt_3 = PointOriented(BasePlane=prot, UComponent=addition, VComponent=item_3, WComponent=item)
pl = ConstructPlane(Origin=pt_3, XAxis=rev_2, YAxis=rev)
series_4 = Series(Start=0, Step=item_3, Count=2)
subtraction = Subtraction(A=series_3, B=division_3)
pln = Plane([pl, prot])
pt_4 = PointOriented(BasePlane=pln, UComponent=num_3, VComponent=stack_2, WComponent=shift_2)
pt_5 = PointOriented(BasePlane=pln, UComponent=num_3, VComponent=series_4, WComponent=subtraction)  # -> simplify(Point)
item_4 = ListItem(List=pt_4, Index=-1, Wrap=True)
pt_6 = Point(reverse(pt_5))
shift_3 = ShiftList(List=pt_4, Shift=-1, Wrap=False)  # -> simplify(List)
pt_7 = Point(simplify(item_4))
flatten = FlattenTree(Tree=pt_7, Path="{0}")
item_5 = ListItem(List=flatten, Index=-1, Wrap=True)
item_6 = ListItem(List=flatten, Index=0, Wrap=True)
subtraction_2 = Subtraction(A=item_6, B=pt_2)
pdecon = Deconstruct(Point=subtraction_2)  # -> XComponent, YComponent, ZComponent
addition_3 = Addition(A=pdecon.XComponent, B=楼梯宽度)
pt_8 = PointOriented(BasePlane=prot, UComponent=addition_3, VComponent=pdecon.YComponent, WComponent=pdecon.ZComponent)
vec2pt = Vector2Pt(PointA=item_6, PointB=item_5, Unitize=False)  # -> Vector, Length
move = Move(Geometry=prot, Motion=vec2pt.Vector)  # -> Geometry, Transform
pline = PolyLine(Vertices=[pt_6, shift_3], Closed=True)
panel = Panel(vec2pt.Vector)
amp = Amplitude(Vector=deplane.XAxis, Amplitude=楼梯宽度)
boundary = BoundarySurfaces(Edges=pline)
extr = Extrude(Base=boundary, Direction=amp)
