# Grasshopper definition 20160408_楼梯.gh (Grasshopper 0.9.76)

md_slider = MDSlider(
    slider_value=Point(0.02424242424, 0.01829268293, 0.5),
    SliderMode=0,
    x_domain=Domain(0, 5000),
    y_domain=Domain(0, 5000),
    z_domain=Domain(0, 1))
genes = GenePool(Decimals=2, Maximum=600, Minimum=0, Value=[321.93, 109.32])
dispatch = Dispatch(List=genes, DispatchPattern=[True, False])  # -> ListA, ListB
dom = ConstructDomain(DomainStart=dispatch.ListA, DomainEnd=dispatch.ListB)
list = ValueList({"One": 1, "Two": 2, "Three": 2² - 1, "Four": Sqrt(16)}, selected="One")
dom_2 = ConstructDomain(DomainStart=Slider(220, range=0..1000), DomainEnd=Slider(300, range=0..1000))

楼梯间距 = Slider(199.444, range=0..1000.001)
踏面宽 = Slider(300, range=0..300)
踢面高 = Slider(154, range=0..350)
踏步数 = Slider(19.27, range=0..21)
楼梯厚度 = Slider(88, range=0..150)
楼梯宽度 = Slider(1571.15, range=0..2800)
平台高 = Slider(362.75, range=0..1000)
平台长 = Slider(1712.75, range=0..2000)
pt = Point(md_slider)
num = Number(楼梯间距)
num_2 = Number(踏面宽)
num_3 = Number(踢面高)
int = Integer(踏步数)
num_4 = Number(平台高)
num_5 = Number(平台长)
num_6 = Number(Slider(301.189, range=0..1201))

inc = Includes(Value=num_3, Domain=dom)  # -> Includes, Deviation
inc_2 = Includes(Value=num_2, Domain=dom_2)  # -> Includes, Deviation
remap = RemapNumbers(Value=Slider(0, range=0..1), Source=Domain(0, 1), Target=Domain(0, 6.283185307))  # -> Mapped, Clipped
gate = StreamGate(Stream=remap.Mapped, Gate=inc_2.Includes)  # -> Target0, Target1
filter = StreamFilter(Gate=inc_2.Includes, Stream1=remap.Mapped)
filter_2 = StreamFilter(Gate=inc.Includes, Stream1=num_3)
addition = Addition(A=int, B=1)
prot = RotatePlane(Plane=pt, Angle=filter)
division = Division(A=num_2, B=num_3)
series = Series(Start=0, Step=num_2, Count=int)
series_2 = Series(Start=0, Step=filter_2, Count=addition)
deplane = DeconstructPlane(Plane=prot)  # -> Origin, XAxis, YAxis, ZAxis
atan = ArcTangent(Value=division)
item = ListItem(List=reverse(series_2), Index=1, Wrap=True)
cos = Cosine(Value=atan)
item_2 = ListItem(List=series_2, Index=-1, Wrap=True)
stack = StackData(Data=series, Stack=2)
stack_2 = StackData(Data=series_2, Stack=2)
item_3 = ListItem(List=reverse(series), Index=0, Wrap=True)
series_3 = Series(Start=0, Step=item, Count=2)
division_2 = Division(A=楼梯厚度, B=cos)
rev = Reverse(Vector=deplane.XAxis)
rev_2 = Reverse(Vector=deplane.YAxis)
shift = ShiftList(List=stack_2, Shift=1, Wrap=False)
pt_2 = PointOriented(BasePlane=prot, UComponent=0, VComponent=item_3, WComponent=item_2)
num_7 = Number(item_3)
num_8 = Number(item_3)
num_9 = Number(item_2)
subtraction = Subtraction(A=series_3, B=division_2)
shift_2 = ShiftList(List=shift, Shift=-1, Wrap=False)
subtraction_2 = Subtraction(A=num_9, B=num_4)
addition_2 = Addition(A=num_8, B=num_6)
addition_3 = Addition(A=num_7, B=num_5)
pl = ConstructPlane(Origin=pt_2, XAxis=rev, YAxis=rev_2)
subtraction_3 = Subtraction(A=num_9, B=division_2)
series_4 = Series(Start=0, Step=item_3, Count=2)
pln = Plane([pl, prot])
num_10 = Number([num_9, subtraction_2, subtraction_3])
num_11 = Number([num_7, addition_2, addition_3])
stack_3 = StackData(Data=num_10, Stack=2)
stack_4 = StackData(Data=num_11, Stack=2)
pt_3 = PointOriented(BasePlane=pln, UComponent=num, VComponent=series_4, WComponent=subtraction)  # -> simplify(Point)
pt_4 = PointOriented(BasePlane=pln, UComponent=num, VComponent=stack, WComponent=shift_2)
shift_3 = ShiftList(List=stack_3, Shift=1, Wrap=True)
addition_4 = Addition(A=楼梯间距, B=楼梯宽度)
item_4 = ListItem(List=pt_4, Index=Slider(4, range=0..41), Wrap=True)
item_5 = ListItem(List=pt_4, Index=Slider(3, range=0..21), Wrap=True)
pt_5 = PointOriented(BasePlane=prot, UComponent=addition_4, VComponent=stack_4, WComponent=shift_3)

pt_6 = Point(reverse(pt_3))
shift_4 = ShiftList(List=pt_4, Shift=-1, Wrap=False)  # -> simplify(List)
multiplication = Multiplication(A=楼梯间距, B=2)
multiplication_2 = Multiplication(A=楼梯宽度, B=2)
pline = PolyLine(Vertices=pt_5, Closed=pt_5)
deplane_2 = DeconstructPlane(Plane=pln)  # -> Origin, XAxis, YAxis, ZAxis
pline_2 = PolyLine(Vertices=[pt_6, shift_4], Closed=True)
addition_5 = Addition(A=multiplication, B=multiplication_2)
boundary = BoundarySurfaces(Edges=pline)
num_12 = Number(addition_5)
boundary_2 = BoundarySurfaces(Edges=pline_2)
amp = Amplitude(Vector=deplane_2.XAxis, Amplitude=楼梯宽度)
amp_2 = Amplitude(Vector=rev, Amplitude=num_12)
extr = Extrude(Base=boundary, Direction=amp_2)
extr_2 = Extrude(Base=boundary_2, Direction=amp)

random = Random(Range=Domain(0, 1), Number=1, Seed=2)
rtrig = RightTrigonometry()  # -> Alpha, Beta, PLength, QLength, RLength
