# Grasshopper definition 20160412_test.gh (Grasshopper 0.9.76)

genes = GenePool(Decimals=2, Maximum=450, Minimum=50, Value=[209.09, 450, 250, 250, 250, 250, 250, 250, 250, 250])
dispatch = Dispatch(List=genes, DispatchPattern=[True, False])  # -> ListA, ListB
division = Division(A=dispatch.ListA)
division_2 = Division()
int = Integer(division)
series = Series(Start=0, Step=1, Count=int)
pt = PointOriented(BasePlane=PlaneXY(0, 0, 0), UComponent=series, VComponent=0, WComponent=0)
series_2 = Series(Start=0, Step=1, Count=10)
genes_2 = GenePool(Decimals=2, Maximum=1000, Minimum=0, Value=[938.97, 176])
item = ListItem(List=series_2, Index=0, Wrap=True)
panel = Panel(series_2)
panel_2 = Panel(item)
panel_3 = Panel(genes_2)
dispatch_2 = Dispatch(List=genes_2, DispatchPattern=[True, False])  # -> ListA, ListB
dispatch_3 = Dispatch(List=genes_2, DispatchPattern=[True, False])  # -> ListA, ListB
md_slider = MDSlider(
    slider_value=Point(0.08577786216, 0.0926826291, 0.5),
    SliderMode=0,
    x_domain=Domain(0, 200),
    y_domain=Domain(0, 200),
    z_domain=Domain(0, 1))
division_3 = Division(A=dispatch_3.ListA, B=dispatch_3.ListB)
division_4 = Division(A=dispatch_2.ListA, B=dispatch_2.ListB)
subtraction = Subtraction(A=Slider(22.131, range=0..450), B=Slider(18.293, range=0..250))
int_2 = Integer(division_4)
panel_4 = Panel(int_2)
int_3 = Integer(division_3)
remap = RemapNumbers(Value=Slider(0.418, range=0..1), Source=Domain(0, 1), Target=Domain(0, 1))  # -> Mapped, Clipped
prot = RotatePlane(Plane=md_slider, Angle=remap.Mapped)
series_3 = Series(Start=int_2, Step=1, Count=10)
series_4 = Series(Start=int_3, Step=subtraction, Count=10)
panel_5 = Panel(series_3)
shift = ShiftList(List=prot, Shift=1, Wrap=True)
pt_2 = PointOriented(BasePlane=PlaneXY(0, 0, 0), UComponent=series_3, VComponent=0, WComponent=0)
item_2 = ListItem(List=shift, Index=0, Wrap=True)
pt_3 = PointOriented(BasePlane=item_2, UComponent=series_4, VComponent=0, WComponent=series_4)
Z = UnitZ(Factor=1)
move = Move(Geometry=pt_3, Motion=Z)  # -> Geometry, Transform
weave = Weave(Pattern=[0, 1], Stream0=move.Geometry, Stream1=move.Geometry, NullGaps=False)
series_5 = Series(Start=0, Step=1, Count=10)
number_slider = Slider(4.315, range=0..15)
panel_6 = Panel(series_5)
flatten = FlattenTree(Tree=series_5, Path="{0}")
item_3 = ListItem(List=flatten, Index=Slider(8, range=0..15), Wrap=True)
merge = Merge(Data1=Slider(12.538, range=0..15), Data2=number_slider, Data3=number_slider, Data4=number_slider)
item_4 = CherryPicker(merge, ListIndex=0)
pt_4 = ConstructPoint(XCoordinate=0, YCoordinate=flatten, ZCoordinate=0)
panel_7 = Panel(merge)
panel_8 = Panel(item_4)
series_6 = Series(Start=0, Step=1, Count=10)  # -> flatten(Series)
int_4 = Integer()
panel_9 = Panel(series_6)
partition = PartitionList(List=series_6, Size=int_4)  # -> simplify(Chunks)
series_7 = Series(Start=0, Step=1, Count=10)
panel_10 = Panel(series_7)
jitter = Jitter(List=series_7, Jitter=1, Seed=2)  # -> Values, Indices
sort = SortList(Keys=jitter.Values)  # -> Keys, ValuesA
panel_11 = Panel(jitter.Values)
panel_12 = Panel(sort.Keys)
pt_5 = ConstructPoint(XCoordinate=0, YCoordinate=0, ZCoordinate=0)
ma = MassAddition()  # -> Result, PartialResults
remap_2 = RemapNumbers(Source=Domain(0, 1), Target=Domain(0, 1))  # -> Mapped, Clipped
number_slider_2 = Slider(0.25, range=0..1)
prot_2 = RotatePlane()
dom = ConstructDomain(DomainStart=Slider(5000, range=0..10000), DomainEnd=Slider(2040, range=0..10000))
dom_2 = ConstructDomain(DomainStart=Slider(3640, range=0..10000), DomainEnd=Slider(2702, range=0..10000))
series_8 = Series(Start=[Slider(0.25, range=0..1), number_slider_2], Step=1, Count=10)
rectangle = Rectangle(Plane=prot, XSize=dom, YSize=dom_2, Radius=0)  # -> Rectangle, Length
panel_13 = Panel(rectangle.Rectangle)
pt_6 = PointOriented(BasePlane=PlaneXY(0, 0, 0), UComponent=number_slider_2, VComponent=0, WComponent=0)
pt_7 = ConstructPoint(XCoordinate=0, YCoordinate=0, ZCoordinate=0)
panel_14 = Panel(series_8)
crv = Curve(rectangle.Rectangle)
bang = ExplodeTree(Data=series_8)  # -> Branch0, Branch1
merge_2 = Merge()
int_5 = Integer(bang.Branch1)
pline = PolyLine(Closed=False)
boundary = BoundarySurfaces()
panel_15 = Panel(bang.Branch1)
panel_16 = Panel(bang.Branch0)
d = Slider(3000, range=0..10000)
s = Slider(20, range=0..100)
w = Slider(5661, range=0..10000)
multiplication = Multiplication(A=s, B=1000000)
repeat = RepeatData()
repeat_2 = RepeatData()
series_9 = Series(Start=0, Step=1, Count=10)
num = Number([multiplication, w, d])
ma_2 = MassAddition(Input=series_9)  # -> Result, PartialResults
rep = ReplaceText(RecursiveReplace=False)
rec = DataRecorder(num, DataLimit=-10, RecordData=True)
panel_17 = Panel(ma_2.PartialResults)
