# Grasshopper definition 20160419_stone_brik2.gh (Grasshopper 0.9.76)

md_slider = MDSlider(
    slider_value=Point(0.4999920293, 0.5198731306, 0.5),
    SliderMode=0,
    x_domain=Domain(-10000, 10000),
    y_domain=Domain(-10000, 10000),
    z_domain=Domain(0, 1))
seam = Panel("10")
briklength = Panel("240")
brikwidth = Panel("115")
brikheight = Panel("53")
genes = GenePool(Decimals=6, Maximum=1, Minimum=0, Value=[0.449411, 0.508571, 0.905882, 0.08647])
miniendlap = Panel("15")
minisidelap = Panel("60")
remap = RemapNumbers(Value=Slider(0, range=0..1), Source=Domain(0, 1), Target=Domain(0, 6.283185307))  # -> Mapped, Clipped
prot = RotatePlane(Plane=md_slider, Angle=remap.Mapped)
pln = Plane(prot)
bool = Boolean(Toggle(False))
num = Number(miniendlap)
int = Integer(brikwidth)
num_2 = Number(genes)
num_3 = Number(minisidelap)
num_4 = Number(seam)
int_2 = Integer(briklength)

eval = Evaluate(F="(y-x)/2", x=num_3, y=int)
neg = Negative(Value=eval)
eval_2 = Evaluate(F="(z-(2*y+x))/2", x=num_4, y=num, z=int_2)
num_5 = Number(0)
dom = ConstructDomain(DomainStart=[num_5, eval_2], DomainEnd=[eval_2, num_5])
dom_2 = ConstructDomain(DomainStart=neg, DomainEnd=eval)
ins = InsertItems(List=dom, Item=dom_2, Indices=[1, 2], Wrap=False)
pshift = ShiftPaths(Data=ins, Offset=-1)
remap_2 = RemapNumbers(Value=num_2, Source=Domain(0, 1), Target=pshift)  # -> Mapped, Clipped
item = ListItem(List=remap_2.Mapped, Index=[0, 2], Wrap=False)
eval_3 = Evaluate(F="y-x", x=item, y=eval_2)
bang = ExplodeTree(Data=simplify(graft(remap_2.Mapped)))  # -> Branch0, Branch1, Branch2, Branch3
bang_2 = ExplodeTree(Data=simplify(graft(eval_3)))  # -> Branch0, Branch1
replace = ReplaceMembers(Set=bool, Find=[False, True], Replace=[-1, 1])
filter = StreamFilter(Gate=bool, Stream0=bang.Branch0, Stream1=bang_2.Branch1)
filter_2 = StreamFilter(Gate=bool, Stream0=bang_2.Branch0, Stream1=bang.Branch2)
filter_3 = StreamFilter(Gate=bool, Stream0=bang.Branch1, Stream1=bang.Branch3)
neg_2 = Negative(Value=replace)
ma = MassAddition(Input=flatten([bang.Branch2, bang_2.Branch0, num_4, num]))  # -> Result, PartialResults
not = GateNot(A=bool)
eval_4 = Evaluate(F="v*(x+y+z+1.5*u)", x=filter_2, y=eval_2, z=num_4, u=num, v=neg_2)
eval_5 = Evaluate(F="x*z+y", x=bang.Branch1, y=bang.Branch3, z=replace)
eval_6 = Evaluate(F="y*z+x", x=bang.Branch1, y=bang.Branch3, z=neg_2)
eval_7 = Evaluate(F="z*(x+y/2)", x=filter, y=num, z=replace)
filter_4 = StreamFilter(Gate=bool, Stream0=eval_5, Stream1=eval_6)
multiplication = Multiplication(A=ma.Result, B=neg_2)
sift = SiftPattern(List=eval_7, SiftPattern=bool)  # -> Output0, Output1
sift_2 = SiftPattern(List=eval_4, SiftPattern=not)  # -> Output0, Output1
eval_8 = Evaluate(F="-1*y/2-x", x=filter_3, y=int)
pt = PointOriented(BasePlane=pln, UComponent=multiplication, VComponent=filter_4, WComponent=0)
clean = CleanTree(RemoveNulls=True, RemoveInvalid=True, RemoveEmpty=True, Tree=[sift.Output0, sift_2.Output0])
clean_2 = CleanTree(RemoveNulls=True, RemoveInvalid=True, RemoveEmpty=True, Tree=[sift.Output1, sift_2.Output1])
addition = Addition(A=eval_8, B=int)
dom_3 = ConstructDomain(DomainStart=clean, DomainEnd=clean_2)
dom_4 = ConstructDomain(DomainStart=eval_8, DomainEnd=addition)

pl_origin = PlaneOrigin(Base=pln, Origin=pt)
rectangle = Rectangle(Plane=pln, XSize=dom_3, YSize=dom_4, Radius=0)  # -> Rectangle, Length
