# Grasshopper definition 20160503_矩形房间切分.gh (Grasshopper 0.9.76)

md_slider = MDSlider(slider_value=Point(0, 0, 0.5), SliderMode=0, x_domain=Domain(0, 100), y_domain=Domain(0, 100), z_domain=Domain(0, 1))
w = Slider(1233, range=0..5000)
d = Slider(2265, range=0..5000)

num = Number(w)
num_2 = Number(d)

xy = XYPlane(Origin=md_slider)
remap = RemapNumbers(Value=Slider(0, range=0..1), Source=Domain(0, 1), Target=Domain(0, 6.283185307))  # -> Mapped, Clipped
prot = RotatePlane(Plane=xy, Angle=remap.Mapped)

multiplication = Multiplication(A=Slider(397, range=0..1000), B=10000)
num_3 = Number(graft([num, num_2]))
rec = DataRecorder(num_3, DataLimit=2, RecordData=True)
split = SplitList(List=rec, Index=1)  # -> ListA, ListB
subtraction = Subtraction(A=split.ListA, B=split.ListB)
bool = Boolean(flatten(subtraction))
mindex = MemberIndex(Set=bool, Member=True)  # -> Index, Count
mindex_2 = MemberIndex(Set=bool, Member=True)  # -> Index, Count
rec_2 = DataRecorder(mindex.Index, DataLimit=1, RecordData=True)
rec_3 = DataRecorder(mindex_2.Index, DataLimit=1, RecordData=True)

panel = Panel(bool)

number_slider = Slider(522.013, range=0..1000)
panel_2 = Panel("500")

larger = LargerThan(FirstNumber=number_slider, SecondNumber="600")  # -> LargerThan, OrEqualTo
smaller = SmallerThan(FirstNumber=number_slider, SecondNumber="600")  # -> SmallerThan, OrEqualTo
bool_2 = Boolean([larger.OrEqualTo, smaller.OrEqualTo])
panel_3 = Panel(bool_2)
mindex_3 = MemberIndex(Set=bool_2, Member=True)  # -> Index, Count

filter = StreamFilter(Gate=rec_3, Stream1=num_2)
filter_2 = StreamFilter(Gate=rec_2, Stream0=num)
filter_3 = StreamFilter(Gate=rec_2, Stream0=num)
filter_4 = StreamFilter(Gate=rec_3, Stream1=num_2)

rec_4 = DataRecorder(mindex_3.Index, DataLimit=1, RecordData=True)
division = Division(A=multiplication, B=filter_3)
smaller_2 = SmallerThan(FirstNumber=number_slider, SecondNumber="600")  # -> SmallerThan, OrEqualTo
division_2 = Division(A=multiplication, B=filter_4)
panel_4 = Panel(filter_3)
panel_5 = Panel(filter_4)
number_slider_2 = Slider(560.75, range=0..1001)

stack = StackData(Data=[division, "0", filter], Stack=2)
stack_2 = StackData(Data=["0", division_2, filter_2], Stack=2)
shift = ShiftList(List=stack, Shift=1, Wrap=True)
shift_2 = ShiftList(List=stack_2, Shift=1, Wrap=True)
consec = ConsecutiveDomains(Numbers=shift_2, Additive=False)  # -> flatten(Domains)
consec_2 = ConsecutiveDomains(Numbers=shift, Additive=False)  # -> flatten(Domains)
rectangle = Rectangle(Plane=prot, XSize=consec_2, YSize=consec, Radius=0)  # -> Rectangle, Length

panel_6 = Panel(smaller_2.OrEqualTo)
panel_7 = Panel(stack)
filter_5 = StreamFilter(Gate=smaller_2.OrEqualTo, Stream0=number_slider, Stream1="600")
num_4 = Number([division, filter_4])
number_slider_3 = Slider(498.646, range=-1520..1520.001)
panel_8 = Panel(consec_2)
panel_9 = Panel(consec)
num_5 = Number(graft([number_slider_3, number_slider]))

subtraction_2 = Subtraction(A=num_4, B=filter_5)
multiplication_2 = Multiplication(A=subtraction_2, B=0.2)
multiplication_3 = Multiplication(A=subtraction_2, B=0.8)
addition = Addition(A=filter_5, B=multiplication_2)
addition_2 = Addition(A=addition, B=multiplication_3)

panel_11 = Panel(addition)
addition_3 = Addition(A=panel_11, B=number_slider_3)

rec_5 = DataRecorder(num_5, DataLimit=2, RecordData=True)
split_2 = SplitList(List=rec_5, Index=1)  # -> ListA, ListB
subtraction_3 = Subtraction(A=split_2.ListA, B=split_2.ListB)
bool_3 = Boolean(flatten(subtraction_3))
mindex_4 = MemberIndex(Set=bool_3, Member=True)  # -> Index, Count
mindex_5 = MemberIndex(Set=bool_3, Member=True)  # -> Index, Count
rec_6 = DataRecorder(mindex_4.Index, DataLimit=1, RecordData=True)
rec_7 = DataRecorder(mindex_5.Index, DataLimit=1, RecordData=True)
filter_6 = StreamFilter(Gate=rec_6, Stream1="1")
filter_7 = StreamFilter(Gate=rec_7, Stream0="1")
filter_8 = StreamFilter(Gate=[filter_7, filter_6], Stream0=addition, Stream1=addition_3)

dom = ConstructDomain(DomainStart=0, DomainEnd=Slider(502.632, range=0..1001))
dom_2 = ConstructDomain(DomainStart=0, DomainEnd=Slider(337.838, range=0..1001))
panel_12 = Panel(multiplication_3)
number_slider_4 = Slider(-26, range=-1001..0)
addition_4 = Addition(A=filter_5, B="600")
offset = Offset(Curve=rectangle.Rectangle, Distance=number_slider_4, Plane=PlaneXY(0, 0, 0), Corners=1)
larger_2 = LargerThan(FirstNumber=filter_8, SecondNumber=addition_4)  # -> LargerThan, OrEqualTo
filter_9 = StreamFilter(Gate=larger_2.OrEqualTo, Stream0=addition_4, Stream1=filter_8)
dom_3 = ConstructDomain(DomainStart=filter_5, DomainEnd=filter_9)
dom_4 = ConstructDomain(DomainStart=filter_9, DomainEnd=addition_2)
rectangle_2 = Rectangle(Plane=prot, XSize=[dom_3, dom_4, filter_5], YSize=[Slider(726.871, range=0..1001), dom_2, dom], Radius=0)  # -> Rectangle, Length
offset_2 = Offset(Curve=rectangle_2.Rectangle, Distance=number_slider_4, Plane=PlaneXY(0, 0, 0), Corners=1)
panel_13 = Panel(filter_9)
