# Grasshopper definition 20160517_新砖墙形成.gh (Grasshopper 0.9.76)

md_slider = MDSlider(
    slider_value=Point(0.4736444178, 0.4288106779, 0.5),
    SliderMode=0,
    x_domain=Domain(-1000, 1000),
    y_domain=Domain(-1000, 1000),
    z_domain=Domain(0, 1))
pt = PointOriented(BasePlane=md_slider, UComponent=0, VComponent=0, WComponent=0)
number_slider = Slider(143, range=0..240)
prot = RotatePlane(Plane=pt, Angle=Slider(0.314, range=0..1))
pl_origin = PlaneOrigin(Base=prot, Origin=pt)
pt_2 = PointOriented(BasePlane=pl_origin, UComponent=number_slider, VComponent=0, WComponent=0)
pl_origin_2 = PlaneOrigin(Base=prot, Origin=pt_2)
subtraction = Subtraction(A=Slider(240, range=0..1000), B=number_slider)
division = Division(A=number_slider, B=2)
division_2 = Division(A=subtraction, B=2)
division_3 = Division(A=Slider(115, range=0..1000), B=2)
multiplication = Multiplication(A=division, B=-1)
multiplication_2 = Multiplication(A=division_3, B=-1)
multiplication_3 = Multiplication(A=division_2, B=-1)
dom = ConstructDomain(DomainStart=multiplication_2, DomainEnd=division_3)
dom_2 = ConstructDomain(DomainStart=multiplication, DomainEnd=division_2)
dom_3 = ConstructDomain(DomainStart=multiplication_3, DomainEnd=division)
rectangle = Rectangle(Plane=pl_origin, XSize=dom_3, YSize=dom, Radius=0)  # -> Rectangle, Length
rectangle_2 = Rectangle(Plane=pl_origin_2, XSize=dom_2, YSize=dom, Radius=0)  # -> Rectangle, Length
boundary = BoundarySurfaces(Edges=[rectangle_2.Rectangle, rectangle.Rectangle])
Z = UnitZ(Factor=Slider(53, range=0..100))
extr = Extrude(Base=boundary, Direction=Z)
panel = Panel(Z)

Z_2 = UnitZ(Factor=Slider(53, range=0..100))

md_slider_2 = MDSlider(
    slider_value=Point(0.2953506563, 0.1894054878, 0.5),
    SliderMode=0,
    x_domain=Domain(0, 1000),
    y_domain=Domain(0, 1000),
    z_domain=Domain(0, 1))
remap = RemapNumbers(Value=Slider(0, range=0..1), Source=Domain(0, 1), Target=Domain(0, 6.283185307))  # -> Mapped, Clipped
pt_3 = Point(md_slider_2)
prot_2 = RotatePlane(Plane=pt_3, Angle=remap.Mapped)
pt_4 = PointOriented(BasePlane=prot_2, UComponent=[Slider(0, range=0..100), Slider(792, range=0..10000)], VComponent=0, WComponent=0)
number_slider_2 = Slider(276, range=0..1000)
genes = GenePool(Decimals=2, Maximum=115, Minimum=0, Value=[53.42, 78.26])
intcrv = Interpolate(Vertices=pt_4, Degree=3, Periodic=False, KnotStyle=1)  # -> Curve, Length, Domain

number_slider_3 = Slider(10, range=10..200)
subtraction_2 = Subtraction(A=240, B=number_slider_3)
panel_2 = Panel([Slider(57.5, range=-102..101), Slider(-57.5, range=-101..100)])
remap_2 = RemapNumbers(Value=Slider(0, range=0..1), Source=Domain(0, 1), Target=Domain(0, 6.283185307))  # -> Mapped, Clipped
division_4 = Division(A=subtraction_2, B=-4)

multiplication_4 = Multiplication(A=division_4, B=-2)
multiplication_5 = Multiplication(A=division_4, B=-1)
subtraction_3 = Subtraction(A=240, B=multiplication_4)

addition = Addition(A=number_slider_3, B=subtraction_3, C=multiplication_4)

divdist = DivideDistance(Curve=intcrv.Curve, Distance=addition)  # -> graft(Points), Tangents, Parameters

pt_5 = Point(divdist.Points)
prot_3 = RotatePlane(Plane=pt_5, Angle=remap_2.Mapped)
pt_6 = PointOriented(BasePlane=prot_3, UComponent=division_4, VComponent=panel_2, WComponent=0)  # -> reverse(Point)
pt_7 = PointOriented(BasePlane=prot_3, UComponent=subtraction_3, VComponent=0, WComponent=0)
prot_4 = RotatePlane(Plane=pt_7, Angle=remap_2.Mapped)
pt_8 = PointOriented(BasePlane=prot_4, UComponent=multiplication_5, VComponent=panel_2, WComponent=0)

pt_9 = PointOriented(BasePlane=prot_4, UComponent=0, VComponent=0, WComponent=genes)
intcrv_2 = Interpolate(Vertices=pt_9, Degree=3, Periodic=False, KnotStyle=1)  # -> Curve, Length, Domain
divdist_2 = DivideDistance(Curve=intcrv_2.Curve, Distance=Slider(65, range=0..100))  # -> Points, Tangents, Parameters

pline = PolyLine(Vertices=[pt_8, pt_6], Closed=True)
Z_3 = UnitZ(Factor=Slider(53, range=0..100))
boundary_2 = BoundarySurfaces(Edges=pline)
extr_2 = Extrude(Base=boundary_2, Direction=Z_3)

panel_3 = Panel(divdist.Points)
pl_offset = PlaneOffset(BasePlane=prot_4, Offset=Z_2)

number_slider_4 = Slider(74, range=10..200)
subtraction_4 = Subtraction(A=240, B=number_slider_3)
panel_4 = Panel([Slider(57.5, range=-102..101), Slider(-57.5, range=-101..100)])
pt_10 = Point(graft(divdist_2.Points))
remap_3 = RemapNumbers(Value=Slider(0, range=0..1.001), Source=Domain(0, 1), Target=Domain(0, 6.283185307))  # -> Mapped, Clipped
division_5 = Division(A=subtraction_4, B=-4)
prot_5 = RotatePlane(Plane=pt_10, Angle=remap_3.Mapped)
pt_11 = PointOriented(BasePlane=prot_5, UComponent=division_5, VComponent=panel_4, WComponent=0)  # -> reverse(Point)

multiplication_6 = Multiplication(A=division_5, B=-2)
multiplication_7 = Multiplication(A=division_5, B=-1)
subtraction_5 = Subtraction(A=240, B=multiplication_6)

pt_12 = PointOriented(BasePlane=prot_5, UComponent=subtraction_5, VComponent=0, WComponent=0)
prot_6 = RotatePlane(Plane=pt_12, Angle=remap_3.Mapped)
pt_13 = PointOriented(BasePlane=prot_6, UComponent=multiplication_7, VComponent=panel_4, WComponent=0)

pline_2 = PolyLine(Vertices=[pt_13, pt_11], Closed=True)
Z_4 = UnitZ(Factor=Slider(53, range=0..100))
boundary_3 = BoundarySurfaces(Edges=pline_2)
extr_3 = Extrude(Base=boundary_3, Direction=Z_4)
