# Grasshopper definition 20160517_旋转碰撞规则.gh (Grasshopper 0.9.76)

间距 = Slider(73, range=10..200)
panel = Panel("将共轭点的相对位置关系输入")
division = Division(A=间距, B=2)
division_2 = Division(B=2)
panel_2 = Panel("再将长度转化为角度")
remap = RemapNumbers(Value=Slider(1, range=0..1), Source=Domain(0, 1), Target=Domain(0, 6.283185307))  # -> Mapped, Clipped
pt = PointOriented(BasePlane=PlaneXY(0, 0, 0), UComponent=0, VComponent=0, WComponent=0)
Z = UnitZ(Factor=Slider(53, range=0..100))

旋转角度调节 = Slider(0.003, range=-0.5..0.5)
remap_2 = RemapNumbers(Value=旋转角度调节, Source=Domain(0, 1), Target=Domain(0, 6.283185307))  # -> Mapped, Clipped
larger = LargerThan(FirstNumber=旋转角度调节, SecondNumber=0)  # -> LargerThan, OrEqualTo

number_slider = Slider(57.5, range=0..100)
共轭点间距 = Slider(23, range=0..100)
共点到边距 = Slider(15, range=0..100)
sqr = Square(Value=number_slider)

panel_3 = Panel([Slider(57.5, range=-102..101), Slider(-57.5, range=-101..100)])
subtraction = Subtraction(A=240, B=division)
division_3 = Division(A=subtraction, B=4)

multiplication = Multiplication(A=division_3, B=2)
multiplication_2 = Multiplication(A=division_3, B=-1)
subtraction_2 = Subtraction(A=240, B=multiplication)

addition = Addition(A=division, B=multiplication)
panel_4 = Panel(addition)

sqr_2 = Square(Value=division_3)
addition_2 = Addition(A=sqr_2, B=sqr)
sqrt = SquareRoot(Value=addition_2)
division_4 = Division(A=number_slider, B=sqrt)
trig = TriangleTrigonometry(PLength=panel_4, QLength=sqrt, RLength=sqrt)  # -> Alpha, Beta, Gamma, PLength, QLength, RLength
asin = ArcSine(Value=division_4)
subtraction_3 = Subtraction(A=asin, B=trig.Beta)
multiplication_3 = Multiplication(A=subtraction_3, B=-1)

multiplication_4 = Multiplication(A=subtraction_2, B=-1)
panel_5 = Panel(multiplication_3)

smaller = SmallerThan(FirstNumber=multiplication_3, SecondNumber=remap_2.Mapped)  # -> SmallerThan, OrEqualTo
larger_2 = LargerThan(FirstNumber=subtraction_3, SecondNumber=remap_2.Mapped)  # -> LargerThan, OrEqualTo
filter = StreamFilter(Gate=smaller.OrEqualTo, Stream0=multiplication_3, Stream1=remap_2.Mapped)
filter_2 = StreamFilter(Gate=larger_2.LargerThan, Stream0=subtraction_3, Stream1=remap_2.Mapped)
filter_3 = StreamFilter(Gate=larger.OrEqualTo, Stream0=filter, Stream1=filter_2)
panel_6 = Panel(filter_3)

multiplication_5 = Multiplication(A=sqrt, B=2)

multiplication_6 = Multiplication(A=division_3, B=2)
subtraction_4 = Subtraction(A=panel_4, B=multiplication_6)
larger_3 = LargerThan(FirstNumber=panel_4, SecondNumber=multiplication_5)  # -> LargerThan, OrEqualTo
filter_4 = StreamFilter(Gate=larger_3.OrEqualTo, Stream0=filter_3, Stream1=remap_2.Mapped)
panel_7 = Panel(filter_4)

panel_8 = Panel(larger_3.OrEqualTo)
panel_9 = Panel(filter_4)
multiplication_7 = Multiplication(A=panel_9, B=-1)
prot = RotatePlane(Plane=pt, Angle=filter_4)

md_slider = MDSlider(
    slider_value=Point(0.2953506563, 0.1894054878, 0.5),
    SliderMode=0,
    x_domain=Domain(0, 1000),
    y_domain=Domain(0, 1000),
    z_domain=Domain(0, 1))
remap_3 = RemapNumbers(Value=Slider(0, range=0..1), Source=Domain(0, 1), Target=Domain(0, 6.283185307))  # -> Mapped, Clipped
pt_2 = Point(md_slider)
prot_2 = RotatePlane(Plane=pt_2, Angle=remap_3.Mapped)
pt_3 = PointOriented(BasePlane=prot_2, UComponent=[Slider(0, range=0..100), Slider(233, range=0..10000)], VComponent=0, WComponent=0)
number_slider_2 = Slider(728, range=0..1000)
genes = GenePool(Decimals=2, Maximum=115, Minimum=0, Value=[53.42, 78.26])
intcrv = Interpolate(Vertices=pt_3, Degree=3, Periodic=False, KnotStyle=1)  # -> Curve, Length, Domain
divdist = DivideDistance(Curve=intcrv.Curve, Distance=addition)  # -> flatten(Points), Tangents, Parameters

shift = ShiftList(List=divdist.Points, Shift=-1, Wrap=False)

pt_4 = Point(graft(shift))
prot_3 = RotatePlane(Plane=pt_4, Angle=multiplication_7)
pt_5 = PointOriented(BasePlane=graft(prot_3), UComponent=division_3, VComponent=panel_3, WComponent=0)  # -> reverse(Point)
pt_6 = PointOriented(BasePlane=graft(prot_3), UComponent=multiplication_4, VComponent=0, WComponent=0)
prot_4 = RotatePlane(Plane=pt_6, Angle=multiplication_7)
pt_7 = PointOriented(BasePlane=prot_4, UComponent=multiplication_2, VComponent=panel_3, WComponent=0)

pline = PolyLine(Vertices=[pt_7, pt_5], Closed=True)
Z_2 = UnitZ(Factor=Slider(53, range=0..100))
boundary = BoundarySurfaces(Edges=pline)
extr = Extrude(Base=boundary, Direction=Z_2)

shift_2 = ShiftList(List=divdist.Points, Shift=1, Wrap=False)

pt_8 = PointOriented(BasePlane=prot_4, UComponent=0, VComponent=0, WComponent=genes)
intcrv_2 = Interpolate(Vertices=pt_8, Degree=3, Periodic=False, KnotStyle=1)  # -> Curve, Length, Domain
divdist_2 = DivideDistance(Curve=intcrv_2.Curve, Distance=Slider(58, range=0..100))  # -> Points, Tangents, Parameters

pt_9 = Point(graft(shift_2))

number_slider_3 = Slider(10, range=10..200)
subtraction_5 = Subtraction(A=240, B=division)
panel_10 = Panel([Slider(57.5, range=-102..101), Slider(-57.5, range=-101..100)])
division_5 = Division(A=subtraction_5, B=-4)
prot_5 = RotatePlane(Plane=pt_9, Angle=panel_9)
pt_10 = PointOriented(BasePlane=graft(prot_5), UComponent=division_5, VComponent=panel_10, WComponent=0)  # -> reverse(Point)

multiplication_8 = Multiplication(A=division_5, B=-2)
multiplication_9 = Multiplication(A=division_5, B=-1)
subtraction_6 = Subtraction(A=240, B=multiplication_8)

pt_11 = PointOriented(BasePlane=graft(prot_5), UComponent=subtraction_6, VComponent=0, WComponent=0)
prot_6 = RotatePlane(Plane=pt_11, Angle=panel_9)
pt_12 = PointOriented(BasePlane=prot_6, UComponent=multiplication_9, VComponent=panel_10, WComponent=0)

pline_2 = PolyLine(Vertices=[pt_12, pt_10], Closed=True)
Z_3 = UnitZ(Factor=Slider(53, range=0..100))
boundary_2 = BoundarySurfaces(Edges=pline_2)
extr_2 = Extrude(Base=boundary_2, Direction=Z_3)

pl_offset = PlaneOffset(BasePlane=prot_6, Offset=Z)
