# Grasshopper definition 20160530_楼梯单独旋转控制.gh (Grasshopper 0.9.76)

number_slider = Slider(4, range=0..10)
int = Integer(Slider(5, range=0..10))
int_2 = Integer(number_slider)
series = Series(Start=0, Step=1, Count=number_slider)
series_2 = Series(Start=0, Step=1, Count=int)  # -> graft(Series)
series_3 = Series(Start=0, Step=1, Count=int_2)  # -> flatten(Series)
int_3 = Integer(graft(series))
int_4 = Integer(Slider(0, range=0..100))
int_5 = Integer(series_2)
panel = Panel("""0
1""")
int_6 = Integer(series_3)
pshift = ShiftPaths(Data=int_5, Offset=2)
concat = Concatenate(FragmentC=int_4, FragmentA=int_3, FragmentB=panel)  # -> flatten(Result)
concat_2 = Concatenate(FragmentA=pshift, FragmentB=int_6)
panel_2 = Panel(concat_2)
panel_3 = Panel(concat)
chars = Characters(Text=concat_2)  # -> Result, Unicode
chars_2 = Characters(Text=concat)  # -> Result, Unicode
path = ConstructPath(Indices=chars.Result)  # -> flatten(Branch)
path_2 = ConstructPath(Indices=chars_2.Result)  # -> flatten(Branch)
panel_4 = Panel(chars.Result)
series_4 = Series(Start=0, Step=1, Count=Slider(4, range=0..10))  # -> flatten(Series)
series_5 = Series(Start=0, Step=1, Count=Slider(4, range=0..10))
series_6 = Series(Start=0, Step=1, Count=Slider(2, range=0..10))  # -> flatten(Series)
lng = ListLength(List=path)
int_7 = Integer(graft(series_5))
panel_5 = Panel(series_4)
panel_6 = Panel(lng)
panel_7 = Panel(path_2)
series_7 = Series(Start=0, Step=1, Count=lng)  # -> graft(Series)
pshift_2 = ShiftPaths(Data=int_7, Offset=2)
panel_8 = Panel(path)
panel_9 = Panel(series_7)
concat_3 = Concatenate(FragmentA=pshift_2, FragmentB=series_4)  # -> graft(Result)
pshift_3 = ShiftPaths(Data=series_7, Offset=2)
panel_10 = Panel(pshift_2)
concat_4 = Concatenate(FragmentA=concat_3, FragmentB=series_6)  # -> graft(Result)
panel_11 = Panel(pshift_3)
replace = ReplaceItems(List=pshift_2, Item=[0, 1], Indices=0, Wrap=False)
replace_2 = ReplaceItems(List=pshift_3, Item=[0, 1], Indices=0, Wrap=False)
viewer = ParamViewer(replace)
panel_12 = Panel(concat_4)
viewer_2 = ParamViewer(replace_2)
replace_3 = ReplacePaths(Data=replace, Search=viewer)
panel_13 = Panel(replace_2)
panel_14 = Panel(viewer_2)
replace_4 = ReplacePaths(Data=replace_2, Search=viewer_2, Replace=path)  # -> graft(Data)
panel_15 = Panel(viewer)
viewer_3 = ParamViewer(replace_4)
panel_16 = Panel(replace_4)
branch = TreeBranch(MaintainPaths=True)
item = TreeItem(Index=0, Wrap=True)
split = SplitTree(Data=replace_4, Masks=flatten(path_2))  # -> Positive, Negative
Z = UnitZ(Factor=graft("106"))

genes = GenePool(Decimals=2, Maximum=1, Minimum=0, Value=[0.22, 0.61, 0.19, 0.35, 0.45, 0.7, 0.13, 0.93])
md_slider = MDSlider(slider_value=Point(0, 0, 0.5), SliderMode=0, x_domain=Domain(0, 1), y_domain=Domain(0, 1), z_domain=Domain(0, 1))

num = Number(genes)

division = Division(A=Slider(39, range=0..100), B=2)
division_2 = Division(A=Slider(45, range=0..100), B=2)
addition = Addition(A=division, B=division_2)
subtraction = Subtraction(A="240", B=addition)

panel_17 = Panel(subtraction)

prot = RotatePlane(Plane=md_slider, Angle=Slider(0, range=0..1))

division_3 = Division(A="115", B=2)
multiplication = Multiplication(A=division_2, B=-1)
multiplication_2 = Multiplication(A=division, B=-1)
subtraction_2 = Subtraction(A="240", B=division)
subtraction_3 = Subtraction(A="240", B=division_2)
multiplication_3 = Multiplication(A=division_3, B=-1)
dom = ConstructDomain(DomainStart=multiplication_3, DomainEnd=division_3)

dom_2 = ConstructDomain(DomainStart=multiplication_2, DomainEnd=subtraction_2)
dom_3 = ConstructDomain(DomainStart=multiplication, DomainEnd=subtraction_3)

addition_2 = Addition(A=num)
sin = Sine(Value=addition_2)
cos = Cosine(Value=addition_2)
dispatch = Dispatch(List=addition_2, DispatchPattern=[True, False])  # -> ListA, ListB
multiplication_4 = Multiplication(A=sin, B=panel_17)
multiplication_5 = Multiplication(A=cos, B=panel_17)
ma = MassAddition(Input=multiplication_4)  # -> Result, PartialResults
ma_2 = MassAddition(Input=multiplication_5)  # -> Result, PartialResults
ins = InsertItems(List=0, Item=ma.PartialResults, Indices=1, Wrap=True)
ins_2 = InsertItems(List=0, Item=ma_2.PartialResults, Indices=1, Wrap=True)

shift = ShiftList(List=ins, Shift=-1, Wrap=False)
shift_2 = ShiftList(List=ins_2, Shift=-1, Wrap=False)

dispatch_2 = Dispatch(List=shift, DispatchPattern=[True, False])  # -> ListA, ListB
dispatch_3 = Dispatch(List=shift_2, DispatchPattern=[True, False])  # -> ListA, ListB

panel_18 = Panel(dispatch_2.ListA)
int_8 = Integer(graft(panel_18))
int_9 = Integer(graft(dispatch_2.ListB))

pt = PointOriented(BasePlane=prot, UComponent=dispatch_3.ListB, VComponent=dispatch_2.ListB, WComponent="53")
pt_2 = PointOriented(BasePlane=prot, UComponent=dispatch_3.ListA, VComponent=dispatch_2.ListA, WComponent=0)
prot_2 = RotatePlane(Plane=pt_2, Angle=dispatch.ListA)
prot_3 = RotatePlane(Plane=pt, Angle=dispatch.ListB)
rectangle = Rectangle(Plane=prot_2, XSize=dom_2, YSize=dom, Radius=0)  # -> Rectangle, Length
rectangle_2 = Rectangle(Plane=prot_3, XSize=dom_3, YSize=dom, Radius=0)  # -> Rectangle, Length
Z_2 = UnitZ(Factor="53")
extr = Extrude(Base=[rectangle.Rectangle, rectangle_2.Rectangle], Direction=Z_2)

int_10 = Integer(flatten([int_8, int_9]))
panel_19 = Panel(int_9)
panel_20 = Panel(int_10)
replace_5 = ReplaceItems(List=split.Positive, Item=graft(panel_20), Indices=0, Wrap=False)
trim = TrimTree(Tree=replace_5, Depth=1)
panel_21 = Panel(trim)
move = Move(Geometry=extr, Motion=Z)  # -> Geometry, Transform
