# Grasshopper definition 20160531_砖墙.gh (Grasshopper 0.9.76)

md_slider = MDSlider(slider_value=Point(0, 0, 0.5), SliderMode=0, x_domain=Domain(0, 1000), y_domain=Domain(0, 1000), z_domain=Domain(0, 1))
brikwidth = Panel("115")
genes = GenePool(Decimals=6, Maximum=1, Minimum=0, Value=[1, 1, 1, 1, 1, 1, 1, 1, 0.5, 0.5])
genes_2 = GenePool(Decimals=6, Maximum=1, Minimum=0, Value=[1, 1, 1, 1, 1, 1, 1, 1, 1, 0, 0.5])
seam = Panel("10")
miniendlap = Panel("15")
briklength = Panel("240")
int = Integer(brikwidth)
brikthickness = Panel("53")
planeseam = Panel("9")
num = Number(Slider(0, range=0..1))
brikthickness_2 = Panel("53")
int_2 = Integer(brikthickness)
int_3 = Integer(planeseam)
remap = RemapNumbers(Value=num, Source=Domain(0, 1), Target=Domain(0, 6.283185307))  # -> Mapped, Clipped
int_4 = Integer(int)

int_5 = Integer(Slider(6, range=1..11))
num_2 = Number(genes_2)
num_3 = Number(genes)
num_4 = Number(miniendlap)
num_5 = Number(seam)
int_6 = Integer(briklength)
series = Series(Start=0, Step=1, Count=expr("x-1", int_5))
eval = Evaluate(F="z-(2*y+x)", x=num_5, y=num_4, z=int_6)
addition = Addition(A=num_5, B=num_4)
series_2 = Series(Start=0, Step=1, Count=int_5)
addition_2 = Addition(A=addition, B=eval)
pshift = ShiftPaths(Data=series_2, Offset=1)
pshift_2 = ShiftPaths(Data=series, Offset=1)
item = ListItem(List=num_3, Index=pshift_2, Wrap=False)
item_2 = ListItem(List=num_2, Index=pshift, Wrap=False)
dom = ConstructDomain(DomainStart=addition, DomainEnd=addition_2)
remap_2 = RemapNumbers(Value=item, Source=Domain(0, 1), Target=dom)  # -> Mapped, Clipped
remap_3 = RemapNumbers(Value=item_2, Source=Domain(0, 1), Target=dom)  # -> Mapped, Clipped

int_7 = Integer(brikthickness_2)
pt = Point(md_slider)
int_8 = Integer(int_2)
int_9 = Integer(int_3)
int_10 = Integer(Slider(8, range=1..11))
division = Division(A=int_4, B=2)
int_11 = Integer(int_7)
prot = RotatePlane(Plane=pt, Angle=remap.Mapped)
addition_3 = Addition(A=int_8, B=int_9)
neg = Negative(Value=division)
dom_2 = ConstructDomain(DomainStart=neg, DomainEnd=division)
deplane = DeconstructPlane(Plane=prot)  # -> Origin, XAxis, YAxis, ZAxis
amp = Amplitude(Vector=deplane.ZAxis, Amplitude=int_11)
series_3 = Series(Start=0, Step=2, Count=expr("x/2+0.5", int_10))
series_4 = Series(Start=1, Step=2, Count=expr("x/2", int_10))
weave = Weave(Pattern=[0, 1], Stream0=remap_3.Mapped, Stream1=remap_2.Mapped, NullGaps=False)
series_5 = Series(Start=0, Step=addition_3, Count=int_10)  # -> graft(Series)
merge = Merge(Data1=0, Data2=weave)
domain = Domain(dom_2)
pshift_3 = ShiftPaths(Data=series_5, Offset=2)
ma = MassAddition(Input=merge)  # -> Result, PartialResults
domain_2 = Domain(domain)
pt_2 = PointOriented(BasePlane=prot, UComponent=ma.PartialResults, VComponent=0, WComponent=pshift_3)
branch = TreeBranch(Tree=pt_2, Path=series_4, MaintainPaths=True)
branch_2 = TreeBranch(Tree=pt_2, Path=series_3, MaintainPaths=True)
shift = ShiftList(List=branch, Shift=-1, Wrap=False)
shift_2 = ShiftList(List=shift, Shift=1, Wrap=False)
series_6 = Series(Start=0, Step=2, Count=int_5)
clean = CleanTree(RemoveNulls=True, RemoveInvalid=True, RemoveEmpty=True, Tree=branch_2)
pshift_4 = ShiftPaths(Data=shift_2, Offset=-2)
merge_2 = Merge(Data1=clean, Data2=pshift_4)
item_3 = ListItem(List=merge_2, Index=series_6, Wrap=Toggle(True))
clean_2 = CleanTree(RemoveNulls=True, RemoveInvalid=True, RemoveEmpty=False, Tree=item_3)
eval_2 = Evaluate(F="-1*(x/2+y)", x=num_4, y=Slider(0, range=0..1))
addition_4 = Addition(A=eval_2, B=int_6)
pl_origin = PlaneOrigin(Base=prot, Origin=clean_2)  # -> simplify(graft(Plane))
lng = ListLength(List=flatten(clean_2))
panel = Panel(pl_origin)
dom_3 = ConstructDomain(DomainStart=eval_2, DomainEnd=addition_4)
panel_2 = Panel(dom_3)
rectangle = Rectangle(Plane=pl_origin, XSize=dom_3, YSize=domain_2, Radius=0)  # -> Rectangle, Length
extr = Extrude(Base=rectangle.Rectangle, Direction=amp)  # disabled
genes_3 = GenePool(Decimals=1, Maximum=1, Minimum=0, Value=[0.2, 0, 0, 0, 0, 0, 0, 0, 0, 0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])
series_7 = Series(Start=0, Step=1, Count=lng)  # -> graft(Series)
pshift_5 = ShiftPaths(Data=series_7, Offset=2)
item_4 = ListItem(List=genes_3, Index=pshift_5, Wrap=True)
remap_4 = RemapNumbers(Value=item_4, Source=Domain(0, 1), Target=eval)  # -> Mapped, Clipped
clean_3 = CleanTree(RemoveNulls=True, RemoveInvalid=True, RemoveEmpty=False)
