# Grasshopper definition 20160603_砖墙_tim.gh (Grasshopper 0.9.76)

briklength = Panel("240")
md_slider = MDSlider(
    slider_value=Point(0.4999920293, 0.5198731306, 0.5),
    SliderMode=0,
    x_domain=Domain(-10000, 10000),
    y_domain=Domain(-10000, 10000),
    z_domain=Domain(0, 1))
seam = Panel("10")
brikwidth = Panel("115")
brikheight = Panel("53")
genes = GenePool(Decimals=6, Maximum=1, Minimum=0, Value=[0.437646, 0.508571, 0.905882, 0.08647])
miniendlap = Panel("15")
minisidelap = Panel("60")
remap = RemapNumbers(Value=Slider(0, range=0..1), Source=Domain(0, 1), Target=Domain(0, 6.283185307))  # -> Mapped, Clipped
prot = RotatePlane(Plane=md_slider, Angle=remap.Mapped)
pln = Plane(prot)
bool = Boolean(Toggle(False))
num = Number(genes)
num_2 = Number(seam)
num_3 = Number(miniendlap)
int = Integer(briklength)
int_2 = Integer(brikwidth)
num_4 = Number(minisidelap)

panel = Panel("""探究编制方法
整理输入反馈
编写基本碰撞
整体局部方案

有疑问及时交流
6/7汇总 """)
planeseam = Panel("9")
panel_2 = Panel("""智能体表达式
定位数据结构
智体标签结构(数据结构)也有可能数据结构和标签结构一块做
关联标签调用(智能体改变后参数能够被调用出来)
先决变量判断(record)
轭距限制值域(调用的意义)
碰撞限制值域""")
int_3 = Integer(brikheight)
int_4 = Integer(planeseam)
genes_2 = GenePool(Decimals=2, Maximum=1, Minimum=0, Value=[0, 1, 1, 0.71, 0.72, 0.61, 0.6, 0.37, 0.36, 0.35])
genes_3 = GenePool(Decimals=2, Maximum=1, Minimum=0, Value=[1, 0.81, 0.41, 0.56, 0.41, 0.45, 0.41, 0.53, 0.47, 0.51])
column = Slider(4, range=0..10)
layer = Slider(10, range=0..10)
eval = Evaluate(F="(y-x)/2", x=num_4, y=int_2)
int_5 = Integer(column)
int_6 = Integer(layer)
num_5 = Number(genes_2)
num_6 = Number(genes_3)
subtraction = Subtraction(A=int_5, B=1)

eval_2 = Evaluate(F="z-(2*y+x)", x=num_2, y=num_3, z=int)
addition = Addition(A=num_2, B=num_3)
series = Series(Start=0, Step=1, Count=int_5)
series_2 = Series(Start=0, Step=1, Count=expr("x-1", int_5))
pshift = ShiftPaths(Data=series, Offset=1)
addition_2 = Addition(A=addition, B=eval_2)
pshift_2 = ShiftPaths(Data=series_2, Offset=1)
dom = ConstructDomain(DomainStart=addition, DomainEnd=addition_2)
item = ListItem(List=num_5, Index=pshift, Wrap=True)
item_2 = ListItem(List=num_6, Index=pshift_2, Wrap=True)
remap_2 = RemapNumbers(Value=item, Source=Domain(0, 1), Target=dom)  # -> Mapped, Clipped
remap_3 = RemapNumbers(Value=item_2, Source=Domain(0, 1), Target=dom)  # -> Mapped, Clipped

series_3 = Series(Start=0, Step=1, Count=int_6)
addition_3 = Addition(A=int_3, B=int_4)
multiplication = Multiplication(A=addition_3, B=series_3)  # -> graft(Result)
genes_4 = GenePool(Decimals=2, Maximum=1, Minimum=0, Value=[0, 0, 0, 0, 0, 0, 0, 0, 0, 0])
genes_5 = GenePool(Decimals=2, Maximum=1, Minimum=0, Value=[0, 0, 0, 0, 0, 0, 0, 0, 0, 0])
pshift_3 = ShiftPaths(Data=multiplication, Offset=2)
weave = Weave(Pattern=[0, 1], Stream0=remap_2.Mapped, Stream1=remap_3.Mapped, NullGaps=False)

# ----
# rotateAngle
series_4 = Series(Start=0, Step=1, Count=expr("x-1", int_5))
series_5 = Series(Start=0, Step=1, Count=int_5)
pshift_4 = ShiftPaths(Data=series_5, Offset=1)
pshift_5 = ShiftPaths(Data=series_4, Offset=1)
item_3 = ListItem(List=genes_5, Index=pshift_4, Wrap=True)
item_4 = ListItem(List=genes_4, Index=pshift_5, Wrap=True)
weave_2 = Weave(Pattern=[0, 1], Stream0=item_3, Stream1=item_4, NullGaps=False)
remap_4 = RemapNumbers(Value=weave_2, Source=Domain(0, 1), Target=Domain(0, 6.283185307))  # -> Mapped, Clipped

distance = Number(weave)
cos = Cosine(Value=remap_4.Mapped)
sin = Sine(Value=remap_4.Mapped)
dis_cos = Multiplication(A=distance, B=cos)
dis_sin = Multiplication(A=distance, B=sin)
merge = Merge(Data1=0, Data2=dis_sin)
merge_2 = Merge(Data1=0, Data2=dis_cos)
ma = MassAddition(Input=merge_2)  # -> Result, PartialResults
ma_2 = MassAddition(Input=merge)  # -> Result, PartialResults

series_6 = Series(Start=0, Step=2, Count=expr("x/2+0.5", int_6))  # -> simplify(graft(Series))
series_7 = Series(Start=1, Step=2, Count=expr("x/2", int_6))  # -> simplify(graft(Series))
pt = PointOriented(BasePlane=PlaneXY(0, 0, 0), UComponent=ma.PartialResults, VComponent=ma_2.PartialResults, WComponent=pshift_3)
stack = StackData(Data=1, Stack=int_6)
branch = TreeBranch(Tree=pt, Path=series_7, MaintainPaths=True)

genes_6 = GenePool(Decimals=2, Maximum=1, Minimum=0, Value=[0.08, 0.07, 0.81, 0, 0, 0, 0, 0, 0, 0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])
genes_7 = GenePool(Decimals=2, Maximum=3, Minimum=-2, Value=[-0.11, -2, 2.23, -2, -2, -2, -2, 1.5, 1.4, 0.5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])
genes_8 = GenePool(Decimals=2, Maximum=2, Minimum=-2, Value=[0.01, -1.23, -0.45, -0.09, 0.64, -2, -2, 0, 0, -0.4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])
genes_9 = GenePool(Decimals=2, Maximum=2, Minimum=-2, Value=[-0.05, 0.18, -1.56, -2, -2, -2, -2, -2, -2, -0.28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])

genes_10 = GenePool(Decimals=2, Maximum=2, Minimum=-2, Value=[-0.63, -0.65, -2, -2, -2, -2, -1.72, -2, 0, 0.32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])
genes_11 = GenePool(Decimals=2, Maximum=3, Minimum=-3, Value=[0.13, 1.13, 1.95, -3, -3, -3, -3, -0.6, 0, 0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])
genes_12 = GenePool(Decimals=2, Maximum=1, Minimum=0, Value=[0, 0.93, 0.71, 0.75, 0.69, 0.5, 0.48, 0.5, 0.5, 0.5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])
genes_13 = GenePool(Decimals=2, Maximum=1, Minimum=0, Value=[0.78, 0.88, 0.91, 0.71, 0.5, 0.5, 0.48, 0.5, 0.5, 0.5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])
genes_14 = GenePool(Decimals=2, Maximum=1, Minimum=0, Value=[0, 0, 0, 0.06, 0, 0.5, 0.48, 0.5, 0.5, 0.5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])
# 1:31:05 轭距是通过plane来调控，将来还要旋转
# 以每一列为一组调整
# 以每一行为一组调整
# 以每一行为一组调整
genes_15 = GenePool(Decimals=2, Maximum=1, Minimum=0, Value=[0.29, 0.67, 0.2, 0.5, 0.5, 0.5, 0.48, 0.57, 0.5, 0.5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])
branch_2 = TreeBranch(Tree=pt, Path=series_6, MaintainPaths=True)
md_slider_2 = MDSlider(
    slider_value=Point(0.4906234741, 0.4250001907, 0.5),
    SliderMode=0,
    x_domain=Domain(-10000, 10000),
    y_domain=Domain(-10000, 10000),
    z_domain=Domain(0, 1))
stack_2 = StackData(Data=remap_4.Mapped, Stack=graft(stack))
clean = CleanTree(RemoveNulls=True, RemoveInvalid=True, RemoveEmpty=True, Tree=branch)
clean_2 = CleanTree(RemoveNulls=True, RemoveInvalid=True, RemoveEmpty=True, Tree=branch_2)
shift = ShiftList(List=clean, Shift=1, Wrap=False)
prot_2 = RotatePlane(Plane=md_slider_2, Angle=stack_2)
shift_2 = ShiftList(List=shift, Shift=-1, Wrap=False)
pshift_6 = ShiftPaths(Data=prot_2, Offset=1)
series_8 = Series(Start=0, Step=2, Count=int_5)
pshift_7 = ShiftPaths(Data=shift_2, Offset=-1)  # -> simplify(Data)
merge_3 = Merge(Data1=clean_2, Data2=pshift_7)

branch_3 = TreeBranch(Tree=pshift_6, Path=series_6, MaintainPaths=True)
branch_4 = TreeBranch(Tree=pshift_6, Path=series_7, MaintainPaths=True)
clean_3 = CleanTree(RemoveNulls=True, RemoveInvalid=True, RemoveEmpty=True, Tree=branch_3)
clean_4 = CleanTree(RemoveNulls=True, RemoveInvalid=True, RemoveEmpty=True, Tree=branch_4)
shift_3 = ShiftList(List=clean_4, Shift=1, Wrap=False)
shift_4 = ShiftList(List=shift_3, Shift=-1, Wrap=False)
pshift_8 = ShiftPaths(Data=shift_4, Offset=-1)  # -> simplify(Data)
merge_4 = Merge(Data1=clean_3, Data2=pshift_8)
item_5 = ListItem(List=merge_4, Index=series_8, Wrap=False)
clean_5 = CleanTree(RemoveNulls=True, RemoveInvalid=True, RemoveEmpty=True, Tree=item_5)

item_6 = ListItem(List=merge_3, Index=series_8, Wrap=False)
# 1:31:05 轭距是通过plane来调控，将来还要旋转
clean_6 = CleanTree(RemoveNulls=True, RemoveInvalid=True, RemoveEmpty=True, Tree=item_6)
points = PointList(Points=flatten(clean_6), Size=Slider(60, range=0..1000))
pl_origin = PlaneOrigin(Base=clean_5, Origin=clean_6)  # -> simplify(graft(Plane))
flip = FlipMatrix(Data=item_6)

# ----
# uLayer
entwine = Entwine(
    Branch00=genes_6,
    Branch01=genes_7,
    Branch02=genes_8,
    Branch03=genes_9,
    Branch04=genes_10,
    Branch05=genes_11,
    Branch06=genes_12,
    Branch07=genes_13,
    Branch08=genes_14,
    Branch09=genes_15,
    FlattenInputs=True)
lng = ListLength(List=clean_6)
tstat = TreeStatistics(Tree=entwine)  # -> Paths, Length, Count
series_9 = Series(Start=0, Step=1, Count=lng)
subtraction_2 = Subtraction(A=int_6, B=tstat.Count)
pshift_9 = ShiftPaths(Data=series_9, Offset=1)
shift_5 = ShiftList(List=tstat.Paths, Shift=subtraction_2, Wrap=False)
split = SplitTree(Data=entwine, Masks=flatten(shift_5))  # -> Positive, Negative
item_7 = ListItem(List=split.Positive, Index=pshift_9, Wrap=True)
clean_7 = CleanTree(RemoveNulls=True, RemoveInvalid=True, RemoveEmpty=True, Tree=item_7)

clean_8 = CleanTree(RemoveNulls=True, RemoveInvalid=True, RemoveEmpty=True, Tree=flip)
number_slider = Slider(0, range=0..100)

remap_5 = RemapNumbers(Value=clean_7, Source=Domain(0, 1), Target=eval_2)  # -> simplify(graft(Mapped)), Clipped
eval_3 = Evaluate(F="-(x*2)-y", x=num_3, y=remap_5.Mapped)
addition_4 = Addition(A=eval_3, B=int)
dom_2 = ConstructDomain(DomainStart=eval_3, DomainEnd=addition_4)

panel_3 = Panel(clean_5)
genes_16 = GenePool(Decimals=1, Maximum=1, Minimum=0, Value=[0.5, 0.5, 0.5, 0.5, 0.5, 0.5, 0.5, 0.5, 0.5, 0.5])
genes_17 = GenePool(Decimals=2, Maximum=1, Minimum=0, Value=[0.5, 0.5, 0.5, 0.5, 0.5, 0.5, 0.5, 0.5, 0.5, 0.5])
genes_18 = GenePool(Decimals=1, Maximum=1, Minimum=0, Value=[0.5, 0.5, 0.5, 0.5, 0.5, 0, 0.5, 0.5, 0.5, 0.5])
genes_19 = GenePool(Decimals=2, Maximum=1, Minimum=0, Value=[0.5, 0.5, 0.5, 0.5, 0.5, 0.5, 0.5, 0.5, 0.5, 0.5])
genes_20 = GenePool(Decimals=2, Maximum=1, Minimum=0, Value=[0.5, 0.5, 0.5, 0.5, 0.5, 0.5, 0.5, 0.5, 0.5, 0.5])
genes_21 = GenePool(Decimals=2, Maximum=1, Minimum=0, Value=[0.5, 0.5, 0.5, 0.5, 0.5, 0.5, 0.5, 0.5, 0.5, 0.5])
genes_22 = GenePool(Decimals=2, Maximum=1, Minimum=0, Value=[0.5, 0.5, 0.5, 0.5, 0.5, 0.5, 0.5, 0.5, 0.5, 0.5])
genes_23 = GenePool(Decimals=2, Maximum=1, Minimum=0, Value=[0.5, 0.5, 0.5, 0.5, 0.5, 0.5, 0.5, 0.5, 0.5, 0.5])
genes_24 = GenePool(Decimals=2, Maximum=1, Minimum=0, Value=[0.5, 0.5, 0.5, 0.5, 0.5, 0.5, 0.5, 0.5, 0.5, 0.5])
genes_25 = GenePool(Decimals=2, Maximum=1, Minimum=0, Value=[0.5, 0.5, 0.5, 0.5, 0.5, 0.5, 0.5, 0.5, 0.5, 0.5])

# ----
# vLayer
entwine_2 = Entwine(
    Branch00=genes_16,
    Branch01=genes_17,
    Branch02=genes_18,
    Branch03=genes_19,
    Branch04=genes_20,
    Branch05=genes_21,
    Branch06=genes_22,
    Branch07=genes_23,
    Branch08=genes_24,
    Branch09=genes_25,
    FlattenInputs=True)
lng_2 = ListLength(List=clean_6)
tstat_2 = TreeStatistics(Tree=entwine_2)  # -> Paths, Length, Count
series_10 = Series(Start=0, Step=1, Count=lng_2)
subtraction_3 = Subtraction(A=int_6, B=tstat_2.Count)
pshift_10 = ShiftPaths(Data=series_10, Offset=1)
shift_6 = ShiftList(List=tstat_2.Paths, Shift=subtraction_3, Wrap=False)
split_2 = SplitTree(Data=entwine_2, Masks=flatten(shift_6))  # -> Positive, Negative
item_8 = ListItem(List=split_2.Positive, Index=pshift_10, Wrap=True)
clean_9 = CleanTree(RemoveNulls=True, RemoveInvalid=True, RemoveEmpty=True, Tree=item_8)

neg = Negative(Value=eval)
dom_3 = ConstructDomain(DomainStart=neg, DomainEnd=eval)
remap_6 = RemapNumbers(Value=clean_9, Source=Domain(0, 1), Target=dom_3)  # -> simplify(graft(Mapped)), Clipped
eval_4 = Evaluate(F="x/2+y", x=int_2, y=remap_6.Mapped)
neg_2 = Negative(Value=eval_4)
addition_5 = Addition(A=neg_2, B=int_2)
dom_4 = ConstructDomain(DomainStart=neg_2, DomainEnd=addition_5)

panel_4 = Panel(clean_9)

multiplication_2 = Multiplication(A=int_5, B=2)
subtraction_4 = Subtraction(A=multiplication_2, B=1)

# ----
# labelCalculation
genes_26 = GenePool(Decimals=0, Maximum=15, Minimum=0, Value=[0, 5])
int_7 = Integer(genes_26)
split_3 = SplitList(List=int_7, Index=1)  # -> ListA, ListB
mod = Modulus(A=split_3.ListA, B=2)
panel_5 = Panel("""i=0,2,4,6,8
(i/2)*(column*2-1)+k
i=1,3,5
((i-1)/2)*(column*2-1)+column+k""")
equals = Equality(FirstNumber=mod, SecondNumber=0)  # -> Equality, Inequality
gate = StreamGate(Stream=split_3.ListA, Gate=equals.Equality)  # -> Target0, Target1
subtraction_5 = Subtraction(A=gate.Target0, B=1)
division = Division(A=gate.Target1, B=2)
division_2 = Division(A=subtraction_5, B=2)
multiplication_3 = Multiplication(A=subtraction_4, B=division)
multiplication_4 = Multiplication(A=subtraction_4, B=division_2)
addition_6 = Addition(A=int_5, B=multiplication_4)
addition_7 = Addition(A=addition_6, B=split_3.ListB)
addition_8 = Addition(A=split_3.ListB, B=multiplication_3)
filter = StreamFilter(Gate=equals.Equality, Stream0=addition_7, Stream1=addition_8)

int_8 = Integer(filter)

addition_9 = Addition(A=subtraction, B=column)
pln_2 = Plane(pl_origin)
multiplication_5 = Multiplication(A=addition_9, B=2)
lng_3 = ListLength(List=flatten(pln_2))
series_11 = Series(Start=addition_9, Step=multiplication_5, Count=2)
stack_3 = StackData(Data=0, Stack=lng_3)
replace = ReplaceItems(List=stack_3, Item=1, Indices=int_8, Wrap=False)
sift = SiftPattern(List=pln_2, SiftPattern=simplify(graft(replace)))  # -> Output0, Output1

panel_6 = Panel(sift.Output0)

rectangle = Rectangle(Plane=sift.Output0, XSize=dom_2, YSize=dom_4, Radius=0)  # -> Rectangle, Length
Z = UnitZ(Factor=int_3)
extr = Extrude(Base=rectangle.Rectangle, Direction=Z)

number_slider_2 = Slider(0, range=0..1)  # disabled
toggle = BooleanToggle(False)  # disabled
briklength_2 = Panel("240")  # disabled
md_slider_3 = MDSlider(
    slider_value=Point(0.4999920293, 0.5198731306, 0.5),
    SliderMode=0,
    x_domain=Domain(-10000, 10000),
    y_domain=Domain(-10000, 10000),
    z_domain=Domain(0, 1))  # disabled
seam_2 = Panel("10")  # disabled
brikwidth_2 = Panel("115")  # disabled
brikheight_2 = Panel("53")  # disabled
genes_27 = GenePool(Decimals=6, Maximum=1, Minimum=0, Value=[0.437646, 0.508571, 0.905882, 0.08647])  # disabled
miniendlap_2 = Panel("15")  # disabled
minisidelap_2 = Panel("60")  # disabled
remap_7 = RemapNumbers(Value=number_slider_2, Source=Domain(0, 1), Target=Domain(0, 6.283185307))  # -> Mapped, Clipped; disabled
prot_3 = RotatePlane(Plane=md_slider_3, Angle=remap_7.Mapped)  # disabled
pln_3 = Plane(prot_3)  # disabled
bool_2 = Boolean(toggle)  # disabled
num_7 = Number(genes_27)  # disabled
num_8 = Number(seam_2)  # disabled
num_9 = Number(miniendlap_2)  # disabled
int_9 = Integer(briklength_2)  # disabled
int_10 = Integer(brikwidth_2)  # disabled
num_10 = Number(minisidelap_2)  # disabled

panel_7 = Panel("""探究编制方法
整理输入反馈
编写基本碰撞
整体局部方案

有疑问及时交流
6/7汇总 """)  # disabled
planeseam_2 = Panel("9")  # disabled
panel_8 = Panel("""智能体表达式
定位数据结构
智体标签结构(数据结构)也有可能数据结构和标签结构一块做
关联标签调用(智能体改变后参数能够被调用出来)
先决变量判断(record)
轭距限制值域(调用的意义)
碰撞限制值域""")  # disabled
int_11 = Integer(brikheight_2)  # disabled
int_12 = Integer(planeseam_2)  # disabled
genes_28 = GenePool(Decimals=2, Maximum=1, Minimum=0, Value=[0, 1, 1, 0.71, 0.72, 0.61, 0.6, 0.37, 0.36, 0.35])  # disabled
genes_29 = GenePool(Decimals=2, Maximum=1, Minimum=0, Value=[1, 0.81, 0.41, 0.56, 0.41, 0.45, 0.41, 0.53, 0.47, 0.51])  # disabled
column_2 = Slider(4, range=0..10)  # disabled
layer_2 = Slider(10, range=0..10)  # disabled
eval_5 = Evaluate(F="(y-x)/2", x=num_10, y=int_10)  # disabled
int_13 = Integer(column_2)  # disabled
int_14 = Integer(layer_2)  # disabled
num_11 = Number(genes_28)  # disabled
num_12 = Number(genes_29)  # disabled
subtraction_6 = Subtraction(A=int_13, B=1)  # disabled

eval_6 = Evaluate(F="z-(2*y+x)", x=num_8, y=num_9, z=int_9)  # disabled
series_12 = Series(Start=0, Step=1, Count=int_13)  # disabled
addition_10 = Addition(A=num_8, B=num_9)  # disabled
series_13 = Series(Start=0, Step=1, Count=expr("x-1", int_13))  # disabled
pshift_11 = ShiftPaths(Data=series_12, Offset=1)  # disabled
addition_11 = Addition(A=addition_10, B=eval_6)  # disabled
pshift_12 = ShiftPaths(Data=series_13, Offset=1)  # disabled
dom_5 = ConstructDomain(DomainStart=addition_10, DomainEnd=addition_11)  # disabled
item_9 = ListItem(List=num_11, Index=pshift_11, Wrap=True)  # disabled
item_10 = ListItem(List=num_12, Index=pshift_12, Wrap=True)  # disabled
remap_8 = RemapNumbers(Value=item_9, Source=Domain(0, 1), Target=dom_5)  # -> Mapped, Clipped; disabled
remap_9 = RemapNumbers(Value=item_10, Source=Domain(0, 1), Target=dom_5)  # -> Mapped, Clipped; disabled

series_14 = Series(Start=0, Step=1, Count=int_14)  # disabled
addition_12 = Addition(A=int_11, B=int_12)  # disabled
multiplication_6 = Multiplication(A=addition_12, B=series_14)  # -> graft(Result); disabled
genes_30 = GenePool(Decimals=2, Maximum=1, Minimum=0, Value=[0, 0, 0, 0, 0, 0, 0, 0, 0, 0])  # disabled
genes_31 = GenePool(Decimals=2, Maximum=1, Minimum=0, Value=[0, 0, 0, 0, 0, 0, 0, 0, 0, 0])  # disabled
pshift_13 = ShiftPaths(Data=multiplication_6, Offset=2)  # disabled
weave_3 = Weave(Pattern=[0, 1], Stream0=remap_8.Mapped, Stream1=remap_9.Mapped, NullGaps=False)  # disabled

# ----
# rotateAngle
series_15 = Series(Start=0, Step=1, Count=expr("x-1", int_13))  # disabled
series_16 = Series(Start=0, Step=1, Count=int_13)  # disabled
pshift_14 = ShiftPaths(Data=series_16, Offset=1)  # disabled
pshift_15 = ShiftPaths(Data=series_15, Offset=1)  # disabled
item_11 = ListItem(List=genes_31, Index=pshift_14, Wrap=True)  # disabled
item_12 = ListItem(List=genes_30, Index=pshift_15, Wrap=True)  # disabled
weave_4 = Weave(Pattern=[0, 1], Stream0=item_11, Stream1=item_12, NullGaps=False)  # disabled
remap_10 = RemapNumbers(Value=weave_4, Source=Domain(0, 1), Target=Domain(0, 6.283185307))  # -> Mapped, Clipped; disabled

distance_2 = Number(weave_3)  # disabled
cos_2 = Cosine(Value=remap_10.Mapped)  # disabled
sin_2 = Sine(Value=remap_10.Mapped)  # disabled
dis_cos_2 = Multiplication(A=distance_2, B=cos_2)  # disabled
dis_sin_2 = Multiplication(A=distance_2, B=sin_2)  # disabled
merge_5 = Merge(Data1=0, Data2=dis_sin_2)  # disabled
merge_6 = Merge(Data1=0, Data2=dis_cos_2)  # disabled
ma_3 = MassAddition(Input=merge_6)  # -> Result, PartialResults; disabled
ma_4 = MassAddition(Input=merge_5)  # -> Result, PartialResults; disabled

series_17 = Series(Start=0, Step=2, Count=expr("x/2+0.5", int_14))  # -> simplify(graft(Series)); disabled
series_18 = Series(Start=1, Step=2, Count=expr("x/2", int_14))  # -> simplify(graft(Series)); disabled
pt_2 = PointOriented(BasePlane=PlaneXY(0, 0, 0), UComponent=ma_3.PartialResults, VComponent=ma_4.PartialResults, WComponent=pshift_13)  # disabled
stack_4 = StackData(Data=1, Stack=int_14)  # disabled
branch_5 = TreeBranch(Tree=pt_2, Path=series_18, MaintainPaths=True)  # disabled

genes_32 = GenePool(Decimals=2, Maximum=2, Minimum=-2, Value=[0.14, -1.36, -0.5, -0.09, 0.64, -2, -2, 0, 0, -0.4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])  # disabled
genes_33 = GenePool(Decimals=2, Maximum=1, Minimum=0, Value=[0.02, 0.01, 0.79, 0, 0, 0, 0, 0, 0, 0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])  # disabled
genes_34 = GenePool(Decimals=2, Maximum=3, Minimum=-2, Value=[-0.11, -2, 2.23, -2, -2, -2, -2, 1.5, 1.4, 0.5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])  # disabled
genes_35 = GenePool(Decimals=2, Maximum=2, Minimum=-2, Value=[0.62, -0.55, -2, -2, -2, -2, -2, -2, -2, -0.28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])  # disabled

genes_36 = GenePool(Decimals=2, Maximum=2, Minimum=-2, Value=[0.13, -1.35, -2, -2, -2, -2, -1.72, -2, 0, 0.32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])  # disabled
genes_37 = GenePool(Decimals=2, Maximum=3, Minimum=-3, Value=[0.63, -0.53, 0.27, -3, -3, -3, -3, -0.6, 0, 0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])  # disabled
genes_38 = GenePool(Decimals=2, Maximum=3, Minimum=-3, Value=[-0.5, -0.63, -0.19, 0.13, 1.14, 0, -0.12, 0, 0, 0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])  # disabled
genes_39 = GenePool(Decimals=2, Maximum=3, Minimum=-3, Value=[0.16, 1.14, 1, 1.26, 0, 0, -0.12, 0, 0, 0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])  # disabled
genes_40 = GenePool(Decimals=2, Maximum=1, Minimum=0, Value=[0, 0, 0, 0.06, 0, 0.5, 0.48, 0.5, 0.5, 0.5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])  # disabled
genes_41 = GenePool(Decimals=2, Maximum=1, Minimum=0, Value=[0.29, 0.67, 0.2, 0.5, 0.5, 0.5, 0.48, 0.57, 0.5, 0.5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])  # disabled
branch_6 = TreeBranch(Tree=pt_2, Path=series_17, MaintainPaths=True)  # disabled
md_slider_4 = MDSlider(
    slider_value=Point(0.453125, 0.4375, 0.5),
    SliderMode=0,
    x_domain=Domain(-10000, 10000),
    y_domain=Domain(-10000, 10000),
    z_domain=Domain(0, 1))  # disabled
stack_5 = StackData(Data=remap_10.Mapped, Stack=graft(stack_4))  # disabled
clean_10 = CleanTree(RemoveNulls=True, RemoveInvalid=True, RemoveEmpty=True, Tree=branch_5)  # disabled
clean_11 = CleanTree(RemoveNulls=True, RemoveInvalid=True, RemoveEmpty=True, Tree=branch_6)  # disabled
shift_7 = ShiftList(List=clean_10, Shift=1, Wrap=False)  # disabled
prot_4 = RotatePlane(Plane=md_slider_4, Angle=stack_5)  # disabled
shift_8 = ShiftList(List=shift_7, Shift=-1, Wrap=False)  # disabled
pshift_16 = ShiftPaths(Data=prot_4, Offset=1)  # disabled
series_19 = Series(Start=0, Step=2, Count=int_13)  # disabled
pshift_17 = ShiftPaths(Data=shift_8, Offset=-1)  # -> simplify(Data); disabled
merge_7 = Merge(Data1=clean_11, Data2=pshift_17)  # disabled

branch_7 = TreeBranch(Tree=pshift_16, Path=series_17, MaintainPaths=True)  # disabled
branch_8 = TreeBranch(Tree=pshift_16, Path=series_18, MaintainPaths=True)  # disabled
clean_12 = CleanTree(RemoveNulls=True, RemoveInvalid=True, RemoveEmpty=True, Tree=branch_7)  # disabled
clean_13 = CleanTree(RemoveNulls=True, RemoveInvalid=True, RemoveEmpty=True, Tree=branch_8)  # disabled
shift_9 = ShiftList(List=clean_13, Shift=1, Wrap=False)  # disabled
shift_10 = ShiftList(List=shift_9, Shift=-1, Wrap=False)  # disabled
pshift_18 = ShiftPaths(Data=shift_10, Offset=-1)  # -> simplify(Data); disabled
merge_8 = Merge(Data1=clean_12, Data2=pshift_18)  # disabled
item_13 = ListItem(List=merge_8, Index=series_19, Wrap=False)  # disabled
clean_14 = CleanTree(RemoveNulls=True, RemoveInvalid=True, RemoveEmpty=True, Tree=item_13)  # disabled

item_14 = ListItem(List=merge_7, Index=series_19, Wrap=False)  # disabled
number_slider_3 = Slider(60, range=0..1000)  # disabled
# 1:31:05 轭距是通过plane来调控，将来还要旋转
clean_15 = CleanTree(RemoveNulls=True, RemoveInvalid=True, RemoveEmpty=True, Tree=item_14)  # disabled
points_2 = PointList(Points=flatten(clean_15), Size=number_slider_3)  # disabled
pl_origin_2 = PlaneOrigin(Base=clean_14, Origin=clean_15)  # -> simplify(graft(Plane)); disabled
flip_2 = FlipMatrix(Data=item_14)  # disabled

# ----
# uLayer
entwine_3 = Entwine(
    Branch00=genes_33,
    Branch01=genes_34,
    Branch02=genes_32,
    Branch03=genes_35,
    Branch04=genes_36,
    Branch05=genes_37,
    Branch06=genes_38,
    Branch07=genes_39,
    Branch08=genes_40,
    Branch09=genes_41,
    FlattenInputs=True)  # disabled
lng_4 = ListLength(List=clean_15)  # disabled
tstat_3 = TreeStatistics(Tree=entwine_3)  # -> Paths, Length, Count; disabled
series_20 = Series(Start=0, Step=1, Count=lng_4)  # disabled
subtraction_7 = Subtraction(A=int_14, B=tstat_3.Count)  # disabled
pshift_19 = ShiftPaths(Data=series_20, Offset=1)  # disabled
shift_11 = ShiftList(List=tstat_3.Paths, Shift=subtraction_7, Wrap=False)  # disabled
split_4 = SplitTree(Data=entwine_3, Masks=flatten(shift_11))  # -> Positive, Negative; disabled
item_15 = ListItem(List=split_4.Positive, Index=pshift_19, Wrap=True)  # disabled
clean_16 = CleanTree(RemoveNulls=True, RemoveInvalid=True, RemoveEmpty=True, Tree=item_15)  # disabled

clean_17 = CleanTree(RemoveNulls=True, RemoveInvalid=True, RemoveEmpty=True, Tree=flip_2)  # disabled
number_slider_4 = Slider(0, range=0..100)  # disabled

remap_11 = RemapNumbers(Value=clean_16, Source=Domain(0, 1), Target=eval_6)  # -> simplify(graft(Mapped)), Clipped; disabled
eval_7 = Evaluate(F="-(x*2)-y", x=num_9, y=remap_11.Mapped)  # disabled
addition_13 = Addition(A=eval_7, B=int_9)  # disabled
dom_6 = ConstructDomain(DomainStart=eval_7, DomainEnd=addition_13)  # disabled

panel_9 = Panel(clean_14)  # disabled
genes_42 = GenePool(Decimals=1, Maximum=1, Minimum=0, Value=[0.5, 0.5, 0.5, 0.5, 0.5, 0.5, 0.5, 0.5, 0.5, 0.5])  # disabled
genes_43 = GenePool(Decimals=2, Maximum=1, Minimum=0, Value=[0.5, 0.5, 0.5, 0.5, 0.5, 0.5, 0.5, 0.5, 0.5, 0.5])  # disabled
genes_44 = GenePool(Decimals=1, Maximum=1, Minimum=0, Value=[0.5, 0.5, 0.5, 0.5, 0.5, 0, 0.5, 0.5, 0.5, 0.5])  # disabled
genes_45 = GenePool(Decimals=2, Maximum=1, Minimum=0, Value=[0.5, 0.5, 0.5, 0.5, 0.5, 0.5, 0.5, 0.5, 0.5, 0.5])  # disabled
genes_46 = GenePool(Decimals=2, Maximum=1, Minimum=0, Value=[0.5, 0.5, 0.5, 0.5, 0.5, 0.5, 0.5, 0.5, 0.5, 0.5])  # disabled
genes_47 = GenePool(Decimals=2, Maximum=1, Minimum=0, Value=[0.5, 0.5, 0.5, 0.5, 0.5, 0.5, 0.5, 0.5, 0.5, 0.5])  # disabled
genes_48 = GenePool(Decimals=2, Maximum=1, Minimum=0, Value=[0.5, 0.5, 0.5, 0.5, 0.5, 0.5, 0.5, 0.5, 0.5, 0.5])  # disabled
genes_49 = GenePool(Decimals=2, Maximum=1, Minimum=0, Value=[0.5, 0.5, 0.5, 0.5, 0.5, 0.5, 0.5, 0.5, 0.5, 0.5])  # disabled
genes_50 = GenePool(Decimals=2, Maximum=1, Minimum=0, Value=[0.5, 0.5, 0.5, 0.5, 0.5, 0.5, 0.5, 0.5, 0.5, 0.5])  # disabled
genes_51 = GenePool(Decimals=2, Maximum=1, Minimum=0, Value=[0.5, 0.5, 0.5, 0.5, 0.5, 0.5, 0.5, 0.5, 0.5, 0.5])  # disabled

# ----
# vLayer
entwine_4 = Entwine(
    Branch00=genes_42,
    Branch01=genes_43,
    Branch02=genes_44,
    Branch03=genes_45,
    Branch04=genes_46,
    Branch05=genes_47,
    Branch06=genes_48,
    Branch07=genes_49,
    Branch08=genes_50,
    Branch09=genes_51,
    FlattenInputs=True)  # disabled
lng_5 = ListLength(List=clean_15)  # disabled
tstat_4 = TreeStatistics(Tree=entwine_4)  # -> Paths, Length, Count; disabled
series_21 = Series(Start=0, Step=1, Count=lng_5)  # disabled
subtraction_8 = Subtraction(A=int_14, B=tstat_4.Count)  # disabled
pshift_20 = ShiftPaths(Data=series_21, Offset=1)  # disabled
shift_12 = ShiftList(List=tstat_4.Paths, Shift=subtraction_8, Wrap=False)  # disabled
split_5 = SplitTree(Data=entwine_4, Masks=flatten(shift_12))  # -> Positive, Negative; disabled
item_16 = ListItem(List=split_5.Positive, Index=pshift_20, Wrap=True)  # disabled
clean_18 = CleanTree(RemoveNulls=True, RemoveInvalid=True, RemoveEmpty=True, Tree=item_16)  # disabled

neg_3 = Negative(Value=eval_5)  # disabled
dom_7 = ConstructDomain(DomainStart=neg_3, DomainEnd=eval_5)  # disabled
remap_12 = RemapNumbers(Value=clean_18, Source=Domain(0, 1), Target=dom_7)  # -> simplify(graft(Mapped)), Clipped; disabled
eval_8 = Evaluate(F="x/2+y", x=int_10, y=remap_12.Mapped)  # disabled
neg_4 = Negative(Value=eval_8)  # disabled
addition_14 = Addition(A=neg_4, B=int_10)  # disabled
dom_8 = ConstructDomain(DomainStart=neg_4, DomainEnd=addition_14)  # disabled

panel_10 = Panel(clean_18)  # disabled

multiplication_7 = Multiplication(A=int_13, B=2)  # disabled
subtraction_9 = Subtraction(A=multiplication_7, B=1)  # disabled

# ----
# labelCalculation
genes_52 = GenePool(Decimals=0, Maximum=15, Minimum=0, Value=[0, 5])  # disabled
int_15 = Integer(genes_52)  # disabled
split_6 = SplitList(List=int_15, Index=1)  # -> ListA, ListB; disabled
mod_2 = Modulus(A=split_6.ListA, B=2)  # disabled
panel_11 = Panel("""i=0,2,4,6,8
(i/2)*(column*2-1)+k
i=1,3,5
((i-1)/2)*(column*2-1)+column+k""")  # disabled
equals_2 = Equality(FirstNumber=mod_2, SecondNumber=0)  # -> Equality, Inequality; disabled
gate_2 = StreamGate(Stream=split_6.ListA, Gate=equals_2.Equality)  # -> Target0, Target1; disabled
subtraction_10 = Subtraction(A=gate_2.Target0, B=1)  # disabled
division_3 = Division(A=gate_2.Target1, B=2)  # disabled
division_4 = Division(A=subtraction_10, B=2)  # disabled
multiplication_8 = Multiplication(A=subtraction_9, B=division_3)  # disabled
multiplication_9 = Multiplication(A=subtraction_9, B=division_4)  # disabled
addition_15 = Addition(A=int_13, B=multiplication_9)  # disabled
addition_16 = Addition(A=addition_15, B=split_6.ListB)  # disabled
addition_17 = Addition(A=split_6.ListB, B=multiplication_8)  # disabled
filter_2 = StreamFilter(Gate=equals_2.Equality, Stream0=addition_16, Stream1=addition_17)  # disabled

int_16 = Integer(filter_2)  # disabled

addition_18 = Addition(A=subtraction_6, B=column_2)  # disabled
pln_4 = Plane(pl_origin_2)  # disabled
multiplication_10 = Multiplication(A=addition_18, B=2)  # disabled
lng_6 = ListLength(List=flatten(pln_4))  # disabled
series_22 = Series(Start=addition_18, Step=multiplication_10, Count=2)  # disabled
stack_6 = StackData(Data=0, Stack=lng_6)  # disabled
replace_2 = ReplaceItems(List=stack_6, Item=1, Indices=int_16, Wrap=False)  # disabled
sift_2 = SiftPattern(List=pln_4, SiftPattern=simplify(graft(replace_2)))  # -> Output0, Output1; disabled

panel_12 = Panel(sift_2.Output0)  # disabled

rectangle_2 = Rectangle(Plane=sift_2.Output0, XSize=dom_6, YSize=dom_8, Radius=0)  # -> Rectangle, Length; disabled
Z_2 = UnitZ(Factor=int_11)  # disabled
extr_2 = Extrude(Base=rectangle_2.Rectangle, Direction=Z_2)  # disabled
