# Grasshopper definition 20160607_stone_砖墙.gh (Grasshopper 0.9.76)

md_slider = MDSlider(slider_value=Point(0, 0, 0.5), SliderMode=0, x_domain=Domain(0, 10000), y_domain=Domain(0, 10000), z_domain=Domain(0, 1))

conjugatedistance = Number(Slider(0.702, range=0..1))
conjugategradient = Number(Slider(0.014938, range=0..0.1))
stretchernumber = Integer(Slider(12, range=1..50))
angleconstraint = Number("0.5*pi")
basicdirection = Number(Slider(0, range=0..1))
brikthickness = Integer("53")
brickrotation = Number(Slider(0.11, range=0..1))
stretchershift = Number(Slider(0, range=0..1))
layernumber = Integer(Slider(16, range=1..40))
shiftgradient = Number(Slider(0.082, range=0..0.1))
minisidelap = Number("60")
sidegradient = Number(Slider(0.674, range=0..1))
miniendlap = Number("15")
planeseam = Integer("9")
briklength = Integer("240")
basicpoint = Point(md_slider)
brikwidth = Integer("115")
sideseam = Number("10")
sideshift = Number(Slider(0.518, range=0..1))

weave = Weave(Pattern=[0, 1], NullGaps=False)

num = Number(Slider(0.49, range=0..1))
num_2 = Number(Slider(0.442, range=0..1))
addition = Addition(A=num_2, B=num)
subtraction = Subtraction(A=1, B=addition)

num_3 = Number(miniendlap)
int = Integer(planeseam)
int_2 = Integer(brikthickness)
num_4 = Number(basicdirection)
num_5 = Number(brickrotation)
int_3 = Integer(stretchernumber)
int_4 = Integer(stretchernumber)
num_6 = Number(sideseam)
int_5 = Integer(briklength)
int_6 = Integer(layernumber)
num_7 = Number(conjugatedistance)
num_8 = Number(conjugategradient)
eval = Evaluate(F="(x-1)*2", x=int_4)
remap = RemapNumbers(Value=num_5, Source=Domain(0, 1), Target=angleconstraint)  # -> Mapped, Clipped
addition_2 = Addition(A=num_6, B=num_3)
eval_2 = Evaluate(F="z-(2*y+x)", x=num_6, y=num_3, z=int_5)
remap_2 = RemapNumbers(Value=num_4, Source=Domain(0, 1), Target=Domain(0, 6.283185307))  # -> Mapped, Clipped
addition_3 = Addition(A=addition_2, B=eval_2)
series = Series(Start=num_7, Step=num_8, Count=eval)
series_2 = Series(Start=remap_2.Mapped, Step=remap.Mapped, Count=expr("2*x-1", int_3))
dom = ConstructDomain(DomainStart=addition_2, DomainEnd=addition_3)
pshift = ShiftPaths(Data=series, Offset=1)
prot = RotatePlane(Plane=basicpoint, Angle=remap_2.Mapped)
stack = StackData(Data=dom, Stack=eval)
series_3 = Series(Start=0, Step=1, Count=int_6)
remap_3 = RemapNumbers(Value=pshift, Source=Domain(0, 1), Target=stack)  # -> Mapped, Clipped
deplane = DeconstructPlane(Plane=prot)  # -> Origin, XAxis, YAxis, ZAxis
merge = Merge(Data1=0, Data2=remap_3.Mapped)
mod = Modulus(A=series_3, B=2)
series_4 = Series(Start=0, Step=2, Count=int_4)
eval_3 = Evaluate(F="2*(y-x)-1", x=mod, y=int_4)
shift = ShiftList(List=merge, Shift=-1, Wrap=False)
pshift_2 = ShiftPaths(Data=series_4, Offset=1)
merge_2 = Merge(Data1=0, Data2=remap_3.Mapped)
pshift_3 = ShiftPaths(Data=shift, Offset=-1)
series_5 = Series(Start=mod, Step=1, Count=eval_3)
pshift_4 = ShiftPaths(Data=series_5, Offset=2)
addition_4 = Addition(A=int, B=int_2)
item = ListItem(List=merge_2, Index=series_5, Wrap=False)
series_6 = Series(Start=0, Step=addition_4, Count=int_6)  # -> graft(Series)
pshift_5 = ShiftPaths(Data=series_6, Offset=2)
conjugatedomain = Number(eval_2)

multiplication = Multiplication(A=int_3, B=2)
subtraction_2 = Subtraction(A=multiplication, B=1)

multiplication_2 = Multiplication(A=subtraction_2, B=num_2)
multiplication_3 = Multiplication(A=subtraction_2, B=num)
multiplication_4 = Multiplication(A=subtraction_2, B=subtraction)
int_7 = Integer(multiplication_2)
int_8 = Integer(multiplication_4)
int_9 = Integer(multiplication_3)
num_9 = Number(remap.Mapped)
series_7 = Series(Start=0, Step=0, Count=int_7)
item_2 = ListItem(List=series_7, Index=-1, Wrap=True)
series_8 = Series(Start=item_2, Step=num_9, Count=int_9)
item_3 = ListItem(List=series_8, Index=-1, Wrap=True)
series_9 = Series(Start=item_3, Step=0, Count=int_8)
merge_3 = Merge(Data1=series_7, Data2=series_8, Data3=series_9)  # -> flatten(Result)

panel = Panel(merge_3)
division = Division(A=int_6, B=2)

int_10 = Integer(division)
panel_2 = Panel(int_10)
num_10 = Number(Slider(0.016, range=0..1))
num_11 = Number(Slider(-0.001, range=-0.001..0.1))
num_12 = Number(Slider(0.55, range=0..1))
num_13 = Number(Slider(-0.001, range=-0.001..0.1))
dom_2 = ConstructDomain(DomainStart=25, DomainEnd=225)
dom_3 = ConstructDomain(DomainStart=25, DomainEnd=225)
series_10 = Series(Start=num_10, Step=num_11, Count=int_10)
series_11 = Series(Start=num_12, Step=num_13, Count=int_10)
pshift_6 = ShiftPaths(Data=series_10, Offset=-1)
pshift_7 = ShiftPaths(Data=series_11, Offset=-1)
remap_4 = RemapNumbers(Value=pshift_6, Source=Domain(0, 1), Target=dom_2)  # -> Mapped, Clipped
remap_5 = RemapNumbers(Value=pshift_7, Source=Domain(0, 1), Target=dom_3)  # -> Mapped, Clipped
weave_2 = Weave(Pattern=[0, 1], Stream0=remap_4.Mapped, Stream1=remap_5.Mapped, NullGaps=False)
num_14 = Number(graft(weave_2))
pt = PointOriented(BasePlane=prot, UComponent=num_14, VComponent=0, WComponent=0)
series_12 = Series(Start=num_14, Step=0, Count=eval_3)
shift_2 = ShiftList(List=item, Shift=1, Wrap=False)
ins = InsertItems(List=shift_2, Item=num_14, Indices=0, Wrap=True)

brikthickness_2 = Integer(brikthickness)
amp = Amplitude(Vector=deplane.ZAxis, Amplitude=brikthickness_2)
thicknessvector = Vector(amp)

pshift_8 = ShiftPaths(Data=merge_3, Offset=0)
prot_2 = RotatePlane(Plane=prot, Angle=pshift_8)
shift_3 = ShiftList(List=pshift_8, Shift=-1, Wrap=False)
pshift_9 = ShiftPaths(Data=shift_3, Offset=-1)
merge_4 = Merge(Data1=0, Data2=pshift_9)
vrot = Rotate(Vector=deplane.XAxis, Axis=deplane.ZAxis, Angle=merge_4)
amp_2 = Amplitude(Vector=vrot, Amplitude=pshift_3)
ma = MassAddition(Input=amp_2)  # -> Result, PartialResults
addition_5 = Addition(A=deplane.Origin, B=ma.PartialResults)
pl_origin = PlaneOrigin(Base=prot_2, Origin=addition_5)
item_4 = ListItem(List=pl_origin, Index=0, Wrap=True)
item_5 = ListItem(List=pl_origin, Index=pshift_4, Wrap=False)
item_6 = ListItem(List=item_5, Index=pshift_2, Wrap=False)
merge_5 = Merge(Data1=item_4, Data2=pl_origin)
pshift_10 = ShiftPaths(Data=ins, Offset=2)
item_7 = ListItem(List=merge_5, Index=pshift_4, Wrap=False)
clean = CleanTree(RemoveNulls=True, RemoveInvalid=True, RemoveEmpty=False, Tree=item_6)

item_8 = ListItem(List=merge, Index=series_5, Wrap=True)
pshift_11 = ShiftPaths(Data=item_8, Offset=2)
shift_4 = ShiftList(List=pshift_11, Shift=1, Wrap=False)
ins_2 = InsertItems(List=shift_4, Item=num_14, Indices=0, Wrap=True)
item_9 = ListItem(List=prot_2, Index=series_5, Wrap=True)
pshift_12 = ShiftPaths(Data=ins_2, Offset=-2)
ma_2 = MassAddition(Input=pshift_12)  # -> Result, PartialResults
amp_3 = Amplitude(Vector=vrot, Amplitude=ma_2.PartialResults)
pl_origin_2 = PlaneOrigin(Base=item_9, Origin=amp_3)

pshift_13 = ShiftPaths(Data=pshift_10, Offset=-2)

pt_2 = PointOriented(BasePlane=pl_origin_2, UComponent=pshift_13, VComponent=0, WComponent=pshift_5)
item_10 = ListItem(List=pt_2, Index=pshift_2, Wrap=False)
clean_2 = CleanTree(RemoveNulls=True, RemoveInvalid=True, RemoveEmpty=False, Tree=item_10)
pl_origin_3 = PlaneOrigin(Base=clean, Origin=clean_2)
placementplane = Plane(pl_origin_3)

conjugatedomain_2 = Number(conjugatedomain)
placementplane_2 = Plane(placementplane)
stretchershift_2 = Number(stretchershift)
shiftgradient_2 = Number(shiftgradient)
miniendlap_2 = Number(miniendlap)
briklength_2 = Integer(briklength)
lng = ListLength(List=placementplane_2)
series_13 = Series(Start=stretchershift_2, Step=shiftgradient_2, Count=lng)
pshift_14 = ShiftPaths(Data=series_13, Offset=-1)
remap_6 = RemapNumbers(Value=pshift_14, Source=Domain(0, 1), Target=conjugatedomain_2)  # -> Mapped, Clipped
eval_4 = Evaluate(F="-1*(x/2+y)", x=miniendlap_2, y=remap_6.Mapped)
addition_6 = Addition(A=eval_4, B=briklength_2)
dom_4 = ConstructDomain(DomainStart=eval_4, DomainEnd=addition_6)
stretcherdomain = Domain(dom_4)

num_15 = Number(Slider(0.324, range=0..1))
num_16 = Number(Slider(0, range=0..1))
addition_7 = Addition(A=num_15, B=num_16)
subtraction_3 = Subtraction(A=1, B=addition_7)
multiplication_5 = Multiplication(A=stretchernumber, B=num_15)
multiplication_6 = Multiplication(A=stretchernumber, B=num_16)
multiplication_7 = Multiplication(A=stretchernumber, B=subtraction_3)
int_11 = Integer(multiplication_5)

placementplane_3 = Plane(placementplane)
minisidelap_2 = Number(minisidelap)
sidegradient_2 = Number(sidegradient)
brikwidth_2 = Integer(brikwidth)
sideshift_2 = Number(sideshift)
lng_2 = ListLength(List=placementplane_3)
series_14 = Series(Start=sideshift_2, Step=sidegradient_2, Count=lng_2)
subtraction_4 = Subtraction(A=brikwidth_2, B=minisidelap_2)

series_15 = Series(Start=sideshift_2, Step=0, Count=int_11)
item_11 = ListItem(List=series_15, Index=-1, Wrap=True)
series_16 = Series(Start=item_11, Step=sidegradient_2, Count=multiplication_6)
item_12 = ListItem(List=series_16, Index=-1, Wrap=True)
series_17 = Series(Start=item_12, Step=0, Count=multiplication_7)
merge_6 = Merge(Data1=series_15, Data2=series_16, Data3=series_17)  # -> flatten(Result)

pshift_15 = ShiftPaths(Data=merge_6, Offset=0)
remap_7 = RemapNumbers(Value=pshift_15, Source=Domain(0, 1), Target=subtraction_4)  # -> Mapped, Clipped
eval_5 = Evaluate(F="-1*(x/2+y)", x=minisidelap_2, y=remap_7.Mapped)
addition_8 = Addition(A=eval_5, B=brikwidth_2)
dom_5 = ConstructDomain(DomainStart=eval_5, DomainEnd=addition_8)
sidedomain = Domain(dom_5)

panel_3 = Panel(minisidelap_2)

placementplane_4 = Plane(placementplane)
stretcherdomain_2 = Domain(stretcherdomain)
thicknessvector_2 = Vector(thicknessvector)
sidedomain_2 = Domain(sidedomain)

rectangle = Rectangle(Plane=placementplane_4, XSize=stretcherdomain_2, YSize=sidedomain_2, Radius=0)  # -> Rectangle, Length
extr = Extrude(Base=rectangle.Rectangle, Direction=thicknessvector_2)  # disabled
cap = CapHoles(Brep=extr)  # disabled

path = ConstructPath(Indices=placementplane_4)
panel_4 = Panel(rectangle.Rectangle)
