# Grasshopper definition 20160616_砖墙尝试.gh (Grasshopper 0.9.76)

md_slider = MDSlider(slider_value=Point(0, 0, 0.5), SliderMode=0, x_domain=Domain(0, 1), y_domain=Domain(0, 1), z_domain=Domain(0, 1))
genes = GenePool(Decimals=2, Maximum=1, Minimum=0, Value=[0.5, 0.5, 0.5, 0.5, 0.5, 0.5, 0.5, 0.4659, 0.5, 0.5])
genes_2 = GenePool(Decimals=2, Maximum=1, Minimum=0, Value=[0.52, 0.47, 0.5, 0.5, 0.5, 0.5, 0.5, 0.51, 0.5, 0.5])
int = Integer(Slider(4, range=0..10))
num = Number("10")
num_2 = Number("15")
int_2 = Integer("240")
num_3 = Number(genes_2)
num_4 = Number(genes)
int_3 = Integer("53")
int_4 = Integer("9")
int_5 = Integer(Slider(0.25, range=0..1))

series = Series(Start=0, Step=1, Count=int)
series_2 = Series(Start=0, Step=1, Count=expr("x-1", int))
pshift = ShiftPaths(Data=series, Offset=-1)
eval = Evaluate(F="z-(2*y+x)", x=num, y=num_2, z=int_2)
addition = Addition(A=num, B=num_2)
pshift_2 = ShiftPaths(Data=series_2, Offset=-1)
addition_2 = Addition(A=addition, B=eval)
item = ListItem(List=num_3, Index=pshift, Wrap=True)
item_2 = ListItem(List=num_4, Index=pshift_2, Wrap=True)
dom = ConstructDomain(DomainStart=addition, DomainEnd=addition_2)
remap = RemapNumbers(Value=item_2, Source=Domain(0, 1), Target=dom)  # -> Mapped, Clipped
remap_2 = RemapNumbers(Value=item, Source=Domain(0, 1), Target=dom)  # -> Mapped, Clipped

panel = Panel(remap_2.Mapped)
int_6 = Integer(Slider(2, range=0..11))
prot = RotatePlane(Plane=md_slider, Angle=int_5)
addition_3 = Addition(A=int_3, B=int_4)
series_3 = Series(Start=0, Step=addition_3, Count=int_6)  # -> graft(Series)
panel_2 = Panel(series_3)
series_4 = Series(Start=0, Step=1, Count=expr("x/2+0.5", int_6))
series_5 = Series(Start=0, Step=1, Count=expr("x/2", int_6))
pshift_3 = ShiftPaths(Data=series_3, Offset=2)
panel_3 = Panel(remap.Mapped)
weave = Weave(Pattern=[0, 1], Stream0=remap_2.Mapped, Stream1=remap.Mapped, NullGaps=False)
merge = Merge(Data2=weave)
ma = MassAddition(Input=merge)  # -> Result, PartialResults
pt = PointOriented(BasePlane=PlaneXY(0, 0, 0), UComponent=ma.PartialResults, VComponent=0, WComponent=pshift_3)
branch = TreeBranch(Tree=pt, Path=series_5, MaintainPaths=True)
branch_2 = TreeBranch(Tree=pt, Path=series_4, MaintainPaths=True)
clean = CleanTree(RemoveNulls=True, RemoveInvalid=True, RemoveEmpty=False, Tree=branch_2)
shift = ShiftList(List=branch, Shift=1, Wrap=True)
shift_2 = ShiftList(List=shift, Shift=1, Wrap=True)
series_6 = Series(Start=0, Step=1, Count=int)
pshift_4 = ShiftPaths(Data=shift_2, Offset=-1)
panel_5 = Panel(pshift_4)
merge_2 = Merge(Data1=clean, Data2=pshift_4)
item_3 = ListItem(List=merge_2, Index=series_6, Wrap=True)
genes_3 = GenePool(Decimals=2, Maximum=100, Minimum=0, Value=[50, 50, 50, 50, 50, 50, 50, 50, 50, 50])
clean_2 = CleanTree(RemoveNulls=True, RemoveInvalid=True, RemoveEmpty=False, Tree=item_3)
lng = ListLength(List=flatten(clean_2))
series_7 = Series(Start=0, Step=1, Count=lng)  # -> graft(Series)
pshift_5 = ShiftPaths(Data=series_7, Offset=-1)
pl_origin = PlaneOrigin(Base=prot, Origin=clean_2)  # -> simplify(graft(Plane))
eval_2 = Evaluate(F="2*(x/2+y)", x=num_2)
item_4 = ListItem(List=genes_3, Index=pshift_5, Wrap=True)
remap_3 = RemapNumbers(Value=item_4, Source=Domain(0, 1), Target=Domain(0, 1))  # -> Mapped, Clipped
