# Grasshopper definition 20160620_课堂作业.gh (Grasshopper 1.0.7)

s = Slider(141841.29, range=100000..200000.001)
w = Slider(805.152, range=700.001..1000.002)
d = Slider(277.711, range=200..300.001)

w_2 = Slider(900.001, range=900.001..1500)
s_2 = Slider(134250.505, range=100000..200000.001)
d_2 = Slider(400, range=400..600.001)

panel = Panel("用面积、长、宽中的任意两组数据建立矩形")
list = ValueList({"One": 1, "Two": 2, "Three": 2² - 1, "Four": Sqrt(16)}, selected="One")
series = Series(Start=0, Step=list, Count="30")
cir = Circle(Plane="0,0,0,", Radius=1)
num = Number(graft([w, d]))
panel_2 = Panel(num)
division = Division(A=s, B=d)
divide = DivideCurve(Curve=cir, Count="30", Kinks=False)  # -> Points, Tangents, Parameters
division_2 = Division(A=s, B=w)
pt = ConstructPoint(XCoordinate=0, YCoordinate=0, ZCoordinate=series)
stack = StackData(Data=[division, "0"], Stack=2)
panel_3 = Panel(stack)
stack_2 = StackData(Data=[d, "0"], Stack=2)
stack_3 = StackData(Data=[division_2, "0"], Stack=2)
panel_4 = Panel(stack_3)
stack_4 = StackData(Data=[w, "0"], Stack=2)
rec = DataRecorder(num, DataLimit=2, RecordData=True)
panel_5 = Panel(rec)
vec2pt = Vector2Pt(PointA="0,0,0,", PointB=divide.Points, Unitize=False)  # -> Vector, Length
shift = ShiftList(List=stack_2, Shift=1, Wrap=True)
panel_6 = Panel(shift)
shift_2 = ShiftList(List=stack_4, Shift=1, Wrap=True)
panel_7 = Panel(shift_2)
line = LineSDL(Start=pt, Direction=vec2pt.Vector, Length=Slider(11.773, range=0..20))
split = SplitList(List=rec, Index=1)  # -> ListA, ListB
panel_8 = Panel(split.ListB)
pline = PolyLine(Vertices=pt, Closed=False)
entwine = Entwine(Branch00=shift_2, Branch01=stack_3, FlattenInputs=True)
subtraction = Subtraction(A=split.ListA, B=split.ListB)
panel_9 = Panel(subtraction)
entwine_2 = Entwine(Branch00=stack, Branch01=shift, FlattenInputs=True)
panel_10 = Panel(entwine)
panel_11 = Panel(entwine_2)
bool = Boolean(flatten(subtraction))
panel_12 = Panel(bool)
list_2 = ValueList({"One": 1, "Two": 2, "Three": 2² - 1, "Four": Sqrt(16)}, selected="One")
pframes = PerpFrames(Curve=line, Count=list_2, Align=True)  # -> Frames, Parameters
mindex = MemberIndex(Set=bool, Member=True)  # -> Index, Count

s_3 = Panel(s_2)
d_3 = Panel(d_2)
w_3 = Panel(w_2)

remap = RemapNumbers(Value=Slider(0, range=0..1), Source=Domain(0, 1), Target=Domain(0, 6.283185307))  # -> Mapped, Clipped
pt_2 = ConstructPoint(XCoordinate=Slider(0.25, range=0..1), YCoordinate=Slider(0.25, range=0..1), ZCoordinate=Slider(0.25, range=0..1))
num_2 = Number(graft([w_2, d_2]))
rec_2 = DataRecorder(graft(num_2), DataLimit=2, RecordData=True)
prot = RotatePlane(Plane=pt_2, Angle=remap.Mapped)
split_2 = SplitList(List=rec_2, Index=1)  # -> ListA, ListB
panel_13 = Panel(rec_2)
subtraction_2 = Subtraction(A=split_2.ListA, B=split_2.ListB)
bool_2 = Boolean(flatten(subtraction_2))
not = GateNot(A=bool_2)
not_2 = GateNot(A=bool_2)
mindex_2 = MemberIndex(Set=not_2, Member=True)  # -> Index, Count
mindex_3 = MemberIndex(Set=not, Member=True)  # -> Index, Count
rec_3 = DataRecorder(mindex_3.Index, DataLimit=1, RecordData=True)
rec_4 = DataRecorder(mindex_2.Index, DataLimit=1, RecordData=True)
filter = StreamFilter(Gate=rec_4, Stream0=w_3, Stream1=d_3)
panel_14 = Panel(filter)
filter_2 = StreamFilter(Gate=rec_3, Stream0=d_3, Stream1=w_3)
division_3 = Division(A=s_3, B=filter_2)
panel_15 = Panel(division_3)
division_4 = Division(A=s_3, B=filter)
panel_16 = Panel(rec_4)
num_3 = Number(reverse([division_3, w_3]))
panel_17 = Panel(num_3)
num_4 = Number(reverse([division_4, w_3]))
item = ListItem(List=num_4, Index=0, Wrap=True)
item_2 = ListItem(List=num_4, Index=1, Wrap=True)
item_3 = ListItem(List=num_3, Index=0, Wrap=True)
item_4 = ListItem(List=num_3, Index=1, Wrap=True)
stack_5 = StackData(Data=[item, "0"], Stack=2)
stack_6 = StackData(Data=[item_2, "0"], Stack=2)
stack_7 = StackData(Data=[item_3, "0"], Stack=2)
stack_8 = StackData(Data=[item_4, "0"], Stack=2)
shift_3 = ShiftList(List=stack_6, Shift=0, Wrap=True)
shift_4 = ShiftList(List=stack_5, Shift=1, Wrap=True)
shift_5 = ShiftList(List=stack_8, Shift=0, Wrap=True)
shift_6 = ShiftList(List=stack_7, Shift=1, Wrap=True)
entwine_3 = Entwine(Branch00=shift_6, Branch01=shift_5, FlattenInputs=True)
entwine_4 = Entwine(Branch00=shift_4, Branch01=shift_3, FlattenInputs=True)
filter_3 = StreamFilter(Gate=rec_4, Stream0=entwine_3, Stream1=entwine_4)
panel_18 = Panel(filter_3)
bang = ExplodeTree(Data=filter_3)  # -> Branch0, Branch1
panel_20 = Panel(bang.Branch1)
pt_3 = PointOriented(BasePlane=prot, UComponent=bang.Branch0, VComponent=bang.Branch1, WComponent=0)

panel_21 = Panel(mindex.Index)
rectangle = Rectangle(Plane=pframes.Frames, XSize=Slider(2, range=0..2), YSize=Slider(8, range=0..8), Radius=0)  # -> Rectangle, Length
rec_5 = DataRecorder(mindex.Index, DataLimit=1, RecordData=True)
panel_22 = Panel(rec_5)
loft = Loft(
    Curves=rectangle.Rectangle,
    Options={Adjust=False, Closed=False, LoftEnds=0, LoftSimp=0, LoftType=0, Rebuild=10, Refit=0.01})
boundary = BoundarySurfaces(Edges=rectangle.Rectangle)
filter_4 = StreamFilter(Gate=rec_5, Stream0=panel_10, Stream1=panel_11)
panel_23 = Panel(filter_4)
join = BrepJoin(Breps=[loft, boundary])  # -> Breps, Closed
remap_2 = RemapNumbers(Value=Slider(0, range=0..1), Source=Domain(0, 1), Target=Domain(0, 6.283185307))  # -> Mapped, Clipped
pt_4 = ConstructPoint(XCoordinate=Slider(0.25, range=0..1), YCoordinate=Slider(0.25, range=0..1), ZCoordinate=Slider(0.25, range=0..1))
bang_2 = ExplodeTree(Data=filter_4)  # -> Branch0, Branch1
prot_2 = RotatePlane(Plane=pt_4, Angle=remap_2.Mapped)
panel_24 = Panel(bang_2.Branch1)
panel_25 = Panel(bang_2.Branch0)
pt_5 = PointOriented(BasePlane=prot_2, UComponent=bang_2.Branch1, VComponent=bang_2.Branch0, WComponent=0)
pline_2 = PolyLine(Vertices=pt_5, Closed=True)
boundary_2 = BoundarySurfaces(Edges=pline_2)
