# Grasshopper definition 20160914_点成面.gh (Grasshopper 1.0.7)

pt = ConstructPoint(XCoordinate=Slider(-1, range=-10..10), YCoordinate=Slider(-10, range=-10..10), ZCoordinate=Slider(7, range=-10..10))
pt_2 = ConstructPoint(XCoordinate=Slider(10, range=0..10), YCoordinate=Slider(0, range=0..10), ZCoordinate=Slider(4, range=0..10))
pt_3 = ConstructPoint(XCoordinate=Slider(0, range=0..10), YCoordinate=Slider(10, range=0..10), ZCoordinate=Slider(8, range=0..10))
pt_4 = ConstructPoint(XCoordinate=Slider(-10, range=-10..10), YCoordinate=Slider(1, range=0..10), ZCoordinate=Slider(8, range=0..10))
merge = Merge(Data1=pt, Data2=pt_2, Data3=pt_3, Data4=pt_4)
pline = PolyLine(Vertices=merge, Closed=Toggle(True))
fpatch = FragmentPatch(Boundary=pline)
intcrv = Interpolate(Vertices=merge, Degree=Slider(3, range=0..10), Periodic=Toggle(True), KnotStyle=Slider(0, range=0..10))  # -> Curve, Length, Domain
number_slider = Slider(0, range=0..10)  # disabled
number_slider_2 = Slider(3, range=0..10)  # disabled
number_slider_3 = Slider(10, range=0..10)  # disabled
crv = Curve(intcrv.Curve)
pipe = Pipe(Curve=crv, Radius=1, Caps=0)
dom = ConstructDomain(DomainStart=number_slider, DomainEnd=number_slider_2)  # disabled
number_slider_4 = Slider(0, range=0..10)  # disabled
range = Range(Domain=dom, Steps=number_slider_3)  # disabled
range_2 = Range(Domain=Slider(1, range=0..10), Steps=number_slider_3)  # disabled
vpipe = PipeVariable(Curve=intcrv.Curve, Parameters=range, Radii=range_2, Caps=number_slider_4)  # disabled
panel = Panel(range_2)  # disabled
