# Grasshopper definition 20160915_楼梯.gh (Grasshopper 0.9.76)

md_slider = MDSlider(
    slider_value=Point(0.7390243949, 0.5536585319, 0.5),
    SliderMode=0,
    x_domain=Domain(0, 1),
    y_domain=Domain(0, 1),
    z_domain=Domain(0, 1))
number_slider = Slider(11, range=0..11)
踏面 = Slider(5.645, range=0..11)
踢面 = Slider(2.714, range=0..11.001)
pt = Point(md_slider)
series = Series(Start=0, Step=踏面, Count=number_slider)
series_2 = Series(Start=0, Step=踢面, Count=number_slider)
Y = UnitY(Factor=series)
Z = UnitZ(Factor=series_2)
Z_2 = UnitZ(Factor=踢面)
move = Move(Geometry=pt, Motion=Y)  # -> Geometry, Transform
move_2 = Move(Geometry=move.Geometry, Motion=Z)  # -> Geometry, Transform
move_3 = Move(Geometry=move_2.Geometry, Motion=Z_2)  # -> Geometry, Transform
multiplication = Multiplication(A=踢面, B=2)
shift = ShiftList(List=move_2.Geometry, Shift=1, Wrap=False)
shift_2 = ShiftList(List=move_3.Geometry, Shift=-1, Wrap=False)
shift_3 = ShiftList(List=move_2.Geometry, Shift=1, Wrap=False)
Z_3 = UnitZ(Factor=1)
neg = Negative(Value=multiplication)
楼梯宽度 = Slider(20, range=0..20)
pt_2 = ConstructPoint(
    XCoordinate=Slider(-1.423, range=-100..100.001),
    YCoordinate=Slider(-56.348, range=-92..32.001),
    ZCoordinate=Slider(24.51, range=0..31))
item = ListItem(List=reverse(move_3.Geometry), Index=0, Wrap=True)
item_2 = ListItem(List=move.Geometry, Index=[0, 1], Wrap=True)
amp = Amplitude(Vector=Z_3, Amplitude=neg)
cluster = Cluster(G=item, T=amp)
item_3 = ListItem(List=reverse(shift_3), Index=0, Wrap=True)
ln = Line(StartPoint=cluster, EndPoint=item_3)
X = UnitX(Factor=楼梯宽度)
Y_2 = UnitY(Factor=Slider(-13.61, range=-20..10.001))
ln_2 = Line(StartPoint=move_2.Geometry, EndPoint=move_3.Geometry)
ln_3 = Line(StartPoint=shift_2, EndPoint=shift)
pline = PolyLine(Vertices=flatten([item_2, item_3, cluster]), Closed=False)
cull_i = CullIndex(List=reverse(ln_2), Indices=0, Wrap=True)
X_2 = UnitX(Factor=楼梯宽度)
shift_4 = ShiftList(List=cull_i, Shift=1, Wrap=True)
boundary = BoundarySurfaces(Edges=flatten([shift_4, pline, ln_3]))
extr = Extrude(Base=boundary, Direction=X)
rotax = RotateAxis(Geometry=extr, Angle=3.141592654, Axis=ln)  # -> Geometry, Transform
move_4 = Move(Geometry=rotax.Geometry, Motion=pt_2)  # -> Geometry, Transform
debrep = DeconstructBrep(Brep=move_4.Geometry)  # -> Faces, Edges, Vertices
item_4 = ListItem(List=debrep.Faces, Index=Slider(1.119, range=0..11), Wrap=True)
extr_2 = Extrude(Base=item_4, Direction=Y_2)
debrep_2 = DeconstructBrep(Brep=extr_2)  # -> Faces, Edges, Vertices
item_5 = ListItem(List=debrep_2.Faces, Index=Slider(0.686, range=0..1), Wrap=True)
extr_3 = Extrude(Base=item_5, Direction=X_2)
楼梯梁 = Slider(-5.857, range=-10..10.001)
楼梯平台长度 = Slider(17.544, range=-30..30.001)
debrep_3 = DeconstructBrep(Brep=extr)  # -> Faces, Edges, Vertices
debrep_4 = DeconstructBrep(Brep=move_4.Geometry)  # -> Faces, Edges, Vertices
item_6 = ListItem(List=debrep_3.Faces, Index=Slider(1.979, range=-10..10.001), Wrap=True)
item_7 = ListItem(List=debrep_4.Faces, Index=Slider(2.277, range=-10..20.001), Wrap=True)
debrep_5 = DeconstructBrep(Brep=extr)  # -> Faces, Edges, Vertices
Z_4 = UnitZ(Factor=楼梯梁)
Z_5 = UnitZ(Factor=楼梯梁)
extr_4 = Extrude(Base=item_6, Direction=Z_5)
item_8 = ListItem(List=debrep_4.Faces, Index=Slider(-3.679, range=-10..11), Wrap=True)
item_9 = ListItem(List=debrep_5.Faces, Index=Slider(0.648, range=-10..10.001), Wrap=True)
extr_5 = Extrude(Base=item_7, Direction=Z_4)
Y_3 = UnitY(Factor=楼梯平台长度)
extr_6 = Extrude(Base=item_8, Direction=Y_3)
Y_4 = UnitY(Factor=楼梯平台长度)
extr_7 = Extrude(Base=item_9, Direction=Y_4)

# ==== cluster Cluster
G = ClusterInput()
T = ClusterInput()
move = Move(Geometry=G, Motion=T)  # -> Geometry, Transform
G_2 = ClusterOutput(move.Geometry)
