# Grasshopper definition 20171218_动线生成2.gh (Grasshopper 0.9.76)

panel = Panel("""确定的元素
下闸道和上闸道是确定的""")
# 货车动线
# 入口进入位置和角度
# 进入可以停车的行驶长度
# 停车位长度种类：
# 	短时间
# 	较长的停车时间（过夜）
# if 进入加油站
# 	长度，角度和方向
# 	加油位置（加油种类）
# 	出口位置，角度
# elif 直接进入出口
# 	出口的角度，长度
# else 进入大车修车区域
# 	修车位置
# 	修理空间，掉头空间
# 加油和修车的出口汇成一条道路
panel_2 = Panel("""停车位
路灯
绿化
和人线的连接
加油站的油泵""")
panel_3 = Panel("""小车动线
大巴动线
货车动线""")
panel_4 = Panel("转弯半径的结合所有的车动线")
panel_5 = Panel("点的控制是大概的，数据本身可以直接自我调节")
panel_6 = Panel("货车的动线尽量简短，减少其较大的噪声对服务区使用人的感受的影响")

高速0 = Point(Point(95751.63501, -302175.4092, 0))
高速1 = Point(Point(311935.6841, -388807.227, 0))
入口角度 = Slider(118, range=-180..180)
入口 = Point(Point(112572.376, -309046.5659, 0))
出口 = Point(Point(267363.694, -374709.387, 0))
大车通行的车道宽度 = Slider(-24467, range=-40000..22001)
出口角度 = Slider(39, range=-180..180)

转弯半径 = Slider(12000, range=0..22000)
pt = Point(Point(97183.55743, -302106.4806, 0))
pt_2 = Point(Point(114113.9538, -311036.7996, 0))
pt_3 = Point(Point(118579.1133, -337455.6599, 0))
pt_4 = Point(Point(234860.7029, -386381.0099, 0))
pt_5 = Point(Point(269004.5734, -370389.5769, 0))
int = Integer(转弯半径)
pt_6 = Point(高速1)
pt_7 = Point(入口)
pt_8 = Point(出口)
ln = Line(StartPoint=高速0, EndPoint=高速1)
crv_cp = CurveClosestPoint(Point=pt_7, Curve=ln)  # -> Point, Parameter, Distance
crv_cp_2 = CurveClosestPoint(Point=pt_8, Curve=ln)  # -> Point, Parameter, Distance
pt_9 = Point(crv_cp_2.Point)
vec2pt = Vector2Pt(PointA=crv_cp.Point, PointB=crv_cp_2.Point, Unitize=False)  # -> Vector, Length
rad = Radians(Degrees=入口角度)
rad_2 = Radians(Degrees=出口角度)
预设值 = Slider(182001, range=-80000..182001)
预设值_2 = Slider(-80000, range=-80000..22001)
vec = Vector(vec2pt.Vector)
xy = XYPlane(Origin=crv_cp.Point)
sin = Sine(Value=rad)
vrot = Rotate(Vector=vec, Axis=xy, Angle=rad)
division = Division(A=大车通行的车道宽度, B=sin)
vrot_2 = Rotate(Vector=vec, Axis=xy, Angle=rad_2)
line = LineSDL(Start=pt_9, Direction=vrot_2, Length=预设值_2)
line_2 = LineSDL(Start=crv_cp.Point, Direction=vrot, Length=division)
end = EndPoints(Curve=line_2)  # -> Start, End
line_3 = LineSDL(Start=end.End, Direction=vec, Length=预设值)
ccx = CurveCurve(CurveA=line_3, CurveB=line)  # -> Points, ParamsA, ParamsB
ln_2 = Line(StartPoint=pt_9, EndPoint=pt_6)
ln_3 = Line(StartPoint=ccx.Points, EndPoint=pt_9)
ln_4 = Line(StartPoint=高速0, EndPoint=end.Start)
ln_5 = Line(StartPoint=end.End, EndPoint=ccx.Points)
普通转弯路径 = 普通转弯路径(路0=ln_4, 路1=line_2, 转弯半径=int)  # -> 路0_3, 转弯路径, 末点
ln_6 = Line(StartPoint=普通转弯路径.末点, EndPoint=end.End)
普通转弯路径_2 = 普通转弯路径_2(路0=ln_6, 路1=ln_5, 转弯半径=int)  # -> 路0_3, 转弯路径, 末点
ln_7 = Line(StartPoint=普通转弯路径_2.末点, EndPoint=ccx.Points)
普通转弯路径_3 = 普通转弯路径_3(路0=ln_7, 路1=ln_3, 转弯半径=int)  # -> 路0_3, 转弯路径, 末点
ln_8 = Line(StartPoint=普通转弯路径_3.末点, EndPoint=pt_9)
普通转弯路径_4 = 普通转弯路径_4(路0=ln_8, 路1=ln_2, 转弯半径=int)  # -> 路0_3, 转弯路径, 末点
ln_9 = Line(StartPoint=普通转弯路径_4.末点, EndPoint=高速1)
短时间停货车路径 = Merge(
    Data1=普通转弯路径.路0_3,
    Data2=普通转弯路径.转弯路径,
    Data3=普通转弯路径_2.路0_3,
    Data4=普通转弯路径_2.转弯路径,
    Data5=普通转弯路径_3.路0_3,
    Data6=普通转弯路径_3.转弯路径,
    Data7=普通转弯路径_4.路0_3,
    Data8=普通转弯路径_4.转弯路径,
    Data9=ln_9)
crv = Curve(短时间停货车路径)

# ==== cluster 普通转弯路径
路0 = ClusterInput()
路1 = ClusterInput()
转弯半径 = ClusterInput()
路0_2 = Curve(路0)
路1_2 = Curve(路1)
angle = Angle(VectorA=路0_2, VectorB=路1_2)  # -> Angle, Reflex
subtraction = Subtraction(A="pi", B=angle.Angle)
ccx = CurveCurve(CurveA=路0_2, CurveB=路1_2)  # -> Points, ParamsA, ParamsB
smaller = SmallerThan(FirstNumber=angle.Angle, SecondNumber=1.570796327)  # -> SmallerThan, OrEqualTo
filter = StreamFilter(Gate=smaller.OrEqualTo, Stream0=angle.Angle, Stream1=subtraction)
division = Division(A=filter, B=2)
tan = Tangent(Value=division)
sin = Sine(Value=division)
division_2 = Division(A=转弯半径, B=tan)
cir = Circle(Plane=ccx.Points, Radius=division_2)
ccx_2 = CurveCurve(CurveA=cir, CurveB=[路0_2, 路1_2])  # -> graft(Points), ParamsA, ParamsB
division_3 = Division(A=转弯半径, B=sin)
pt = Point(flatten(ccx_2.Points))
pline = PolyLine(Vertices=pt, Closed=False)
curvepoint = PointOnCurve(pline, parameter=0.5)
vec2pt = Vector2Pt(PointA=ccx.Points, PointB=curvepoint, Unitize=False)  # -> Vector, Length
bang = ExplodeTree(Data=ccx_2.Points)  # -> _0000, _0010
line = LineSDL(Start=ccx.Points, Direction=vec2pt.Vector, Length=division_3)
end = EndPoints(Curve=line)  # -> Start, End
cir_2 = Circle(Plane=end.End, Radius=转弯半径)
ccx_3 = CurveCurve(CurveA=cir_2, CurveB=line)  # -> Points, ParamsA, ParamsB
arc = Arc3Pt(PointA=bang._0000, PointB=ccx_3.Points, PointC=bang._0010)  # -> Arc, Plane, Radius
crv = Curve(路0_2)
crv_2 = Curve(arc.Arc)
crv_3 = Curve(路1_2)
end_2 = EndPoints(Curve=crv)  # -> Start, End
ccx_4 = CurveCurve(CurveA=crv, CurveB=crv_2)  # -> Points, ParamsA, ParamsB
ccx_5 = CurveCurve(CurveA=crv_2, CurveB=crv_3)  # -> Points, ParamsA, ParamsB
ln = Line(StartPoint=end_2.Start, EndPoint=ccx_4.Points)
pt_2 = Point(ccx_5.Points)
crv_4 = Curve(ln)
转弯路径 = ClusterOutput(crv_2)
末点 = ClusterOutput(pt_2)
路0_3 = ClusterOutput(crv_4)

# ==== cluster 普通转弯路径_2
路0 = ClusterInput()
路1 = ClusterInput()
转弯半径 = ClusterInput()
路0_2 = Curve(路0)
路1_2 = Curve(路1)
angle = Angle(VectorA=路0_2, VectorB=路1_2)  # -> Angle, Reflex
subtraction = Subtraction(A="pi", B=angle.Angle)
ccx = CurveCurve(CurveA=路0_2, CurveB=路1_2)  # -> Points, ParamsA, ParamsB
smaller = SmallerThan(FirstNumber=angle.Angle, SecondNumber=1.570796327)  # -> SmallerThan, OrEqualTo
filter = StreamFilter(Gate=smaller.OrEqualTo, Stream0=angle.Angle, Stream1=subtraction)
division = Division(A=filter, B=2)
tan = Tangent(Value=division)
sin = Sine(Value=division)
division_2 = Division(A=转弯半径, B=tan)
cir = Circle(Plane=ccx.Points, Radius=division_2)
ccx_2 = CurveCurve(CurveA=cir, CurveB=[路0_2, 路1_2])  # -> graft(Points), ParamsA, ParamsB
division_3 = Division(A=转弯半径, B=sin)
pt = Point(flatten(ccx_2.Points))
pline = PolyLine(Vertices=pt, Closed=False)
curvepoint = PointOnCurve(pline, parameter=0.5)
vec2pt = Vector2Pt(PointA=ccx.Points, PointB=curvepoint, Unitize=False)  # -> Vector, Length
bang = ExplodeTree(Data=ccx_2.Points)  # -> _00000000, _00000100
line = LineSDL(Start=ccx.Points, Direction=vec2pt.Vector, Length=division_3)
end = EndPoints(Curve=line)  # -> Start, End
cir_2 = Circle(Plane=end.End, Radius=转弯半径)
ccx_3 = CurveCurve(CurveA=cir_2, CurveB=line)  # -> Points, ParamsA, ParamsB
arc = Arc3Pt(PointA=bang._00000000, PointB=ccx_3.Points, PointC=bang._00000100)  # -> Arc, Plane, Radius
crv = Curve(路0_2)
crv_2 = Curve(arc.Arc)
crv_3 = Curve(路1_2)
end_2 = EndPoints(Curve=crv)  # -> Start, End
ccx_4 = CurveCurve(CurveA=crv, CurveB=crv_2)  # -> Points, ParamsA, ParamsB
ccx_5 = CurveCurve(CurveA=crv_2, CurveB=crv_3)  # -> Points, ParamsA, ParamsB
ln = Line(StartPoint=end_2.Start, EndPoint=ccx_4.Points)
pt_2 = Point(ccx_5.Points)
crv_4 = Curve(ln)
转弯路径 = ClusterOutput(crv_2)
末点 = ClusterOutput(pt_2)
路0_3 = ClusterOutput(crv_4)

# ==== cluster 普通转弯路径_3
路0 = ClusterInput()
路1 = ClusterInput()
转弯半径 = ClusterInput()
路0_2 = Curve(路0)
路1_2 = Curve(路1)
angle = Angle(VectorA=路0_2, VectorB=路1_2)  # -> Angle, Reflex
subtraction = Subtraction(A="pi", B=angle.Angle)
ccx = CurveCurve(CurveA=路0_2, CurveB=路1_2)  # -> Points, ParamsA, ParamsB
smaller = SmallerThan(FirstNumber=angle.Angle, SecondNumber=1.570796327)  # -> SmallerThan, OrEqualTo
filter = StreamFilter(Gate=smaller.OrEqualTo, Stream0=angle.Angle, Stream1=subtraction)
division = Division(A=filter, B=2)
tan = Tangent(Value=division)
sin = Sine(Value=division)
division_2 = Division(A=转弯半径, B=tan)
cir = Circle(Plane=ccx.Points, Radius=division_2)
ccx_2 = CurveCurve(CurveA=cir, CurveB=[路0_2, 路1_2])  # -> graft(Points), ParamsA, ParamsB
division_3 = Division(A=转弯半径, B=sin)
pt = Point(flatten(ccx_2.Points))
pline = PolyLine(Vertices=pt, Closed=False)
curvepoint = PointOnCurve(pline, parameter=0.5)
vec2pt = Vector2Pt(PointA=ccx.Points, PointB=curvepoint, Unitize=False)  # -> Vector, Length
bang = ExplodeTree(Data=ccx_2.Points)  # -> _000000000000, _000000000100
line = LineSDL(Start=ccx.Points, Direction=vec2pt.Vector, Length=division_3)
end = EndPoints(Curve=line)  # -> Start, End
cir_2 = Circle(Plane=end.End, Radius=转弯半径)
ccx_3 = CurveCurve(CurveA=cir_2, CurveB=line)  # -> Points, ParamsA, ParamsB
arc = Arc3Pt(PointA=bang._000000000000, PointB=ccx_3.Points, PointC=bang._000000000100)  # -> Arc, Plane, Radius
crv = Curve(路0_2)
crv_2 = Curve(arc.Arc)
crv_3 = Curve(路1_2)
end_2 = EndPoints(Curve=crv)  # -> Start, End
ccx_4 = CurveCurve(CurveA=crv, CurveB=crv_2)  # -> Points, ParamsA, ParamsB
ccx_5 = CurveCurve(CurveA=crv_2, CurveB=crv_3)  # -> Points, ParamsA, ParamsB
ln = Line(StartPoint=end_2.Start, EndPoint=ccx_4.Points)
pt_2 = Point(ccx_5.Points)
crv_4 = Curve(ln)
转弯路径 = ClusterOutput(crv_2)
末点 = ClusterOutput(pt_2)
路0_3 = ClusterOutput(crv_4)

# ==== cluster 普通转弯路径_4
路0 = ClusterInput()
路1 = ClusterInput()
转弯半径 = ClusterInput()
路0_2 = Curve(路0)
路1_2 = Curve(路1)
angle = Angle(VectorA=路0_2, VectorB=路1_2)  # -> Angle, Reflex
subtraction = Subtraction(A="pi", B=angle.Angle)
ccx = CurveCurve(CurveA=路0_2, CurveB=路1_2)  # -> Points, ParamsA, ParamsB
smaller = SmallerThan(FirstNumber=angle.Angle, SecondNumber=1.570796327)  # -> SmallerThan, OrEqualTo
filter = StreamFilter(Gate=smaller.OrEqualTo, Stream0=angle.Angle, Stream1=subtraction)
division = Division(A=filter, B=2)
tan = Tangent(Value=division)
sin = Sine(Value=division)
division_2 = Division(A=转弯半径, B=tan)
cir = Circle(Plane=ccx.Points, Radius=division_2)
ccx_2 = CurveCurve(CurveA=cir, CurveB=[路0_2, 路1_2])  # -> graft(Points), ParamsA, ParamsB
division_3 = Division(A=转弯半径, B=sin)
pt = Point(flatten(ccx_2.Points))
pline = PolyLine(Vertices=pt, Closed=False)
curvepoint = PointOnCurve(pline, parameter=0.5)
vec2pt = Vector2Pt(PointA=ccx.Points, PointB=curvepoint, Unitize=False)  # -> Vector, Length
bang = ExplodeTree(Data=ccx_2.Points)  # -> _0000000000000000, _0000000000000100
line = LineSDL(Start=ccx.Points, Direction=vec2pt.Vector, Length=division_3)
end = EndPoints(Curve=line)  # -> Start, End
cir_2 = Circle(Plane=end.End, Radius=转弯半径)
ccx_3 = CurveCurve(CurveA=cir_2, CurveB=line)  # -> Points, ParamsA, ParamsB
arc = Arc3Pt(PointA=bang._0000000000000000, PointB=ccx_3.Points, PointC=bang._0000000000000100)  # -> Arc, Plane, Radius
crv = Curve(路0_2)
crv_2 = Curve(arc.Arc)
crv_3 = Curve(路1_2)
end_2 = EndPoints(Curve=crv)  # -> Start, End
ccx_4 = CurveCurve(CurveA=crv, CurveB=crv_2)  # -> Points, ParamsA, ParamsB
ccx_5 = CurveCurve(CurveA=crv_2, CurveB=crv_3)  # -> Points, ParamsA, ParamsB
ln = Line(StartPoint=end_2.Start, EndPoint=ccx_4.Points)
pt_2 = Point(ccx_5.Points)
crv_4 = Curve(ln)
转弯路径 = ClusterOutput(crv_2)
末点 = ClusterOutput(pt_2)
路0_3 = ClusterOutput(crv_4)
