# Grasshopper definition 20171219_动线生成.gh (Grasshopper 0.9.76)

panel = Panel("""确定的元素
下闸道和上闸道是确定的""")
# 货车动线
# 入口进入位置和角度
# 进入可以停车的行驶长度
# 停车位长度种类：
# 	短时间
# 	较长的停车时间（过夜）
# if 进入加油站
# 	长度，角度和方向
# 	加油位置（加油种类）
# 	出口位置，角度
# elif 直接进入出口
# 	出口的角度，长度
# else 进入大车修车区域
# 	修车位置
# 	修理空间，掉头空间
# 加油和修车的出口汇成一条道路
panel_2 = Panel("""停车位
路灯
绿化
和人线的连接
加油站的油泵""")
panel_3 = Panel("""小车动线
大巴动线
货车动线""")
panel_4 = Panel("转弯半径的结合所有的车动线")
panel_5 = Panel("点的控制是大概的，数据本身可以直接自我调节")
panel_6 = Panel("货车的动线尽量简短，减少其较大的噪声对服务区使用人的感受的影响")
入口角度 = Slider(122, range=-180..180)
入口 = Point(Point(116339.8543, -309046.5659, 0))
出口角度 = Slider(-57, range=-180..180)
转弯半径 = Slider(16127, range=0..22000)
高速0 = Point(Point(95751.63501, -302175.4092, 0))
高速1 = Point(Point(311935.6841, -388807.227, 0))
出口 = Point(Point(220869.8476, -355490.9041, 0))
大车通行的车道宽度 = Slider(-19405, range=-40000..22001)
大车通行的车道宽度_2 = Slider(9683, range=-40000..22001)
int = Integer(转弯半径)
pt = Point(入口)
pt_2 = Point(出口)
插入点 = Point(<point referenced from the Rhino model>)
ln = Line(StartPoint=高速0, EndPoint=高速1)
number_slider = Slider(100000, range=0..100000)
转弯半径_2 = Slider(11324, range=0..22000)
vec = Vector(ln)
vec_2 = Vector(Vector(256077.3075, -202373.8539, 0))
断开路转弯路径 = 断开路转弯路径(路0=ln, 路1矢量=vec_2, 路1长度=number_slider, 入口点=pt, 转入角度=入口角度, 转弯半径0=int, 转弯半径1=转弯半径_2, 两路间距=大车通行的车道宽度)  # -> 路0_4, 转弯路径0, 路01, 转弯路径1, 路1_3
断开路转弯路径_2 = 断开路转弯路径_2(路0=断开路转弯路径.路1_3, 路1矢量=vec_2, 路1长度=number_slider, 入口点=pt_2, 转入角度=出口角度, 转弯半径0=int, 转弯半径1=转弯半径_2, 两路间距=大车通行的车道宽度_2)  # -> 路0_4, 转弯路径0, 路01, 转弯路径1, 路1_3
cluster = Cluster(A=断开路转弯路径.转弯路径1)
cluster_2 = Cluster(A=断开路转弯路径.转弯路径0)

# ==== cluster 断开路转弯路径
路0 = ClusterInput()
路1矢量 = ClusterInput()
路1长度 = ClusterInput()
入口点 = ClusterInput()
转入角度 = ClusterInput()
转弯半径0 = ClusterInput()
转弯半径1 = ClusterInput()
两路间距 = ClusterInput()
vec = Vector(路1矢量)
int = Integer(路1长度)
int_2 = Integer(两路间距)
int_3 = Integer(转入角度)
pt = Point(入口点)
crv = Curve(路0)
end = EndPoints(Curve=crv)  # -> Start, End
int_4 = Integer(转弯半径0)
int_5 = Integer(转弯半径1)
crv_cp = CurveClosestPoint(Point=pt, Curve=crv)  # -> Point, Parameter, Distance
rad = Radians(Degrees=int_3)
xy = XYPlane(Origin=crv_cp.Point)
vec_2 = Vector(crv)
sin = Sine(Value=rad)
vrot = Rotate(Vector=vec_2, Axis=xy, Angle=rad)
division = Division(A=int_2, B=sin)
line = LineSDL(Start=crv_cp.Point, Direction=vrot, Length=division)
路1 = Curve(line)
路0_2 = Curve(line)
crv_2 = Curve(路1)
end_2 = EndPoints(Curve=line)  # -> Start, End
pt_2 = Point(end_2.End)
line_2 = LineSDL(Start=pt_2, Direction=vec, Length=int)
路1_2 = Curve(line_2)
ln = Line(StartPoint=end.Start, EndPoint=end_2.Start)
路0_3 = Curve(ln)
angle = Angle(VectorA=路0_2, VectorB=路1_2)  # -> Angle, Reflex
subtraction = Subtraction(A="pi", B=angle.Angle)
crv_3 = Curve(路1_2)
angle_2 = Angle(VectorA=路0_3, VectorB=路1)  # -> Angle, Reflex
subtraction_2 = Subtraction(A="pi", B=angle_2.Angle)
ccx = CurveCurve(CurveA=路0_3, CurveB=crv_2)  # -> Points, ParamsA, ParamsB
smaller = SmallerThan(FirstNumber=angle.Angle, SecondNumber=1.570796327)  # -> SmallerThan, OrEqualTo
filter = StreamFilter(Gate=smaller.OrEqualTo, Stream0=angle.Angle, Stream1=subtraction)
ccx_2 = CurveCurve(CurveA=路0_2, CurveB=crv_3)  # -> Points, ParamsA, ParamsB
smaller_2 = SmallerThan(FirstNumber=angle_2.Angle, SecondNumber=1.570796327)  # -> SmallerThan, OrEqualTo
filter_2 = StreamFilter(Gate=smaller_2.OrEqualTo, Stream0=angle_2.Angle, Stream1=subtraction_2)
division_2 = Division(A=filter_2, B=2)
division_3 = Division(A=filter, B=2)
tan = Tangent(Value=division_2)
sin_2 = Sine(Value=division_2)
tan_2 = Tangent(Value=division_3)
sin_3 = Sine(Value=division_3)
division_4 = Division(A=int_4, B=tan)
cir = Circle(Plane=ccx.Points, Radius=division_4)
ccx_3 = CurveCurve(CurveA=cir, CurveB=[路0_3, crv_2])  # -> graft(Points), ParamsA, ParamsB
division_5 = Division(A=int_4, B=sin_2)
division_6 = Division(A=int_5, B=tan_2)
cir_2 = Circle(Plane=ccx_2.Points, Radius=division_6)
ccx_4 = CurveCurve(CurveA=cir_2, CurveB=[路0_2, crv_3])  # -> graft(Points), ParamsA, ParamsB
division_7 = Division(A=int_5, B=sin_3)
pt_3 = Point(flatten(ccx_3.Points))
pline = PolyLine(Vertices=pt_3, Closed=False)
curvepoint = PointOnCurve(pline, parameter=0.5)
pt_4 = Point(flatten(ccx_4.Points))
pline_2 = PolyLine(Vertices=pt_4, Closed=False)
curvepoint_2 = PointOnCurve(pline_2, parameter=0.5)
vec2pt = Vector2Pt(PointA=ccx.Points, PointB=curvepoint, Unitize=False)  # -> Vector, Length
vec2pt_2 = Vector2Pt(PointA=ccx_2.Points, PointB=curvepoint_2, Unitize=False)  # -> Vector, Length
bang = ExplodeTree(Data=ccx_3.Points)  # -> _0000, _0010
bang_2 = ExplodeTree(Data=ccx_4.Points)  # -> _0000, _0010
line_3 = LineSDL(Start=ccx.Points, Direction=vec2pt.Vector, Length=division_5)
line_4 = LineSDL(Start=ccx_2.Points, Direction=vec2pt_2.Vector, Length=division_7)
end_3 = EndPoints(Curve=line_3)  # -> Start, End
cir_3 = Circle(Plane=end_3.End, Radius=int_4)
end_4 = EndPoints(Curve=line_4)  # -> Start, End
cir_4 = Circle(Plane=end_4.End, Radius=int_5)
ccx_5 = CurveCurve(CurveA=cir_3, CurveB=line_3)  # -> Points, ParamsA, ParamsB
arc = Arc3Pt(PointA=bang._0000, PointB=ccx_5.Points, PointC=bang._0010)  # -> Arc, Plane, Radius
ccx_6 = CurveCurve(CurveA=cir_4, CurveB=line_4)  # -> Points, ParamsA, ParamsB
arc_2 = Arc3Pt(PointA=bang_2._0000, PointB=ccx_6.Points, PointC=bang_2._0010)  # -> Arc, Plane, Radius
crv_4 = Curve(路0_3)
crv_5 = Curve(arc.Arc)
crv_6 = Curve(crv_2)
crv_7 = Curve(路0_2)
crv_8 = Curve(crv_3)
crv_9 = Curve(arc_2.Arc)
end_5 = EndPoints(Curve=crv_4)  # -> Start, End
ccx_7 = CurveCurve(CurveA=crv_4, CurveB=crv_5)  # -> Points, ParamsA, ParamsB
ccx_8 = CurveCurve(CurveA=crv_5, CurveB=crv_6)  # -> Points, ParamsA, ParamsB
ccx_9 = CurveCurve(CurveA=crv_7, CurveB=crv_9)  # -> Points, ParamsA, ParamsB
ccx_10 = CurveCurve(CurveA=crv_9, CurveB=crv_8)  # -> Points, ParamsA, ParamsB
crv_10 = Curve(line_2)
ln_2 = Line(StartPoint=end_5.Start, EndPoint=ccx_7.Points)
pt_5 = Point(ccx_8.Points)
end_6 = EndPoints(Curve=crv_10)  # -> Start, End
ln_3 = Line(StartPoint=pt_5, EndPoint=ccx_9.Points)
pt_6 = Point(ccx_10.Points)
pt_7 = Point(pt_6)
crv_11 = Curve(ln_2)
ln_4 = Line(StartPoint=pt_7, EndPoint=end_6.End)
crv_12 = Curve(ln_4)
crv_13 = Curve(ln_3)
转弯路径0 = ClusterOutput(crv_5)
转弯路径1 = ClusterOutput(crv_9)
路0_4 = ClusterOutput(crv_11)
路01 = ClusterOutput(crv_13)
路1_3 = ClusterOutput(crv_12)

# ==== cluster 断开路转弯路径_2
路0 = ClusterInput()
路1矢量 = ClusterInput()
路1长度 = ClusterInput()
入口点 = ClusterInput()
转入角度 = ClusterInput()
转弯半径0 = ClusterInput()
转弯半径1 = ClusterInput()
两路间距 = ClusterInput()
vec = Vector(路1矢量)
int = Integer(路1长度)
int_2 = Integer(两路间距)
int_3 = Integer(转入角度)
pt = Point(入口点)
crv = Curve(路0)
end = EndPoints(Curve=crv)  # -> Start, End
int_4 = Integer(转弯半径0)
int_5 = Integer(转弯半径1)
crv_cp = CurveClosestPoint(Point=pt, Curve=crv)  # -> Point, Parameter, Distance
rad = Radians(Degrees=int_3)
xy = XYPlane(Origin=crv_cp.Point)
vec_2 = Vector(crv)
sin = Sine(Value=rad)
vrot = Rotate(Vector=vec_2, Axis=xy, Angle=rad)
division = Division(A=int_2, B=sin)
line = LineSDL(Start=crv_cp.Point, Direction=vrot, Length=division)
路1 = Curve(line)
路0_2 = Curve(line)
crv_2 = Curve(路1)
end_2 = EndPoints(Curve=line)  # -> Start, End
pt_2 = Point(end_2.End)
line_2 = LineSDL(Start=pt_2, Direction=vec, Length=int)
路1_2 = Curve(line_2)
ln = Line(StartPoint=end.Start, EndPoint=end_2.Start)
路0_3 = Curve(ln)
angle = Angle(VectorA=路0_2, VectorB=路1_2)  # -> Angle, Reflex
subtraction = Subtraction(A="pi", B=angle.Angle)
crv_3 = Curve(路1_2)
angle_2 = Angle(VectorA=路0_3, VectorB=路1)  # -> Angle, Reflex
subtraction_2 = Subtraction(A="pi", B=angle_2.Angle)
ccx = CurveCurve(CurveA=路0_3, CurveB=crv_2)  # -> Points, ParamsA, ParamsB
smaller = SmallerThan(FirstNumber=angle.Angle, SecondNumber=1.570796327)  # -> SmallerThan, OrEqualTo
filter = StreamFilter(Gate=smaller.OrEqualTo, Stream0=angle.Angle, Stream1=subtraction)
ccx_2 = CurveCurve(CurveA=路0_2, CurveB=crv_3)  # -> Points, ParamsA, ParamsB
smaller_2 = SmallerThan(FirstNumber=angle_2.Angle, SecondNumber=1.570796327)  # -> SmallerThan, OrEqualTo
filter_2 = StreamFilter(Gate=smaller_2.OrEqualTo, Stream0=angle_2.Angle, Stream1=subtraction_2)
division_2 = Division(A=filter_2, B=2)
division_3 = Division(A=filter, B=2)
tan = Tangent(Value=division_2)
sin_2 = Sine(Value=division_2)
tan_2 = Tangent(Value=division_3)
sin_3 = Sine(Value=division_3)
division_4 = Division(A=int_4, B=tan)
cir = Circle(Plane=ccx.Points, Radius=division_4)
ccx_3 = CurveCurve(CurveA=cir, CurveB=[路0_3, crv_2])  # -> graft(Points), ParamsA, ParamsB
division_5 = Division(A=int_4, B=sin_2)
division_6 = Division(A=int_5, B=tan_2)
cir_2 = Circle(Plane=ccx_2.Points, Radius=division_6)
ccx_4 = CurveCurve(CurveA=cir_2, CurveB=[路0_2, crv_3])  # -> graft(Points), ParamsA, ParamsB
division_7 = Division(A=int_5, B=sin_3)
pt_3 = Point(flatten(ccx_3.Points))
pline = PolyLine(Vertices=pt_3, Closed=False)
curvepoint = PointOnCurve(pline, parameter=0.5)
pt_4 = Point(flatten(ccx_4.Points))
pline_2 = PolyLine(Vertices=pt_4, Closed=False)
curvepoint_2 = PointOnCurve(pline_2, parameter=0.5)
vec2pt = Vector2Pt(PointA=ccx.Points, PointB=curvepoint, Unitize=False)  # -> Vector, Length
vec2pt_2 = Vector2Pt(PointA=ccx_2.Points, PointB=curvepoint_2, Unitize=False)  # -> Vector, Length
bang = ExplodeTree(Data=ccx_3.Points)  # -> _00000000, _00000010
bang_2 = ExplodeTree(Data=ccx_4.Points)  # -> _00000000, _00000010
line_3 = LineSDL(Start=ccx.Points, Direction=vec2pt.Vector, Length=division_5)
line_4 = LineSDL(Start=ccx_2.Points, Direction=vec2pt_2.Vector, Length=division_7)
end_3 = EndPoints(Curve=line_3)  # -> Start, End
cir_3 = Circle(Plane=end_3.End, Radius=int_4)
end_4 = EndPoints(Curve=line_4)  # -> Start, End
cir_4 = Circle(Plane=end_4.End, Radius=int_5)
ccx_5 = CurveCurve(CurveA=cir_3, CurveB=line_3)  # -> Points, ParamsA, ParamsB
arc = Arc3Pt(PointA=bang._00000000, PointB=ccx_5.Points, PointC=bang._00000010)  # -> Arc, Plane, Radius
ccx_6 = CurveCurve(CurveA=cir_4, CurveB=line_4)  # -> Points, ParamsA, ParamsB
arc_2 = Arc3Pt(PointA=bang_2._00000000, PointB=ccx_6.Points, PointC=bang_2._00000010)  # -> Arc, Plane, Radius
crv_4 = Curve(路0_3)
crv_5 = Curve(arc.Arc)
crv_6 = Curve(crv_2)
crv_7 = Curve(路0_2)
crv_8 = Curve(crv_3)
crv_9 = Curve(arc_2.Arc)
end_5 = EndPoints(Curve=crv_4)  # -> Start, End
ccx_7 = CurveCurve(CurveA=crv_4, CurveB=crv_5)  # -> Points, ParamsA, ParamsB
ccx_8 = CurveCurve(CurveA=crv_5, CurveB=crv_6)  # -> Points, ParamsA, ParamsB
ccx_9 = CurveCurve(CurveA=crv_7, CurveB=crv_9)  # -> Points, ParamsA, ParamsB
ccx_10 = CurveCurve(CurveA=crv_9, CurveB=crv_8)  # -> Points, ParamsA, ParamsB
crv_10 = Curve(line_2)
ln_2 = Line(StartPoint=end_5.Start, EndPoint=ccx_7.Points)
pt_5 = Point(ccx_8.Points)
end_6 = EndPoints(Curve=crv_10)  # -> Start, End
ln_3 = Line(StartPoint=pt_5, EndPoint=ccx_9.Points)
pt_6 = Point(ccx_10.Points)
pt_7 = Point(pt_6)
crv_11 = Curve(ln_2)
ln_4 = Line(StartPoint=pt_7, EndPoint=end_6.End)
crv_12 = Curve(ln_4)
crv_13 = Curve(ln_3)
转弯路径0 = ClusterOutput(crv_5)
转弯路径1 = ClusterOutput(crv_9)
路0_4 = ClusterOutput(crv_11)
路01 = ClusterOutput(crv_13)
路1_3 = ClusterOutput(crv_12)

# ==== cluster Cluster
number_slider = Slider(671, range=0..1000)
A = ClusterInput()
darc = DeconstructArc(Arc=A)  # -> BasePlane, Radius, Angle
arcdim = ArcDimension(Arc=A, Offset=Slider(2080, range=0..10000), Text="{0:0.0}°", Size=number_slider)
end = EndPoints(Curve=A)  # -> Start, End
pt = Point(darc.BasePlane)
ln = Line(StartPoint=pt, EndPoint=end.End)
ln_2 = Line(StartPoint=pt, EndPoint=end.Start)
linedim = LineDimension(Line=ln_2, Text="{0:0.00}", Size=number_slider)
