# Grasshopper definition 20171219_草图化动线生成.gh (Grasshopper 0.9.76)

number_slider = Slider(10000, range=0..10000)
number_slider_2 = Slider(5659, range=0..10000)
number_slider_3 = Slider(9151, range=0..10000)
number_slider_4 = Slider(6676, range=0..10000)
pt = Point(Point(97183.55743, -302106.4806, 0))
pt_2 = Point(Point(109272.0989, -311036.7996, 0))
pt_3 = Point(Point(109814.39, -328055.3369, 0))
pt_4 = Point(Point(234860.7029, -386905.9732, 0))
pt_5 = Point(Point(269004.5734, -368814.687, 0))
pt_6 = Point(Point(312656.8635, -389406.4161, 0))
merge = Merge(Data1=pt, Data2=pt_2, Data3=pt_3, Data4=pt_4, Data5=pt_5, Data6=pt_6)
merge_2 = Merge(Data1=number_slider, Data2=number_slider_2, Data3=number_slider_3, Data4=number_slider_4)
pline = PolyLine(Vertices=merge, Closed=False)
explode = Explode(Curve=pline, Recursive=True)  # -> Segments, Vertices
shift = ShiftList(List=merge, Shift=-1, Wrap=False)
num = Number(graft(merge_2))
shift_2 = ShiftList(List=shift, Shift=1, Wrap=False)
shift_3 = ShiftList(List=explode.Segments, Shift=1, Wrap=False)  # -> graft(List)
shift_4 = ShiftList(List=explode.Segments, Shift=-1, Wrap=False)  # -> graft(List)
item = ListItem(List=merge, Index=-1, Wrap=True)
item_2 = ListItem(List=merge, Index=0, Wrap=True)
pt_7 = Point(shift_2)
merge_3 = Merge(Data1=shift_4, Data2=shift_3)
pt_8 = Point(graft(pt_7))
len = Length(Curve=merge_3)
angle = Angle(VectorA=shift_4, VectorB=shift_3)  # -> Angle, Reflex
larger = LargerThan(FirstNumber=angle.Angle, SecondNumber=1.570796327)  # -> LargerThan, OrEqualTo
subtraction = Subtraction(A=3.141592654, B=angle.Angle)
sort = SortList(Keys=len)  # -> Keys, ValuesA
item_3 = ListItem(List=sort.Keys, Index=0, Wrap=True)
num_2 = Number(item_3)
bang = ExplodeTree(Data=simplify(num_2))  # -> Branch0, Branch1, Branch2, Branch3
larger_2 = LargerThan(FirstNumber=num, SecondNumber=num_2)  # -> LargerThan, OrEqualTo
bang_2 = ExplodeTree(Data=simplify(larger_2.LargerThan))  # -> Branch0, Branch1, Branch2, Branch3
bang_3 = ExplodeTree(Data=simplify(larger.LargerThan))  # -> Branch0, Branch1, Branch2, Branch3
bang_4 = ExplodeTree(Data=simplify(subtraction))  # -> Branch0, Branch1, Branch2, Branch3
bang_5 = ExplodeTree(Data=simplify(angle.Angle))  # -> Branch0, Branch1, Branch2, Branch3
filter = StreamFilter(Gate=bang_2.Branch0, Stream0=number_slider, Stream1=bang.Branch0)
filter_2 = StreamFilter(Gate=bang_2.Branch1, Stream0=number_slider_2, Stream1=bang.Branch1)
filter_3 = StreamFilter(Gate=bang_2.Branch2, Stream0=number_slider_3, Stream1=bang.Branch2)
filter_4 = StreamFilter(Gate=bang_2.Branch3, Stream0=number_slider_4, Stream1=bang.Branch3)
filter_5 = StreamFilter(Gate=bang_3.Branch3, Stream0=bang_4.Branch3, Stream1=bang_5.Branch3)
filter_6 = StreamFilter(Gate=bang_3.Branch2, Stream0=bang_4.Branch2, Stream1=bang_5.Branch2)
filter_7 = StreamFilter(Gate=bang_3.Branch0, Stream0=bang_4.Branch0, Stream1=bang_5.Branch0)
filter_8 = StreamFilter(Gate=bang_3.Branch1, Stream0=bang_4.Branch1, Stream1=bang_5.Branch1)
remap = RemapNumbers(Source=Domain(0, 1), Target=Domain(0, 1))  # -> Mapped, Clipped
panel = Panel(filter_7)
merge_4 = Merge(Data1=filter, Data2=filter_2, Data3=filter_3, Data4=filter_4)
cir = Circle(Plane=pt_7, Radius=merge_4)
ccx = CurveCurve(CurveA=pline, CurveB=cir)  # -> Points, ParamsA, ParamsB
vec2pt = Vector2Pt(PointA=pt_8, PointB=ccx.Points, Unitize=False)  # -> Vector, Length
item_4 = ListItem(List=ccx.Points, Index=0, Wrap=True)
pt_9 = Point(flatten(item_4))
ins = InsertItems(List=pt_9, Item=item, Indices=-1, Wrap=True)  # -> graft(List)
item_5 = ListItem(List=ccx.Points, Index=1, Wrap=True)
pt_10 = Point(flatten(item_5))
ins_2 = InsertItems(List=pt_10, Item=item_2, Indices=0, Wrap=True)  # -> graft(List)
rev = Reverse(Vector=vec2pt.Vector)
merge_5 = Merge(Data1=ins, Data2=ins_2)
item_6 = ListItem(List=rev, Index=0, Wrap=True)
pline_2 = PolyLine(Vertices=merge_5, Closed=False)  # -> simplify(Polyline)
arc = ArcSED(Start=item_4, End=item_5, Direction=item_6)  # -> Arc, Plane, Radius
arc_2 = CircularArc(simplify(arc.Arc))
join = JoinCurves(Curves=[pline_2, arc_2], Preserve=False)
