# Grasshopper definition 20171220_partC-level1.gh (Grasshopper 0.9.76)

number_slider = Slider(100, range=0..100)
crv = Curve(<curve referenced from the Rhino model>)
number_slider_2 = Slider(0.31, range=0..1)
divide = DivideCurve(Curve=crv, Count=number_slider, Kinks=False)  # -> Points, Tangents, Parameters
series = Series(Start=0, Step=0.1, Count=11)
series_2 = Series(Start=0, Step=1, Count=number_slider)
num = Number(graft(series))

pt = Point([Point(-34.18189089, -7.521323881, 0), Point(-6.073545192, 30.86267194, 0), Point(35.06313527, -28.73645837, 0), Point(78.90863959, 32.59524943, 0)])
shift = ShiftList(List=pt, Shift=1, Wrap=False)
short = ShortestList(ListA=pt, ListB=shift, TrimMode=2)  # -> ListA, ListB
ln = Line(StartPoint=short.ListA, EndPoint=short.ListB)
eval = EvaluateCurve(Curve=reparameterize(ln), Parameter=num)  # -> Point, Tangent, Angle

graph = GraphMapper(series_2, x0=0, x1=100, y0=0, y1=50, container_name="Gaussian", factor=0.165433228, mean=0.5397449732, sdev=0.100359261)
shift_2 = ShiftList(List=divide.Points, Shift=Slider(9, range=0..100), Wrap=True)
Z = UnitZ(Factor=graph)

pt_2 = Point(eval.Point)
shift_3 = ShiftList(List=pt_2, Shift=1, Wrap=False)
short_2 = ShortestList(ListA=pt_2, ListB=shift_3, TrimMode=2)  # -> ListA, ListB
ln_2 = Line(StartPoint=short_2.ListA, EndPoint=short_2.ListB)
eval_2 = EvaluateCurve(Curve=reparameterize(ln_2), Parameter=num)  # -> Point, Tangent, Angle

pt_3 = Point(eval_2.Point)
shift_4 = ShiftList(List=pt_3, Shift=1, Wrap=False)
short_3 = ShortestList(ListA=pt_3, ListB=shift_4, TrimMode=2)  # -> ListA, ListB
ln_3 = Line(StartPoint=short_3.ListA, EndPoint=short_3.ListB)
eval_3 = EvaluateCurve(Curve=reparameterize(ln_3), Parameter=num)  # -> flatten(Point), Tangent, Angle

move = Move(Geometry=shift_2, Motion=Z)  # -> Geometry, Transform
panel = Panel(graph)
intcrv = Interpolate(Vertices=eval_3.Point, Degree=3, Periodic=False, KnotStyle=1)  # -> Curve, Length, Domain
