# Grasshopper definition 20170323_primer_01.gh (Grasshopper 0.9.76)

md_slider = MDSlider(
    slider_value=Point(0.1234755632, 0.1310971888, 0.5),
    SliderMode=0,
    x_domain=Domain(0, 100),
    y_domain=Domain(0, 100),
    z_domain=Domain(0, 1))
pt = Point()
crv = Curve(reparameterize(<curve referenced from the Rhino model>))
pt_2 = Point(pt)
range = Range(Domain=Slider(7, range=0..10), Steps=Slider(100, range=0..100))
divide = DivideCurve(Curve=crv, Count=Slider(12, range=0..100), Kinks=False)  # -> Points, Tangents, Parameters
number_slider = Slider(38, range=0..50)
end = EndPoints()  # -> Start, End
eval = Evaluate(F="x*sin(5*x)", x=range)
eval_2 = Evaluate(F="x*cos(5*x)", x=range)
graph = GraphMapper(
    divide.Parameters,
    x0=0,
    x1=1,
    y0=0,
    y1=1,
    container_name="Sine",
    Equation_px=[0.03918931261, 0.6337839365],
    Equation_py=[0.1347824335, 0.8884056211])
crv_2 = Curve(<curve referenced from the Rhino model>)
hexgrid = Hexagonal(Plane=md_slider, Size=Slider(1.436, range=0..10), ExtentX=number_slider, ExtentY=number_slider)  # -> Cells, Points
pt_3 = ConstructPoint(XCoordinate=eval, YCoordinate=eval_2, ZCoordinate=range)
crv_cp = CurveClosestPoint(Point=hexgrid.Points, Curve=crv_2)  # -> Point, Parameter, Distance
multiplication = Multiplication(A=graph, B=Slider(4, range=0..10))
pt_4 = Point(pt_3)
vec2pt = Vector2Pt(PointA=hexgrid.Points, PointB=crv_cp.Point, Unitize=False)  # -> Vector, Length
intcrv = Interpolate(Vertices=pt_3, Degree=3, Periodic=False, KnotStyle=1)  # -> Curve, Length, Domain
circle = CircleCNR(Center=divide.Points, Normal=divide.Tangents, Radius=multiplication)
number_slider_2 = Slider(-0.19, range=-1..1.01)
angle = Angle()  # -> Angle, Reflex
num = Number(flatten(vec2pt.Length))
loft = Loft(Curves=circle, Options={Adjust=True, Closed=False, LoftEnds=0, LoftSimp=0, LoftType=0, Rebuild=10, Refit=0.01})  # disabled
circle_2 = CircleCNR(Center=hexgrid.Points, Normal=vec2pt.Vector, Radius=Slider(1.149, range=0..10))
panel = Panel(intcrv.Curve)
boundary = BoundarySurfaces(Edges=circle_2)
preview = CustomPreview(Geometry=boundary, Shader=ColourSwatch(SwatchColor=RGB(0, 0, 0)))
