# Grasshopper definition 20170324_primer_02.gh (Grasshopper 1.0.7)

pt = Point(Point(-19.10766326, -81.34460363, 0))
X = UnitX(Factor=Slider(0.504, range=0..1))
arrlinear = LinearArray(Geometry=pt, Direction=X, Count=Slider(157, range=0..1100))  # -> Geometry, Transform
panel = Panel(arrlinear.Transform)
number_slider = Slider(6, range=0..10)
number_slider_2 = Slider(5, range=0..10)
pt_2 = Point(arrlinear.Geometry)
pdecon = Deconstruct(Point=pt_2)  # -> XComponent, YComponent, ZComponent
expression = Expression(x=pdecon.XComponent, Expression="x*sin(x)")
expression_2 = Expression(x=pdecon.XComponent, Expression="x*cos(x)")
pt_3 = ConstructPoint(XCoordinate=expression, YCoordinate=expression_2, ZCoordinate=0)
intcrv = Interpolate(Vertices=pt_3, Degree=3, Periodic=False, KnotStyle=1)  # -> Curve, Length, Domain
con = DelaunayEdges(Points=pt_3, Plane=PlaneXY(0, 0, 0))  # -> Connectivity, Edges
voronoi = Voronoi(Points=pt_3, Radius=Slider(24, range=0..100), BruteForceOverride=False)
