# Grasshopper definition Wallacei X_Kangaroo2_ExampleFile.gh (Grasshopper 1.0.7)
# plug-ins: Weaverbird, Wallacei, Kangaroo2 Components

wlc_3 = GenePool(Decimals=0, Maximum=342, Minimum=0, Value=[315.0285103, 286.0695334])
wlc_1 = GenePool(Decimals=2, Maximum=4, Minimum=0, Value=[3.619124042, 3.724167058, 3.102426504, 3.132751511])
wlc_2 = GenePool(Decimals=2, Maximum=10, Minimum=6, Value=[9.619124042, 9.730775529, 9.102426504, 9.132751511])
wlc_4 = GenePool(Decimals=2, Maximum=1500, Minimum=50, Value=[1361.932465, 1400.010559, 1181.778237, 1185.622423])
shuffler = GenePoolAndSliderShuffler(BooleanButton=Button())
item = ListItem(List=wlc_1, Index=0, Wrap=True)  # -> Item, Item1, Item2, Item3
item_2 = ListItem(List=wlc_2, Index=0, Wrap=True)  # -> Item, Item1, Item2, Item3
subtraction = Subtraction(A=item.Item3, B="10")
subtraction_2 = Subtraction(A=item_2.Item3, B="10")
abs = Absolute(Value=subtraction)
abs_2 = Absolute(Value=subtraction_2)
pt = ConstructPoint(XCoordinate=item.Item, YCoordinate=item.Item1, ZCoordinate=0)
pt_2 = ConstructPoint(XCoordinate=item.Item2, YCoordinate=abs, ZCoordinate=0)
pt_3 = ConstructPoint(XCoordinate=item_2.Item, YCoordinate=item_2.Item1, ZCoordinate=0)
pt_4 = ConstructPoint(XCoordinate=item_2.Item2, YCoordinate=abs_2, ZCoordinate=0)
merge = Merge(Data1=flatten(pt), Data2=flatten(pt_2), Data3=flatten(pt_3), Data4=flatten(pt_4))
pline = PolyLine(Vertices=merge, Closed=True)
boundary = BoundarySurfaces(Edges=pline)
custom_mesh_settings = SettingsCustom(
    StitchSeams=True,
    SimplePlanes=False,
    Refine=True,
    MinCount=Slider(300, range=0..500),
    MaxCount=400,
    AspectRatio=20,
    MaxDistance=0,
    MaxAngle=20,
    MinEdge=0,
    MaxEdge=0)
mesh = MeshBrep(Brep=boundary, Settings=custom_mesh_settings)
demesh = DeconstructMesh(Mesh=mesh)  # -> Vertices, Faces, Colours, Normals
pt_5 = Point(demesh.Vertices)
mc = MeshCorners(Mesh=mesh, Angle=2.35619449)
pt_6 = Point(mc)
item_3 = ListItem(List=wlc_3, Index=0, Wrap=True)  # -> Item, Item1
item_4 = ListItem(List=pt_5, Index=item_3.Item, Wrap=True)
item_5 = ListItem(List=pt_5, Index=item_3.Item1, Wrap=True)
wbedges = WeaverbirdsMeshEdges(MeshOrPolylines=mesh)
pt_7 = Point([item_4, item_5])

# ---- group: Kangaroo 2_Goals and Zombie Solver
toggle = BooleanToggle(True)
len = Length(Curve=wbedges)
Z = UnitZ(Factor=Slider(1, range=0..5))
anchorxyz = AnchorXYZ(Point=pt_7, X=toggle, Y=toggle, Z=toggle, Strength=Slider(1500, range=0..1500))
anchorxyz_2 = AnchorXYZ(Point=pt_6, X=toggle, Y=toggle, Z=toggle, Strength=wlc_4)
length_line = LengthLine(Line=wbedges, Length=len, Strength=Slider(1000, range=0..1000))
load = Load(Point=flatten(pt_5), ForceVector=Z)
zombiesolver = ZombieSolver(
    GoalObjects=[length_line, anchorxyz, load, anchorxyz_2],
    Threshold=1e-10,
    Tolerance=0.01,
    MaxIterations=Slider(750, range=0..1000))  # -> I, V, O

# ----
dom = ConstructDomain(DomainStart=Slider(0, range=0..100), DomainEnd=Slider(10, range=0..100))
dom_2 = ConstructDomain(DomainStart=Slider(0, range=0..100), DomainEnd=Slider(10, range=0..100))
crv = Curve(zombiesolver.O)
rectangle = Rectangle(Plane=PlaneXY(0, 0, 0), XSize=dom, YSize=dom_2, Radius=0)  # -> Rectangle, Length
wbweave = WeaverbirdsMeshFromLinesWeaveBack(Lines=crv, MaximumValence=4)
demesh_2 = DeconstructMesh(Mesh=wbweave)  # -> Vertices, Faces, Colours, Normals
wbfacepolys = WeaverbirdsFacePolylines(Mesh=wbweave)
mplane = MeshPlane(Boundary=rectangle.Rectangle, WidthCount=Slider(50, range=0..100), HeightCount=Slider(50, range=0..100))  # -> Mesh, Area
demesh_3 = DeconstructMesh(Mesh=mplane.Mesh)  # -> Vertices, Faces, Colours, Normals
sun_vector = Line(Line((65, -45, 11), (53, -30, 0)))
pt_8 = Point(demesh_3.Vertices)
end = EndPoints(Curve=sun_vector)  # -> Start, End
vec2pt = Vector2Pt(PointA=end.Start, PointB=end.End, Unitize=False)  # -> Vector, Length
occ = Occlusion(Samples=pt_8, Obstructions=wbweave, Rays=vec2pt.Vector)  # -> Hits, Occlusion
gradient = Gradient(LowerLimit=0, UpperLimit=1, Parameter=occ.Hits, stops=[0: RGB(255, 255, 255), 1: RGB(0, 0, 0)])

# ---- group: Maximizing the shadow on the ground
ma = MassAddition(Input=occ.Hits)  # -> Result, PartialResults
one_over_x = OneOverX(Value=ma.Result)
wlc_max_shadow = Number(flatten(one_over_x))

# ---- group: Maintain the footprint area between 0.3 to 0.8 squnit
# Maintain the footprint area between 0.3 to 0.8 sq unit area
area = Area(Geometry=pline)  # -> Area, Centroid
area_2 = Area(Geometry=rectangle.Rectangle)  # -> Area, Centroid
division = Division(A=area.Area, B=area_2.Area)
subtraction_3 = Subtraction(A=division, B="0.3")
subtraction_4 = Subtraction(A=division, B="0.8")
abs_3 = Absolute(Value=subtraction_3)
abs_4 = Absolute(Value=subtraction_4)
addition = Addition(A=abs_3, B=abs_4)
wlc_footprint = Number(flatten(addition))

# ---- group: Equalize the lenght of the mesh lines
len_2 = Length(Curve=crv)
clean = CleanTree(RemoveNulls=True, RemoveInvalid=True, RemoveEmpty=False, Tree=len_2)
reldif = RelativeDifferences(Values=clean)
abs_5 = Absolute(Value=reldif)
ma_2 = MassAddition(Input=abs_5)  # -> Result, PartialResults
wlc_eq = Number(flatten(ma_2.Result))

# ---- group: Maintain the distance between the points of contact to the ground
dist = Distance(PointA=item_4, PointB=item_5)
subtraction_5 = Subtraction(A=dist, B="3")
wlc_dist = Number(flatten(subtraction_5))

# ---- group: Keep the the points of contact to the ground away from the corners
pt_9 = Point(item_4)
pt_10 = Point(item_5)
dist_2 = Distance(PointA=pt_9, PointB=pt_6)
dist_3 = Distance(PointA=pt_10, PointB=pt_6)
ma_3 = MassAddition(Input=dist_2)  # -> Result, PartialResults
ma_4 = MassAddition(Input=dist_3)  # -> Result, PartialResults
addition_2 = Addition(A=ma_3.Result, B=ma_4.Result)
one_over_x_2 = OneOverX(Value=addition_2)
wlc_away = Number(flatten(one_over_x_2))

# ----
mesh_2 = Geometry(wbweave)
lines = Geometry(wbfacepolys)
phenotype = Geometry([mesh_2, lines])
preview = CustomPreview(Geometry=wbfacepolys, Material=ColourSwatch(SwatchColor=RGB(0, 0, 0)))
preview_2 = CustomPreview(Geometry=pt_8, Shader=gradient)
preview_3 = CustomPreview(Geometry=wbweave, Shader=ColourSwatch(SwatchColor=RGB(255, 69, 156)))
wallacei_x = WallaceiX(
    Genes=[wlc_1, wlc_2, wlc_3, wlc_4],
    Objectives=[wlc_away, wlc_dist, wlc_eq, wlc_footprint, wlc_max_shadow],
    popGen="-1,-1",
    total="0",
    wlcDone=False)  # -> WallaceiGenomes, FitnessValues, Data, WPhenotypes
