# Grasshopper definition test1.gh (Grasshopper 1.0.7)
# plug-ins: Wallacei

line = Line(Line((-24.1583886, -8.820399483, 0), (35.35678329, 14.98566927, 0)))
genes = GenePool(Decimals=2, Maximum=100, Minimum=0, Value=[50, 50, 50, 50, 50, 50, 50, 50, 50, 50])
txt = Text("3124235")
txt_2 = Text("132143")
geo = Geometry(line)
wallacei_x = WallaceiX(
    Genes=[Slider(90, range=0..100), genes],
    Objectives=[txt_2, txt],
    Phenotype=geo,
    popGen="-1,-1",
    total="0",
    wlcDone=False)  # -> WallaceiGenomes, FitnessValues, Data, WPhenotypes
