# Grasshopper definition 20200306_kanVray动画.gh (Grasshopper 1.0.7)
# plug-ins: V-Ray For Grasshopper 6, Kangaroo2 Components

number_slider = Slider(100, range=0..400)
number_slider_2 = Slider(200, range=0..400)
brep = Brep(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)
number_slider_3 = Slider(237, range=0..300)
brep_2 = Brep(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)
preview = CustomPreview(
    Geometry=brep_2,
    Material={diffuse=RGB(221, 160, 221), emission=RGB(66, 48, 66), shine=0.5, specular=RGB(255, 255, 255), transparency=0})
number_slider_4 = Slider(40, range=0..300)
box = CenterBox(Base=PlaneXY(0, 0, 0), X=number_slider, Y=number_slider, Z=number_slider)
box_2 = CenterBox(Base=PlaneXY(0, 0, 0), X=number_slider_2, Y=number_slider_2, Z=number_slider_2)
Z = UnitZ(Factor=Slider(276, range=0..600))
move = Move(Geometry=box_2, Motion=Z)  # -> Geometry, Transform
move_2 = Move(Geometry=box, Motion=Z)  # -> Geometry, Transform
pop3d = Populate3D(Region=move.Geometry, Count=number_slider_4, Seed=1)
pop3d_2 = Populate3D(Region=move_2.Geometry, Count=number_slider_4, Seed=2)
number_slider_5 = Slider(20, range=0..100)
floor = Floor(Strength=1)
pt = Point(flatten(pop3d_2))
spc = SolidPointCollide(Points=pt, Solid=brep, Interior=False, Unidirectional=True, Strength=number_slider_3)
Z_2 = UnitZ(Factor=expr("x*-1", Slider(0.3987, range=0..5)))
sc = SphereCollide(Points=pt, Radius=number_slider_5, Strength=number_slider_3)
load = Load(Point=pt, ForceVector=Z_2)
solver = Solver(GoalObjects=[sc, load, spc, floor], Reset=Button(), Threshold=1e-15, Tolerance=0.01, On=Toggle(True))  # -> I, V, O; disabled
msphere = MeshSphere(Base=solver.V, Radius=number_slider_5, UCount=10, VCount=20)
timeline = VRayTimeline(FramesCount=50)  # -> Timeline, CurrentFrame, CurrentFraction
stepsolver = StepSolver(
    GoalObjects=[sc, spc, load],
    Tolerance=0.01,
    Momentum=Toggle(True),
    Damping=0.99,
    SubIterations=9,
    Animate=timeline.CurrentFrame)  # -> I, V, O
msphere_2 = MeshSphere(Base=stepsolver.V, Radius=number_slider_5, UCount=10, VCount=20)
preview_2 = CustomPreview(
    Geometry=msphere_2,
    Material={diffuse=RGB(221, 160, 221), emission=RGB(66, 48, 66), shine=0.5, specular=RGB(255, 255, 255), transparency=0})
preview_3 = CustomPreview(
    Geometry=msphere,
    Material={diffuse=RGB(221, 160, 221), emission=RGB(66, 48, 66), shine=0.5, specular=RGB(255, 255, 255), transparency=0})
mtl_name = VRayMaterialFromProject(Has_Extract_Parameter=True, Has_Manage_Collection=False, OptionsLength=3, Options=["/Generic", "/Generic#1", "/black"])
mtl_name_2 = VRayMaterialFromProject(Has_Extract_Parameter=True, Has_Manage_Collection=False, OptionsLength=3, Options=["/Generic", "/Generic#1", "/black"])
mtl_name_3 = VRayMaterialFromProject(Has_Extract_Parameter=True, Has_Manage_Collection=False, OptionsLength=3, Options=["/Generic", "/Generic#1", "/black"])
panel = Panel(timeline.CurrentFrame)
brep_3 = Brep(<brep referenced from the Rhino model>)
srf = Surface(<surface referenced from the Rhino model>)
vgeo = VRayGeometry(Geo=msphere_2, Material=mtl_name)
vgeo_2 = VRayGeometry(Geo=brep_3, Material=mtl_name_3)
vgeo_3 = VRayGeometry(Geo=srf, Material=mtl_name_2)
save_file = OutputImage(
    "G:\architecture\learn\5毕业设计\wer\eee.png",
    File_Picker=1,
    File_Types="Portable Network Graphics (*.png)|*.png|Windows bitmap (*.bmp)|*.bmp|Targa Image (*.tga)|*.tga|Radiance High-Dynamyc Range (*.hdr)|*.hdr|Silicon Graphics (*.sgi; *.rgb; *.rgba)|*.dgi;*.rgb;*.rgba|JPEG image (*.jpg; *.jpeg)|*.jpg;*.jpeg|OpenEXR image (*.exr)|*.exr|SoftImage PICT (*.pic)|*.pic|Tagged image (*.tif; *.tiff)|*.tif;*.tiff|V-Ray Raw Image (*.vrimg)|*.vrimg",
    Has_Extract_Parameter=False,
    Has_Manage_Collection=True,
    Has_Multiple_Files_Menu=False,
    Has_Picker_File_Menu=False,
    Multiple_Files=False)
sampler = Sampler(0, Has_Extract_Parameter=False, Has_Manage_Collection=False, OptionsLength=2, Options=["Progressive", "Bucket"])
quality = Quality(
    2,
    Has_Extract_Parameter=False,
    Has_Manage_Collection=False,
    OptionsLength=5,
    Options=["Draft", "Low", "Medium", "High", "Very High"])
engine = Engine(1, Has_Extract_Parameter=False, Has_Manage_Collection=False, OptionsLength=2, Options=["CPU", "GPU"])
mode = Mode(1, Has_Extract_Parameter=False, Has_Manage_Collection=False, OptionsLength=2, Options=["Interactive", "Production"])
camera = VRayCamera(
    Position=Point(353.281076, -824.8180064, 635.8375635),
    Target=Point(-260.4819422, 553.7634286, -256.6107315),
    FOV=66.17756914,
    PhysicalExposureOn=False,
    FNumber=8,
    ShutterSpeed1S=100,
    FilmSensitivity=625)  # -> Camera, Angle
render = VRayRender(
    Engine=engine,
    Mode=mode,
    Sampler=sampler,
    Quality=quality,
    OutputImage=save_file,
    OutputResolution=[960, 540],
    Camera=camera.Camera,
    VGeometry=flatten([vgeo, vgeo_2, vgeo_3]),
    Timeline=timeline.Timeline)
lighting_analysis = VRayElementLightingAnalysis(ValueRange=Domain(500, 2000), GridSpacing=40, FadeImage=True, DrawLegend=True)
