# Grasshopper definition 动线生成.gh (Grasshopper 0.9.76)

panel = Panel("""确定的元素
下闸道和上闸道是确定的""")
# 货车动线
# 入口进入位置和角度
# 进入可以停车的行驶长度
# 停车位长度种类：
# 	短时间
# 	较长的停车时间（过夜）
# if 进入加油站
# 	长度，角度和方向
# 	加油位置（加油种类）
# 	出口位置，角度
# elif 直接进入出口
# 	出口的角度，长度
# else 进入大车修车区域
# 	修车位置
# 	修理空间，掉头空间
# 加油和修车的出口汇成一条道路
panel_2 = Panel("""停车位
路灯
绿化
和人线的连接
加油站的油泵""")
panel_3 = Panel("""小车动线
大巴动线
货车动线""")
panel_4 = Panel("转弯半径的结合所有的车动线")
panel_5 = Panel("点的控制是大概的，数据本身可以直接自我调节")
panel_6 = Panel("货车的动线尽量简短，减少其较大的噪声对服务区使用人的感受的影响")
高速0 = Point(Point(94057.99919, -301384.1107, 0))
高速1 = Point(Point(258118.1113, -367482.7865, 0))
入口角度 = Slider(113.168, range=-180..180)
入口 = Point(Point(108877.8317, -307430.2027, 0))
出口 = Point(Point(236249.2216, -358315.917, 0))
大车通行的车道宽度 = Slider(-16098.366, range=-20000..22001)
出口角度 = Slider(29.372, range=-180..180)
ln = Line(StartPoint=高速0, EndPoint=高速1)
crv_cp = CurveClosestPoint(Point=入口, Curve=ln)  # -> Point, Parameter, Distance
vec2pt = Vector2Pt(PointA=crv_cp.Point, PointB=出口, Unitize=False)  # -> Vector, Length
rad = Radians(Degrees=入口角度)
预设值 = Slider(182001, range=-80000..182001)
预设值_2 = Slider(-80000, range=-80000..22001)
rad_2 = Radians(Degrees=出口角度)
xy = XYPlane(Origin=crv_cp.Point)
vec = Vector(vec2pt.Vector)
sin = Sine(Value=rad)
division = Division(A=大车通行的车道宽度, B=sin)
vrot = Rotate(Vector=vec, Axis=xy, Angle=rad)
vrot_2 = Rotate(Vector=vec, Axis=xy, Angle=rad_2)
line = LineSDL(Start=出口, Direction=vrot_2, Length=预设值_2)
line_2 = LineSDL(Start=crv_cp.Point, Direction=vrot, Length=division)
转弯半径 = Slider(11088, range=0..22000)
end = EndPoints(Curve=line_2)  # -> Start, End
line_3 = LineSDL(Start=end.End, Direction=vec, Length=预设值)
ccx = CurveCurve(CurveA=line_3, CurveB=line)  # -> Points, ParamsA, ParamsB
ln_2 = Line(StartPoint=高速0, EndPoint=end.Start)
ln_3 = Line(StartPoint=end.End, EndPoint=ccx.Points)
tan = TangentLines()  # -> Tangent1, Tangent2
intcrv_t = InterpolateT(Degree=3, TangentStart=Vector(0, 0, 0), TangentEnd=Vector(0, 0, 0), KnotStyle=1)  # -> Curve, Length, Domain
arc = ArcSED()  # -> Arc, Plane, Radius
biarc = BiArc(Ratio=0.5)  # -> FirstArc, SecondArc, BiArc
parc = PolyArc(Closed=False)
nurbcrv = NurbsCurve()  # -> Curve, Length, Domain
eval = EvaluateCurve()  # -> Point, Tangent, Angle
cluster = Cluster(路0=ln_2, 路1=line_2, 路相交点=end.Start, 路间角度=rad, 转弯半径=转弯半径)
cluster_2 = Cluster_2(路0=line_2, 路1=ln_3, 路相交点=end.End, 路间角度=rad, 转弯半径=转弯半径)

# ==== cluster Cluster
路0 = ClusterInput()
路1 = ClusterInput()
路相交点 = ClusterInput()
路间角度 = ClusterInput()
转弯半径 = ClusterInput()
路0_2 = Curve(路0)
路1_2 = Curve(路1)
路相交点_2 = Point(路相交点)
路间角度_2 = Number(路间角度)
division = Division(A=路间角度_2, B=2)
tan = Tangent(Value=division)
sin = Sine(Value=division)
division_2 = Division(A=转弯半径, B=tan)
cir = Circle(Plane=路相交点_2, Radius=division_2)
division_3 = Division(A=转弯半径, B=sin)
ccx = CurveCurve(CurveA=cir, CurveB=[路0_2, 路1_2])  # -> graft(Points), ParamsA, ParamsB
pt = Point(flatten(ccx.Points))
pline = PolyLine(Vertices=pt, Closed=False)
curvepoint = PointOnCurve(pline, parameter=0.5)
vec2pt = Vector2Pt(PointA=路相交点_2, PointB=curvepoint, Unitize=False)  # -> Vector, Length
bang = ExplodeTree(Data=ccx.Points)  # -> Branch0, Branch1
line = LineSDL(Start=路相交点_2, Direction=vec2pt.Vector, Length=division_3)
end = EndPoints(Curve=line)  # -> Start, End
cir_2 = Circle(Plane=end.End, Radius=转弯半径)
ccx_2 = CurveCurve(CurveA=cir_2, CurveB=line)  # -> Points, ParamsA, ParamsB
arc = Arc3Pt(PointA=bang.Branch0, PointB=ccx_2.Points, PointC=bang.Branch1)  # -> Arc, Plane, Radius
crv = Curve(arc.Arc)
crv_2 = ClusterOutput(crv)

# ==== cluster Cluster_2
路0 = ClusterInput()
路1 = ClusterInput()
路相交点 = ClusterInput()
路间角度 = ClusterInput()
转弯半径 = ClusterInput()
路0_2 = Curve(路0)
路1_2 = Curve(路1)
路相交点_2 = Point(路相交点)
路间角度_2 = Number(路间角度)
division = Division(A=路间角度_2, B=2)
tan = Tangent(Value=division)
sin = Sine(Value=division)
division_2 = Division(A=转弯半径, B=tan)
cir = Circle(Plane=路相交点_2, Radius=division_2)
division_3 = Division(A=转弯半径, B=sin)
ccx = CurveCurve(CurveA=cir, CurveB=[路0_2, 路1_2])  # -> graft(Points), ParamsA, ParamsB
pt = Point(flatten(ccx.Points))
pline = PolyLine(Vertices=pt, Closed=False)
curvepoint = PointOnCurve(pline, parameter=0.5)
vec2pt = Vector2Pt(PointA=路相交点_2, PointB=curvepoint, Unitize=False)  # -> Vector, Length
bang = ExplodeTree(Data=ccx.Points)  # -> _0000, _0001
line = LineSDL(Start=路相交点_2, Direction=vec2pt.Vector, Length=division_3)
end = EndPoints(Curve=line)  # -> Start, End
cir_2 = Circle(Plane=end.End, Radius=转弯半径)
ccx_2 = CurveCurve(CurveA=cir_2, CurveB=line)  # -> Points, ParamsA, ParamsB
arc = Arc3Pt(PointA=bang._0000, PointB=ccx_2.Points, PointC=bang._0001)  # -> Arc, Plane, Radius
crv = Curve(arc.Arc)
crv_2 = ClusterOutput(crv)
