# Grasshopper definition 20170925_高程点建立网格地形.gh (Grasshopper 1.0.7)

panel = Panel("""输入地形的等高线
整理数据形成地形""")
panel_2 = Panel(""" 输入：高程点
加以网架""")
rec = Rectangle({Plane=PlaneXY(40550429.75, 3392653.82, 0), Size=Domain2(u=-4005.489411..4005.489411, v=-2929.941328..2929.941328)})
id = Guid([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])

# ---- group: 平面等高线
crv = Curve([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])

# ----
curve = Curve(crv)

# ---- group: 建立网架 / 地形建立范围
rec_2 = Rectangle({Plane=PlaneXY(-336541.6643, 236496.9104, 0), Size=Domain2(u=0..189386.8867, v=0..151478.7803)})

# ---- group: 建立网架
精度 = Slider(5000, range=1000..10000)
rec_3 = Rectangle(rec_2)
boundary = BoundarySurfaces(Edges=rec_3)
dim = Dimensions(Surface=rec_3)  # -> UDimension, VDimension
integer_division = IntegerDivision(A=dim.VDimension, B=精度)
integer_division_2 = IntegerDivision(A=dim.UDimension, B=精度)
sdivide = DivideSurface(Surface=boundary, UCount=integer_division_2, VCount=integer_division)  # -> Points, Normals, Parameters

# ----
hhhhhh = Hhhhhh(rec=rec, x=id, num=Slider(6.809, range=0..20))
id_2 = Guid([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])
list_length = ListLength(List=curve)
vb = VBScript(x=id_2)  # -> out, A, B; inputs x: list of Guid
# ---------- vb: VB usings ----------
Imports System.IO
Imports System.Linq
Imports System.Data
Imports System.Drawing
Imports System.Reflection
Imports System.Windows.Forms
Imports System.Xml
Imports System.Xml.Linq
Imports Microsoft.VisualBasic
Imports System.Runtime.InteropServices

Imports Rhino.DocObjects
Imports Rhino.Collections
Imports GH_IO
Imports GH_IO.Serialization
# ---------- vb: VB ----------
    Dim obj As Rhino.DocObjects.TextObject
    obj = Rhino.RhinoDoc.ActiveDoc.Objects.Find(x)
    A = obj.DisplayText
    B = obj.Geometry.GetBoundingBox(false).Center
# ---------- end vb ----------
series = Series(Start=0, Step=Slider(2500, range=0..10000), Count=list_length)
mesh = Mesh(hhhhhh)
Z = UnitZ(Factor=vb.A)
pt = Point(vb.B)
unit_z = UnitZ(Factor=series)
surface_t_f_mesh = BooleanToggle(False)
simplify_vertex_num = BooleanToggle(True)
U = Slider(100, range=0..5000)
move = Move(Geometry=pt, Motion=Z)  # -> Geometry, Transform
point = Point(flatten(Tree({0;0;0}: [Point(-336541.6643, 261743.3738, 511.0363819), Point(-336541.6643, 266792.6664, 1198.217096), Point(-336541.6643, 271841.9591, 1885.397811), Point(-336541.6643, 276891.2518, 2764.026837), Point(-336541.6643, 281940.5445, 5200.829062), Point(-336541.6643, 286989.8372, 7119.142629)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], {0;0;1}: [Point(-331423.0998, 261743.3738, 631.7589276), Point(-331423.0998, 266792.6664, 1289.371235), Point(-331423.0998, 271841.9591, 1966.749133), Point(-331423.0998, 276891.2518, 3058.656821), Point(-331423.0998, 281940.5445, 5404.074253), Point(-331423.0998, 286989.8372, 7249.347068)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], {0;0;2}: [Point(-326304.5353, 256694.0811, 114.2509328), Point(-326304.5353, 261743.3738, 771.2813197), Point(-326304.5353, 266792.6664, 1428.344891), Point(-326304.5353, 271841.9591, 2085.408462), Point(-326304.5353, 276891.2518, 3409.653187), Point(-326304.5353, 281940.5445, 5626.958824)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], {0;0;3}: [Point(-321185.9708, 256694.0811, 275.3080269), Point(-321185.9708, 261743.3738, 932.2822151), Point(-321185.9708, 266792.6664, 1589.256403), Point(-321185.9708, 271841.9591, 2246.314885), Point(-321185.9708, 276891.2518, 3976.328466), Point(-321185.9708, 281940.5445, 5972.511458)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], {0;0;4}: [Point(-316067.4063, 256694.0811, 490.2021117), Point(-316067.4063, 261743.3738, 1147.123639), Point(-316067.4063, 266792.6664, 1801.210769), Point(-316067.4063, 271841.9591, 2455.297899), Point(-316067.4063, 276891.2518, 4695.259332), Point(-316067.4063, 281940.5445, 6392.80159)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], {0;0;5}: [Point(-310948.8418, 256694.0811, 698.7008103), Point(-310948.8418, 261743.3738, 1418.190866), Point(-310948.8418, 266792.6664, 2114.368626), Point(-310948.8418, 271841.9591, 3401.700091), Point(-310948.8418, 276891.2518, 5439.657152), Point(-310948.8418, 281940.5445, 6934.523313)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]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)))  # disabled
del = DelaunayMesh(Points=move.Geometry, Plane=PlaneXY(0, 0, 0))
move_2 = Move(Geometry=curve, Motion=unit_z)  # -> Geometry, Transform

# ---- group: 简单网格化 / 等高线
crv_2 = Curve(move_2.Geometry)

# ---- group: 简单网格化
divdist = DivideDistance(Curve=crv_2, Distance=Slider(10000, range=8000..16001))  # -> flatten(Points), Tangents, Parameters
del_2 = DelaunayMesh(Points=divdist.Points, Plane=PlaneXY(0, 0, 0))

# ---- group: 给网架赋值建立地形
mesh_2 = Mesh(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)
Z_2 = UnitZ(Factor=1)
project = ProjectPoint(Point=sdivide.Points, Direction=Z_2, Geometry=mesh_2)  # -> Point, Index
intcrv = Interpolate(Vertices=project.Point, Degree=3, Periodic=False, KnotStyle=0)  # -> flatten(Curve), Length, Domain
loft = Loft(Curves=intcrv.Curve, Options={Adjust=False, Closed=False, LoftEnds=0, LoftSimp=0, LoftType=0, Rebuild=10, Refit=0.01})

# ----
topography = Topography(points=point, surface_t_f_mesh=surface_t_f_mesh, simplify_vertex_num=simplify_vertex_num, U=U)  # -> output_geometry_2, height_2
point_2 = Point(Tree({0;0;0}: [Point(-336541.6643, 261743.3738, 511.0363819), Point(-336541.6643, 266792.6664, 1198.217096), Point(-336541.6643, 271841.9591, 1885.397811), Point(-336541.6643, 276891.2518, 2764.026837), Point(-336541.6643, 281940.5445, 5200.829062), Point(-336541.6643, 286989.8372, 7119.142629)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], {0;0;1}: [Point(-331423.0998, 261743.3738, 631.7589276), Point(-331423.0998, 266792.6664, 1289.371235), Point(-331423.0998, 271841.9591, 1966.749133), Point(-331423.0998, 276891.2518, 3058.656821), Point(-331423.0998, 281940.5445, 5404.074253), Point(-331423.0998, 286989.8372, 7249.347068)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], {0;0;2}: [Point(-326304.5353, 256694.0811, 114.2509328), Point(-326304.5353, 261743.3738, 771.2813197), Point(-326304.5353, 266792.6664, 1428.344891), Point(-326304.5353, 271841.9591, 2085.408462), Point(-326304.5353, 276891.2518, 3409.653187), Point(-326304.5353, 281940.5445, 5626.958824)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], {0;0;3}: [Point(-321185.9708, 256694.0811, 275.3080269), Point(-321185.9708, 261743.3738, 932.2822151), Point(-321185.9708, 266792.6664, 1589.256403), Point(-321185.9708, 271841.9591, 2246.314885), Point(-321185.9708, 276891.2518, 3976.328466), Point(-321185.9708, 281940.5445, 5972.511458)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], {0;0;4}: [Point(-316067.4063, 256694.0811, 490.2021117), Point(-316067.4063, 261743.3738, 1147.123639), Point(-316067.4063, 266792.6664, 1801.210769), Point(-316067.4063, 271841.9591, 2455.297899), Point(-316067.4063, 276891.2518, 4695.259332), Point(-316067.4063, 281940.5445, 6392.80159)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], {0;0;5}: [Point(-310948.8418, 256694.0811, 698.7008103), Point(-310948.8418, 261743.3738, 1418.190866), Point(-310948.8418, 266792.6664, 2114.368626), Point(-310948.8418, 271841.9591, 3401.700091), Point(-310948.8418, 276891.2518, 5439.657152), Point(-310948.8418, 281940.5445, 6934.523313)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]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))
总高 = Panel(topography.height_2)

# ---- group: 结果
output_geometry = Geometry(topography.output_geometry_2)

# ----
surface = Surface(loft)

# ---- group: 网格化
number_slider = Slider(3862, range=1000..10000)
dim_2 = Dimensions(Surface=rec_3)  # -> UDimension, VDimension
integer_division_3 = IntegerDivision(A=dim_2.UDimension, B=number_slider)
integer_division_4 = IntegerDivision(A=dim_2.VDimension, B=number_slider)
mesh_uv = MeshSurface(Surface=loft, UCount=integer_division_3, VCount=integer_division_4, Overhang=True, Equalize=False)
mesh_3 = Mesh(mesh_uv)
demesh = DeconstructMesh(Mesh=mesh_uv)  # -> Vertices, Faces, Colours, Normals

# ---- group: 高程可视化
pdecon = Deconstruct(Point=project.Point)  # -> XComponent, YComponent, ZComponent
bnd = Bounds(Numbers=pdecon.ZComponent)
dedomain = DeconstructDomain(Domain=bnd)  # -> Start, End
gradient = Gradient(
    LowerLimit=dedomain.Start,
    UpperLimit=dedomain.End,
    Parameter=pdecon.ZComponent,
    stops=[0: RGB(234, 38, 0), 0.25: RGB(234, 126, 0), 0.5: RGB(254, 244, 84), 0.75: RGB(173, 203, 249), 1: RGB(75, 107, 169)])
mspray = MeshSpray(Mesh=mesh_3, Points=project.Point, Colours=gradient, SprayMode=11)

# ==== cluster Topography: Make topography
points = ClusterInput()
surface_t_f_mesh = ClusterInput()
simplify_vertex_num = ClusterInput()
U = ClusterInput()
delaunay_mesh = DelaunayMesh(Points=points, Plane=PlaneXY(0, 0, 0))
surface_t_f_mesh_2 = Boolean(surface_t_f_mesh)
simplify_vertex_num_2 = Boolean(simplify_vertex_num)
U_2 = Integer(U)
bounding_box = BoundingBox(Content=delaunay_mesh, Plane=PlaneXY(0, 0, 0))  # -> Box, Box_2
deconstruct_brep = DeconstructBrep(Brep=bounding_box.Box)  # -> Faces, Edges, Vertices
list_item = ListItem(List=deconstruct_brep.Faces, Index=4, Wrap=True)
number_slider = Slider(1.05, range=0..10)
area = Area(Geometry=list_item)  # -> Area, Centroid
explode = Explode(Curve=list_item, Recursive=True)  # -> Segments, Vertices
multiplication = Multiplication(A=Slider(1000, range=0..1000), B=Slider(1000, range=0..1000))
length = Length(Curve=explode.Segments)
U_3 = Integer(U_2)
scale_nu = ScaleNU(Geometry=list_item, Plane=area.Centroid, ScaleX=number_slider, ScaleY=number_slider, ScaleZ=1)  # -> Geometry, Transform
unit_z = UnitZ(Factor=multiplication)
list_item_2 = ListItem(List=length, Index=0, Wrap=True)  # -> Item, Item1
settings_speed = SettingsSpeed()
division = Division(A=list_item_2.Item, B=list_item_2.Item1)
mesh_brep = MeshBrep(Brep=scale_nu.Geometry, Settings=settings_speed)
move = Move(Geometry=list_item, Motion=unit_z)  # -> Geometry, Transform
reverse = Reverse(Vector=unit_z)
mesh_join = MeshJoin(Meshes=flatten([delaunay_mesh, mesh_brep]))
U_4 = Integer(U_3)
multiplication_2 = Multiplication(A=U_4, B=division)
V = Integer(multiplication_2)
divide_surface = DivideSurface(Surface=move.Geometry, UCount=U_4, VCount=V)  # -> Points, Normals, Parameters
addition = Addition(A=U_4, B=1)
point = Point(flatten(divide_surface.Points))
mesh_ray = MeshRay(Mesh=mesh_join, Point=point, Direction=reverse)  # -> flatten(Point), Hit
area_2 = Area(Geometry=list_item)  # -> Area, Centroid
volume = Volume(Geometry=bounding_box.Box)  # -> Volume, Centroid
point_2 = Point(mesh_ray.Point)
boolean = Boolean(surface_t_f_mesh_2)
division_2 = Division(A=volume.Volume, B=area_2.Area)  # -> flatten(Result)
stream_gate = StreamGate(Stream=point_2, Gate=boolean)  # -> Target0, Target1
point_3 = Point(stream_gate.Target1)
总高 = Panel(division_2)
boolean_2 = Boolean(simplify_vertex_num_2)
point_4 = Point(stream_gate.Target0)
height = Number(总高)
stream_gate_2 = StreamGate(Stream=point_4, Gate=boolean_2)  # -> Target0, Target1
height_2 = ClusterOutput(height)
point_5 = Point(stream_gate_2.Target0)
point_6 = Point(stream_gate_2.Target1)
list_length = ListLength(List=point_6)
list_length_2 = ListLength(List=point_5)
division_3 = Division(A=list_length_2, B=addition)
series = Series(Start=0, Step=1, Count=list_length)
division_4 = Division(A=list_length, B=addition)
partition_list = PartitionList(List=series, Size=division_4)  # -> simplify(Chunks)
partition_list_2 = PartitionList(List=point_5, Size=division_3)  # -> simplify(Chunks)
relative_item = RelativeItem(Tree=partition_list_2, Offset="{1}(-1)", WrapPaths=False, WrapItems=False)  # -> ItemA, ItemB
relative_item_2 = RelativeItem(Tree=partition_list, Offset="{1}(-1)", WrapPaths=False, WrapItems=False)  # -> ItemA, ItemB
relative_item_3 = RelativeItem(Tree=partition_list, Offset="{1}(1)", WrapPaths=False, WrapItems=False)  # -> ItemA, ItemB
relative_item_4 = RelativeItem(Tree=partition_list_2, Offset="{1}(1)", WrapPaths=False, WrapItems=False)  # -> ItemA, ItemB
integer = Integer(relative_item_2.ItemB)
integer_2 = Integer(relative_item_3.ItemA)
point_7 = Point(relative_item_4.ItemA)
point_8 = Point(relative_item.ItemB)
integer_3 = Integer(relative_item_3.ItemB)
integer_4 = Integer(relative_item_2.ItemA)
point_9 = Point(relative_item.ItemA)
point_10 = Point(relative_item_4.ItemB)
merge = Merge(Data1=graft(integer), Data2=graft(integer_3), Data3=graft(integer_4), Data4=graft(integer_2))
merge_2 = Merge(Data1=graft(point_8), Data2=graft(point_10), Data3=graft(point_9), Data4=graft(point_7))
text_join = TextJoin(Text=merge, Join=";")
construct_mesh = ConstructMesh(Vertices=merge_2, Faces={A=0, B=1, C=2, D=3})  # -> flatten(Mesh)
concatenate = Concatenate(FragmentA="Q{", FragmentB=text_join, FragmentC="}")  # -> flatten(Result)
point_11 = Point(point_6)
mesh_join_2 = MeshJoin(Meshes=construct_mesh)
construct_mesh_2 = ConstructMesh(Vertices=point_11, Faces=concatenate)
boolean_3 = Boolean(boolean_2)
surface_from_points = SurfaceFromPoints(Points=point_3, UCount=addition, Interpolate=False)
stream_filter = StreamFilter(Gate=boolean_3, Stream0=mesh_join_2, Stream1=construct_mesh_2)
mesh = Mesh(stream_filter)
boolean_4 = Boolean(boolean)
surface = Surface(surface_from_points)
stream_filter_2 = StreamFilter(Gate=boolean_4, Stream0=mesh, Stream1=surface)
output_geometry = Geometry(stream_filter_2)
output_geometry_2 = ClusterOutput(output_geometry)

# ==== cluster Hhhhhh
rec = ClusterInput()
rec_2 = Rectangle(rec)
x = ClusterInput()
vb = VBScript(x=x)  # -> out, A, B
# ---------- vb: VB ----------
    Dim obj As Rhino.DocObjects.TextObject
    obj = Rhino.RhinoDoc.ActiveDoc.Objects.Find(x)
    A = obj.DisplayText
    B = obj.Geometry.GetBoundingBox(false).Center
# ---------- end vb ----------
number_slider = Slider(20, range=0..100)
Z = UnitZ(Factor=vb.A)
boundary = BoundarySurfaces(Edges=rec_2)
dim = Dimensions(Surface=rec_2)  # -> UDimension, VDimension
pt = Point(vb.B)
move = Move(Geometry=pt, Motion=Z)  # -> Geometry, Transform
integer_division = IntegerDivision(A=dim.VDimension, B=number_slider)
integer_division_2 = IntegerDivision(A=dim.UDimension, B=number_slider)
sdivide = DivideSurface(Surface=boundary, UCount=integer_division_2, VCount=integer_division)  # -> Points, Normals, Parameters
Z_2 = UnitZ(Factor=1)
del = DelaunayMesh(Points=move.Geometry, Plane=PlaneXY(0, 0, 0))
project = ProjectPoint(Point=sdivide.Points, Direction=Z_2, Geometry=del)  # -> Point, Index
intcrv = Interpolate(Vertices=project.Point, Degree=3, Periodic=False, KnotStyle=0)  # -> flatten(Curve), Length, Domain
clean = CleanTree(RemoveNulls=True, RemoveInvalid=True, RemoveEmpty=False, Tree=intcrv.Curve)
loft = Loft(Curves=clean, Options={Adjust=False, Closed=False, LoftEnds=0, LoftSimp=0, LoftType=0, Rebuild=10, Refit=0.01})
num = ClusterInput()
num_2 = Number(num)
dim_2 = Dimensions(Surface=rec_2)  # -> UDimension, VDimension
integer_division_3 = IntegerDivision(A=dim_2.UDimension, B=num_2)
integer_division_4 = IntegerDivision(A=dim_2.VDimension, B=num_2)
mesh_uv = MeshSurface(Surface=loft, UCount=integer_division_3, VCount=integer_division_4, Overhang=True, Equalize=False)
M = ClusterOutput(mesh_uv)
