# Grasshopper definition 20200114_案例地形.gh (Grasshopper 1.0.7)

number_slider = Slider(20, range=0..100)

# ---- group: 建立网架 / 地形建立范围
rec = Rectangle({Plane=PlaneXY(497.0662129, 502.3160005, 0), Size=Domain2(u=-467.1517807..467.1517807, v=-482.015701..482.015701)})

# ---- group: 建立网架
精度 = Slider(1000, range=1000..10000)
rec_2 = Rectangle(rec)
boundary = BoundarySurfaces(Edges=rec_2)
dim = Dimensions(Surface=rec_2)  # -> UDimension, VDimension
integer_division = IntegerDivision(A=dim.VDimension, B=number_slider)
integer_division_2 = IntegerDivision(A=dim.UDimension, B=number_slider)
sdivide = DivideSurface(Surface=boundary, UCount=integer_division_2, VCount=integer_division)  # -> Points, Normals, Parameters

# ----
mesh = Mesh(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)

# ---- group: 给网架赋值建立地形
mesh_2 = Mesh(mesh)
Z = UnitZ(Factor=1)
project = ProjectPoint(Point=sdivide.Points, Direction=Z, Geometry=mesh_2)  # -> Point, Index
intcrv = Interpolate(Vertices=project.Point, Degree=3, Periodic=False, KnotStyle=0)  # -> flatten(Curve), Length, Domain
loft = Loft(Curves=intcrv.Curve, Options={Adjust=False, Closed=False, LoftEnds=0, LoftSimp=0, LoftType=0, Rebuild=10, Refit=0.01})

# ----
pt = Point(flatten(project.Point))
pdecon = Deconstruct(Point=pt)  # -> XComponent, YComponent, ZComponent
merge = Merge(Data1=graft(pdecon.XComponent), Data2=graft(pdecon.YComponent), Data3=graft(pdecon.ZComponent))
srf = Surface(loft)
join = TextJoin(Text=merge, Join=",")  # -> flatten(Result)
python = GhPythonScript(dzb=join)  # -> out, a; inputs dzb: list
# ---------- python: Python ----------
__author__ = "billpower"
__version__ = "2020.01.14"

import rhinoscriptsyntax as rs

print(dzb[0])

output = open('E:\地形数据.txt','w')
for i in range(len(dzb)):
    output.write(dzb[i])
    output.write('\n')
output.close()


#data=open("D:\data.txt",'a') 
#print(dzb[0],file=data)
#data.close()
# ---------- end python ----------
panel = Panel(join)
