# Grasshopper definition Self-Organizing of Basic Behaviors_Yufan Xie.gh (Grasshopper 1.0.4)
# plug-ins: Heteroptera, Anemone

death_radius = Slider(10, range=0..1000)
number_slider = Slider(248, range=0..2000)
button = Button()
pt = Point([Point(18, -6, 0), Point(18, -46, 0), Point(18, -81, 0), Point(77, -81, 0), Point(77, 28, 0), Point(77, 86, 0)])
loop_start = LoopStart(Repeat=number_slider, Trigger=button, Data=flatten(pt))  # -> port, Counter, Data
xy = XYPlane(Origin=Point(0, 0, 0))
cullpt = CullDuplicates(Points=loop_start.Data, Tolerance=death_radius, CullMode=3)  # -> Points, Indices, Valence
search_radius = Slider(200, range=0..1000)
project = Project(Geometry=cullpt.Points, Plane=xy)  # -> Geometry, Transform
data = Data(project.Geometry)
voronoi = Voronoi(Points=data, Radius=search_radius, BruteForceOverride=False)
area = Area(Geometry=voronoi)  # -> Area, Centroid
bnd = Bounds(Numbers=area.Area)
remap = RemapNumbers(Value=area.Area, Source=bnd, Target=Domain(0, 1))  # -> Mapped, Clipped
bnd_2 = Bounds(Numbers=remap.Mapped)
remap_2 = RemapNumbers(Value=remap.Mapped, Source=bnd_2, Target=Domain(0, 1))  # -> Mapped, Clipped
num = Number(Slider(300, range=0..1000))
smaller = SmallerThan(FirstNumber=Slider(0.9, range=0..1), SecondNumber=remap_2.Mapped)  # -> SmallerThan, OrEqualTo
cull = CullPattern(List=data, CullPattern=smaller.SmallerThan)
smaller_2 = SmallerThan(FirstNumber=remap_2.Mapped, SecondNumber=Slider(0.235, range=0..1))  # -> SmallerThan, OrEqualTo
emitter = PointEmitter(Emitter=cull, Radius=num, Number=1, Tendency=0.25)
merge = Merge(Data1=data, Data2=emitter)  # -> flatten(Result)
cull_2 = CullPattern(List=data, CullPattern=smaller_2.SmallerThan)
pcharge = PointCharge(Point=cull_2, Charge=Slider(1000, range=0..10000), Decay=Slider(1.2, range=0..2))
pcharge_2 = PointCharge(Point=cull, Charge=Slider(-10000, range=-100000..100000), Decay=Slider(1, range=0..2))
data_2 = Data(merge)
merge_2 = Merge(Data1=pcharge, Data2=pcharge_2)
mergef = MergeFields(Fields=flatten(merge_2))
evf = EvaluateField(Field=mergef, Point=data_2)  # -> Tensor, Strength
neg = Negative(Value=num)
multiplication = Multiplication(A=evf.Tensor, B=Slider(1, range=0..100))
dom = ConstructDomain(DomainStart=neg, DomainEnd=num)
vlen = VectorLength(Vector=multiplication)
boundary = NumberLimiter(Number=vlen, Domain=dom, LimitationMode=3)
amp = Amplitude(Vector=multiplication, Amplitude=boundary)
multiplication_2 = Multiplication(A=amp, B=remap.Mapped)
move = Move(Geometry=data_2, Motion=multiplication_2)  # -> Geometry, Transform
running = Running(port=loop_start.port, Exit=False, Data=move.Geometry, pausedState=False, state="Constant output", TimeOutVal=0)
pt_2 = Point(Point(461500, -92300, 0))
filter = StreamFilter(Gate=button, Stream0=number_slider, Stream1=0)  # disabled
group = Group(Objects=running)  # disabled
yz = YZPlane(Origin=pt_2)
capacitor = Capacitor(Data=group, Capacity=filter)  # disabled
orient = Orient(Geometry=running, Source=PlaneXY(0, 0, 0), Target=yz)  # -> Geometry, Transform
scale = Scale(Geometry=orient.Geometry, Center=pt_2, Factor=Slider(1000, range=0..1000))  # -> Geometry, Transform
