# Grasshopper definition kangaroo-F.gh (Grasshopper 0.9.76)
# plug-ins: Kangaroo Components

pt = Point([Point(187, -115, 0), Point(283, -115, 0)])
pt_2 = Point([Point(144, 39, 0), Point(425, 39, 0)])
Y = UnitY(Factor=Slider(67, range=0..100))
ln = Line(StartPoint=pt, EndPoint=pt_2)
move = Move(Geometry=pt, Motion=Y)  # -> Geometry, Transform
end = EndPoints(Curve=ln)  # -> Start, End
end_2 = EndPoints(Curve=graft(ln))  # -> Start, End
panel = Panel("强制两条线平行")
align = Align(
    Align1=end.Start,
    Align2=end.End,
    Align3=end_2.Start,
    Align4=end_2.End,
    AlignStrength=100,
    Exponent=Slider(1, range=0..10),
    Cutoff=100,
    AngleRange=0)
bend = Bend(Point1=move.Geometry, Point2=pt_2, Point3=pt, BendStrength=Slider(38, range=0..100), RestAngle=0)
panel_2 = Panel(end_2.End)
kangaroo = KangarooPhysics(ForceObjects=flatten([align, bend]), AnchorPoints=pt, Settings=null, Geometry=ln, SimulationReset=Toggle(False))  # -> Out, Iterations, ParticlesOut, GeometryOut
end_3 = EndPoints(Curve=kangaroo.GeometryOut)  # -> Start, End
vdis = VectorDisplay(Anchor=end_3.Start, Vector=kangaroo.GeometryOut)
panel_3 = Panel(end_3.Start)
