# Grasshopper definition kangaroo-k.gh (Grasshopper 0.9.76)
# plug-ins: Kangaroo Components

# ---- group: 时间循环
timer = Timer(TimerInterval=20, Target=counter)  # disabled
counter = Counter(Reset=Toggle(False))
mod = Modulus(A=counter, B=Slider(200, range=0..1100))

# ----
panel = Panel("使数值在0-200一直重复")
panel_2 = Panel("To公差，点与点的最小距离/数值")
panel_3 = Panel("Ti每次迭代的时间间隔/数值")
panel_4 = Panel("S每次模拟结果显示的迭代次数/数值")
panel_5 = Panel("F设置Floor地面的开关/布尔")
panel_6 = Panel("D粘性阻力，限制粒子运动/数值")
panel_7 = Panel("R粒子之间及与地面弹性碰撞恢复系数/数值")
panel_8 = Panel("S粒子与地面的静摩擦系数/数值")
panel_9 = Panel("K粒子与地面的动摩擦系数/数值")
panel_10 = Panel("Se粒子与地面的动摩擦系数/数值")
panel_11 = Panel("T使粒子停止跳动的临界速度/数值")
panel_12 = Panel("Sound音响效果开关/布尔")
panel_13 = Panel("Solver算法选择")
timer_2 = Timer(TimerInterval=20, Target=counter_3)  # disabled
timer_3 = Timer(TimerInterval=1000, Target=[counter_2, panel_14])  # disabled
toggle = BooleanToggle(True)  # disabled
anchorspring = AnchorSpring(Strength=500, Sticky=1000)
counter_2 = Counter(Reset=Toggle(True))
timer_4 = Timer(TimerInterval=100, Target=counter_4)  # disabled
number_slider = Slider(10, range=0..10)  # disabled
anchorxyz = AnchorXYZ(ConstrainX=True, ConstrainY=True, ConstrainZ=True)
kangaroo = KangarooPhysics(Settings=null, SimulationReset=True)  # -> Out, Iterations, ParticlesOut, GeometryOut
counter_3 = Counter(Reset=Toggle(False))
panel_14 = Panel("1")
counter_4 = Counter(Reset=toggle)  # disabled
panel_15 = Panel("用一个弹簧作用力把点固定在起始位置")
panel_16 = Panel("在xyz轴方向上约束粒子")
panel_17 = Panel(counter_2)
mod_2 = Modulus(A=counter_3, B=Slider(200, range=0..1100))
rec = DataRecorder(panel_14, DataLimit=-10, RecordData=False)
kangaroo_settings = KangarooSettings(
    Tolerance=0.001,
    TimeStep=0.01,
    SubIterations=10,
    Floor=False,
    Drag=1,
    Restitution=0.7,
    StaticFriction=10,
    KineticFriction=10,
    Settle=2,
    Tumble=1,
    Sound=False,
    Solver=0)
panel_18 = Panel("正弦函数")
panel_19 = Panel("生成一个时间变量")
panel_20 = Panel("布尔循环")
wave = Wave(T=counter_4, Frequency=0.1, Amplitude=number_slider, PhaseShift=0, BaseLine=2)
sequence = Sequence(Frames=mod_2)
ma = MassAddition(Input=rec)  # -> Result, PartialResults
particle = Particle(Mass=1, Velocity=Vector(0, 0, 0))
rec_2 = DataRecorder(counter_4, DataLimit=-10, RecordData=True)  # disabled
rec_3 = DataRecorder(wave, DataLimit=-10, RecordData=True)  # disabled
pt = ConstructPoint(XCoordinate=rec_2, YCoordinate=rec_3, ZCoordinate=0)  # disabled
timer_5 = Timer(TimerInterval=20, Target=counter_5)  # disabled
pt_2 = ConstructPoint(XCoordinate=0, YCoordinate=0, ZCoordinate=0)
counter_5 = Counter(Reset=Toggle(True))
Z = UnitZ(Factor=Slider(8, range=0..10))
mod_3 = Modulus(A=counter_5, B=Slider(16, range=0..1100))
particle_2 = Particle(Point=pt_2, Mass=Slider(7, range=0..10), Velocity=Z)
sequence_2 = Sequence(Frames=mod_3)
button = Button()
kangaroo_2 = KangarooPhysics(ForceObjects=particle_2, Settings=null, SimulationReset=sequence_2)  # -> Out, Iterations, ParticlesOut, GeometryOut
