# Grasshopper definition py_text.gh (Grasshopper 1.0.7)

panel = Panel("""first
sacend
third""")
panel_2 = Panel("""first
sacend
third""")
timer = Timer(TimerInterval=1000, Target=python)
timer_2 = Timer(TimerInterval=1000, Target=python_2)
python = GhPythonScript(texts=reverse(panel), Toggle=Toggle(False), x=Slider(67, range=0..100))  # inputs texts: list
# ---------- python: Python ----------
__author__ = "billpower"
__version__ = "2018.08.02"

import rhinoscriptsyntax as rs
import Rhino as rc
import random as rnd

if "display" not in globals():
    display = rc.Display.CustomDisplay(True)

display.Clear()

if Toggle == False:
    display.Dispose
    del display

if Toggle == True:
    for i in xrange(len(texts)):
        point3d = rc.Geometry.Point3d(0,x*i*2,0)
        vec = rc.Geometry.Vector3d(0,0,10)
        plane = rc.Geometry.Plane(point3d,vec)
        color = rc.Display.ColorHSL(rnd.random(),1.0,0.5)
        display.AddText(texts[i],plane,x,color)
# ---------- end python ----------
python_2 = GhPythonScript(texts=reverse(panel_2), Toggle=Toggle(False), x=Slider(67, range=0..100))  # inputs texts: list
# ---------- python_2: Python ----------
__author__ = "billpower"
__version__ = "2018.08.02"

import rhinoscriptsyntax as rs
import Rhino as rc
import random as rnd

if "display" not in globals():
    display = rc.Display.CustomDisplay(True)

display.Clear()

if Toggle == False:
    display.Dispose()
    del display

if Toggle == True:
    for i in xrange(len(texts)):
        point3d = rc.Geometry.Point3d(0,x*i*2,0)
        vec = rc.Geometry.Vector3d(0,0,10)
        plane = rc.Geometry.Plane(point3d,vec)#矢量和点生成面
        color = rc.Display.ColorHSL(rnd.random(),1.0,0.5)
        display.AddText(texts[i],plane,x,color)
# ---------- end python_2 ----------
