# Grasshopper definition py_序列.gh (Grasshopper 1.0.7)

crv = Curve(reparameterize(<curve referenced from the Rhino model>))
pt = Point()
eval = EvaluateCurve(Curve=crv, Parameter=Slider(1, range=0..1))  # -> Point, Tangent, Angle
python = GhPythonScript(x=Button(), y=eval.Point)  # -> out, a; inputs y: Point3d
# ---------- python: Python ----------
__author__ = "billpower"
__version__ = "2018.08.23"

import rhinoscriptsyntax as rs
import Rhino as r
import System as s
#导入必要的模块
doc = r.RhinoDoc.ActiveDoc
#当前在rhino中激活的文件
views = doc.Views
#当前在rhino中的视图

if x == True:
    rect = s.Drawing.Rectangle(100,50,400,300)
    if not views.Find("zz",False):
        views.Add("zz",r.Display.DefinedViewportProjection.Perspective,rect,True)
        
view = views.Find("zz",False)
vp = view.ActiveViewport
vp.SetCameraLocations(r.Geometry.Point3d(0,0,0),y)
# ---------- end python ----------
