# Grasshopper definition Wallacei X_Example File.gh (Grasshopper 1.0.7)
# plug-ins: Wallacei

wlc_1 = Slider(91, range=90..100)
wlc_2 = GenePool(Decimals=2, Maximum=0.95, Minimum=0.7, Value=[0.95, 0.95, 0.95, 0.95, 0.95, 0.95, 0.95, 0.95, 0.95])
wlc_3 = GenePool(Decimals=2, Maximum=0.8, Minimum=0.4, Value=[0.4, 0.8, 0.8, 0.4, 0.8, 0.8, 0.4, 0.4, 0.8])
wlc_4 = GenePool(Decimals=0, Maximum=10, Minimum=0, Value=[1, 9, 0, 6, 1, 9, 2, 0, 10, 6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])

number_slider = Slider(3, range=0..10)
sqgrid = Square(Plane=PlaneXY(0, 0, 0), Size=wlc_1, ExtentX=number_slider, ExtentY=number_slider)  # -> flatten(Cells), Points
panel = Panel("0.9")
area = Area(Geometry=sqgrid.Cells)  # -> Area, Centroid
scale = Scale(Geometry=sqgrid.Cells, Center=area.Centroid, Factor=wlc_2)  # -> Geometry, Transform
area_2 = Area(Geometry=scale.Geometry)  # -> Area, Centroid
scale_2 = Scale(Geometry=scale.Geometry, Center=area_2.Centroid, Factor=wlc_3)  # -> Geometry, Transform
explode = Explode(Curve=scale.Geometry, Recursive=True)  # -> Segments, Vertices
explode_2 = Explode(Curve=scale_2.Geometry, Recursive=True)  # -> Segments, Vertices
divide = DivideCurve(Curve=explode_2.Segments, Count="4", Kinks=False)  # -> Points, Tangents, Parameters
crv_cp = CurveClosestPoint(Point=divide.Points, Curve=graft(explode.Segments))  # -> Point, Parameter, Distance
disc = Discontinuity(Curve=scale.Geometry, Level=1)  # -> Points, Parameters
disc_2 = Discontinuity(Curve=scale_2.Geometry, Level=1)  # -> Points, Parameters
ln = Line(StartPoint=crv_cp.Point, EndPoint=divide.Points)
rec_2pt = Rectangle2Pt(Plane=PlaneXY(0, 0, 0), PointA=disc.Points, PointB=disc_2.Points, Radius=0)  # -> simplify(Rectangle), Length
shift = ShiftList(List=ln, Shift=1, Wrap=False)
boundary = BoundarySurfaces(Edges=rec_2pt.Rectangle)
edgesrf = EdgeSurface(CurveA=ln, CurveB=shift)  # -> simplify(Surface)
cull_i = CullIndex(List=reverse(edgesrf), Indices=0, Wrap=True)  # -> reverse(List)
trim = TrimTree(Tree=cull_i, Depth=2)
merge = Merge(Data1=simplify(trim), Data2=simplify(boundary))  # -> flatten(Result)
panel_2 = Panel("高度=层数*层高")
area_3 = Area(Geometry=merge)  # -> Area, Centroid
multiplication = Multiplication(A=wlc_4, B="3.5")
equals = Equality(FirstNumber=multiplication, SecondNumber="0")  # -> Equality, Inequality
multiplication_2 = Multiplication(A=area_3.Area, B=multiplication)
panel_3 = Panel("体积=底面积*高")
panel_4 = Panel("提取层数为0的面")
dispatch = Dispatch(List=flatten(merge), DispatchPattern=equals.Equality)  # -> ListA, ListB
dispatch_2 = Dispatch(List=flatten(multiplication_2), DispatchPattern=equals.Equality)  # -> ListA, ListB
ma = MassAddition(Input=flatten(dispatch_2.ListB))  # -> Result, PartialResults
brep = Brep(dispatch.ListA)
panel_5 = Panel("总差值=整体变化的幅度，在加个倒数就是最大值")
area_4 = Area(Geometry=[scale_2.Geometry, brep])  # -> Area, Centroid

# ---- group: 相邻数值的差值
reldif = RelativeDifferences(Values=wlc_4)

# ----
abs = Absolute(Value=reldif)
ma_2 = MassAddition(Input=abs)  # -> Result, PartialResults
one_over_x = OneOverX(Value=ma_2.Result)

# ---- group: 无高度地面总面积
ma_3 = MassAddition(Input=flatten(area_4.Area))  # -> Result, PartialResults

# ---- group: 总体积
int = Integer(ma.Result)

# ----
ma_4 = MassAddition(Input=area_3.Area)  # -> Result, PartialResults
total_ground_floor_area = Number(ma_4.Result)

# ---- group: Enable after you run the evolutionary simulation
Z = UnitZ(Factor=multiplication)
extr = Extrude(Base=merge, Direction=Z)
phenotype = Geometry(extr)
mesh = Mesh(extr)
entwine = Entwine(Branch00=mesh, Branch01=total_ground_floor_area, FlattenInputs=True)  # -> simplify(Result)

# ----
wlc_maximise_differences_between_heights = Number(one_over_x)
wlc_minimise_courtayrd_area = Number(ma_3.Result)
wlc_minimise_volume = Number(int)
panel_6 = Panel("计算参考值，目的是将参考值找到最大/最小解")
panel_7 = Panel("希望由每一个解得出的值——不参与计算")
panel_8 = Panel("同上且会自动区分数据类型——不参与计算")
panel_9 = Panel("输入数据，基本纯数据值")
wallacei_x = WallaceiX(
    Genes=[wlc_1, wlc_2, wlc_3, wlc_4],
    Objectives=[wlc_maximise_differences_between_heights, wlc_minimise_courtayrd_area, wlc_minimise_volume],
    Data=total_ground_floor_area,
    Phenotype=entwine,
    allFitness="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",
    allFrontIdx="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",
    allGenomes="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",
    curFrontIdx="99|0;99|1;99|2;99|3;99|4;99|5;99|6;99|7;99|8;99|9;99|10;99|11;99|12;99|13;99|14;99|15;99|16;99|17;99|18;99|19;99|20;99|21;99|22;99|23;99|24;99|25;99|26;99|27;99|28;99|29",
    curFrontIdxSave="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",
    popGen="30,100",
    total="557750",
    wlcDone=True)  # -> WallaceiGenomes, FitnessValues, Data, WPhenotypes
panel_10 = Panel("每一个解的对应Gene值")
panel_11 = Panel("每一个解的对应的判断参考值")
pdecoder = DecodePhenotype(WallaceiPhenotype=wallacei_x.WPhenotypes)  # -> GeometriesList, MeshesList, NumbersList, TextList
gdecoder = DecodeGenome(WallaceiGenome=wallacei_x.WallaceiGenomes)  # -> simplify(GeneList)
tstat = TreeStatistics(Tree=wallacei_x.WPhenotypes)  # -> Paths, Length, Count
mesh_2 = Mesh(pdecoder.MeshesList)
trim_2 = TrimTree(Tree=pdecoder.NumbersList, Depth=1)
branch = TreeBranch(Tree=gdecoder, Path=tstat.Paths, MaintainPaths=True)
branch_2 = TreeBranch(Tree=wallacei_x.FitnessValues, Path=tstat.Paths, MaintainPaths=True)
branch_3 = TreeBranch(Tree=trim_2, Path=tstat.Paths, MaintainPaths=True)
viewer = ParamViewer(tstat.Paths)
data = Data(tstat.Paths)

rec = Rectangle(sqgrid.Cells)
debox = DeconstructBox(Box=rec)  # -> Plane, X, Y, Z
dedomain = DeconstructDomain(Domain=debox.X)  # -> Start, End
data_2 = Data(branch_2)
data_3 = Data(branch_3)
dpath = DeconstructPath(Branch=data)
lng = ListLength(List=data)
sort = SortList(Keys=dedomain.End)  # -> reverse(Keys), ValuesA
item = ListItem(List=data_2, Index=0, Wrap=True)  # -> Item, Item1, Item2
item_2 = ListItem(List=dpath, Index=0, Wrap=True)  # -> Item, Item1
series = Series(Start=0, Step=1, Count=lng)
item_3 = ListItem(List=sort.Keys, Index=0, Wrap=True)
division = Division(A=item_3, B=5)
int_2 = Integer(data_3)
concat = Concatenate(FragmentA="volume:", FragmentB=item.Item2, FragmentC=" | area:", FragmentD=int_2)
concat_2 = Concatenate(FragmentA="Gen.", FragmentB=item_2.Item, FragmentC=" | Ind.", FragmentD=item_2.Item1)
addition = Addition(A=item_3, B=division)
Y = UnitY(Factor=Slider(33, range=0..100))

sqrt = SquareRoot(Value=lng)
int_3 = Integer(sqrt)

sqgrid_2 = Square(Plane=PlaneXY(0, 0, 0), Size=addition, ExtentX=int_3, ExtentY=int_3)  # -> flatten(Cells), Points
item_4 = ListItem(List=sqgrid_2.Cells, Index=series, Wrap=True)  # -> flatten(Item)
explode_3 = Explode(Curve=item_4, Recursive=True)  # -> Segments, Vertices
area_5 = Area(Geometry=item_4)  # -> Area, graft(Centroid)
item_5 = ListItem(List=explode_3.Segments, Index=0, Wrap=True)
midpt = CurveMiddle(Curve=item_5)
move = Move(Geometry=midpt, Motion=Y)  # -> Geometry, Transform
tag = TextTag3D(Location=move.Geometry, Text=concat_2, Size=Slider(13, range=0..100), Justification=2)
tag_2 = TextTag3D(Location=midpt, Text=concat, Size=Slider(8, range=0..100), Justification=8)

debox_2 = DeconstructBox(Box=mesh_2)  # -> Plane, X, Y, Z
dedomain_2 = DeconstructDomain(Domain=debox_2.X)  # -> Start, End
dedomain_3 = DeconstructDomain(Domain=debox_2.Y)  # -> Start, End
bnd = Bounds(Numbers=[dedomain_2.Start, dedomain_2.End])
bnd_2 = Bounds(Numbers=[dedomain_3.Start, dedomain_3.End])
rectangle = Rectangle(Plane=PlaneXY(0, 0, 0), XSize=bnd, YSize=bnd_2, Radius=0)  # -> Rectangle, Length
area_6 = Area(Geometry=rectangle.Rectangle)  # -> Area, Centroid
vec2pt = Vector2Pt(PointA=area_6.Centroid, PointB=area_5.Centroid, Unitize=False)  # -> Vector, Length
move_2 = Move(Geometry=mesh_2, Motion=vec2pt.Vector)  # -> Geometry, Transform

panel_14 = Panel(int_3)
