# Grasshopper definition Wallacei X_Kangaroo1_ExampleFile.gh (Grasshopper 1.0.7)
# plug-ins: Kangaroo Components, Weaverbird, Wallacei

wlc_3 = GenePool(Decimals=0, Maximum=342, Minimum=0, Value=[48.27813203, 47.034109])
wlc_1 = GenePool(Decimals=2, Maximum=4, Minimum=0, Value=[0.9094141075, 0.09800462804, 3.312020446, 0.5206089815])
wlc_2 = GenePool(Decimals=2, Maximum=10, Minimum=6, Value=[6.8511012, 6.11112513, 9.367452868, 6.472492375])
wlc_4 = GenePool(Decimals=2, Maximum=5000, Minimum=0, Value=[911.6188314, 173.1646455, 4354.052676, 464.9808074])
shuffler = GenePoolAndSliderShuffler(BooleanButton=Button())
item = ListItem(List=wlc_1, Index=0, Wrap=True)  # -> Item, Item1, Item2, Item3
item_2 = ListItem(List=wlc_2, Index=0, Wrap=True)  # -> Item, Item1, Item2, Item3
subtraction = Subtraction(A=item.Item3, B="10")
subtraction_2 = Subtraction(A=item_2.Item3, B="10")
abs = Absolute(Value=subtraction)
abs_2 = Absolute(Value=subtraction_2)
pt = ConstructPoint(XCoordinate=item.Item, YCoordinate=item.Item1, ZCoordinate=0)
pt_2 = ConstructPoint(XCoordinate=item.Item2, YCoordinate=abs, ZCoordinate=0)
pt_3 = ConstructPoint(XCoordinate=item_2.Item, YCoordinate=item_2.Item1, ZCoordinate=0)
pt_4 = ConstructPoint(XCoordinate=item_2.Item2, YCoordinate=abs_2, ZCoordinate=0)
merge = Merge(Data1=flatten(pt), Data2=flatten(pt_2), Data3=flatten(pt_3), Data4=flatten(pt_4))
pline = PolyLine(Vertices=merge, Closed=True)
boundary = BoundarySurfaces(Edges=pline)
custom_mesh_settings = SettingsCustom(
    StitchSeams=True,
    SimplePlanes=False,
    Refine=True,
    MinCount=Slider(300, range=0..500),
    MaxCount=400,
    AspectRatio=20,
    MaxDistance=0,
    MaxAngle=20,
    MinEdge=0,
    MaxEdge=0)
mesh = MeshBrep(Brep=boundary, Settings=custom_mesh_settings)
demesh = DeconstructMesh(Mesh=mesh)  # -> Vertices, Faces, Colours, Normals
pt_5 = Point(demesh.Vertices)
corners = Corners(mesh=mesh)
pt_6 = Point(corners)
item_3 = ListItem(List=wlc_3, Index=0, Wrap=True)  # -> Item, Item1
item_4 = ListItem(List=pt_5, Index=item_3.Item, Wrap=True)
item_5 = ListItem(List=pt_5, Index=item_3.Item1, Wrap=True)
wbedges = WeaverbirdsMeshEdges(MeshOrPolylines=mesh)
pt_7 = Point([item_4, item_5])

# ---- group: Kangaroo 1_Forces and Zombie Solver
Z = UnitZ(Factor=Slider(0.367, range=0..5))
springsfrommesh = SpringsFromMesh(M=mesh, stiffness=1000, B=1)
anchorspring = AnchorSpring(Point=pt_6, Strength=wlc_4, Sticky=1000)
uforce = UnaryForce(Point=pt_5, Force=Z)
zombie = ZombieKangaroo(
    ForceObjects=[uforce, springsfrommesh, anchorspring],
    AnchorPoints=pt_7,
    Settings=null,
    Geometry=mesh,
    Threshold=0.1,
    MaxIters=Slider(750, range=0..1000))  # -> Out, Iterations, ParticlesOut, GeometryOut, KE

# ----
dom = ConstructDomain(DomainStart=Slider(0, range=0..100), DomainEnd=Slider(10, range=0..100))
dom_2 = ConstructDomain(DomainStart=Slider(0, range=0..100), DomainEnd=Slider(10, range=0..100))
rectangle = Rectangle(Plane=PlaneXY(0, 0, 0), XSize=dom, YSize=dom_2, Radius=0)  # -> Rectangle, Length
wbfacepolys = WeaverbirdsFacePolylines(Mesh=zombie.GeometryOut)
mplane = MeshPlane(Boundary=rectangle.Rectangle, WidthCount=Slider(50, range=0..100), HeightCount=Slider(50, range=0..100))  # -> Mesh, Area
demesh_2 = DeconstructMesh(Mesh=mplane.Mesh)  # -> Vertices, Faces, Colours, Normals
sun_vector = Line(Line((65, -45, 11), (53, -30, 0)))
pt_8 = Point(demesh_2.Vertices)
end = EndPoints(Curve=sun_vector)  # -> Start, End
vec2pt = Vector2Pt(PointA=end.Start, PointB=end.End, Unitize=False)  # -> Vector, Length
occ = Occlusion(Samples=pt_8, Obstructions=zombie.GeometryOut, Rays=vec2pt.Vector)  # -> Hits, Occlusion
gradient = Gradient(LowerLimit=0, UpperLimit=1, Parameter=occ.Hits, stops=[0: RGB(255, 255, 255), 1: RGB(0, 0, 0)])

# ---- group: Equalize the lenght of the mesh lines
explode = Explode(Curve=wbfacepolys, Recursive=True)  # -> Segments, Vertices
len = Length(Curve=flatten(explode.Segments))
clean = CleanTree(RemoveNulls=True, RemoveInvalid=True, RemoveEmpty=False, Tree=len)
reldif = RelativeDifferences(Values=clean)
abs_3 = Absolute(Value=reldif)
ma = MassAddition(Input=abs_3)  # -> Result, PartialResults
wlc_eq = Number(flatten(ma.Result))

# ---- group: Maximizing the shadow on the ground
ma_2 = MassAddition(Input=occ.Hits)  # -> Result, PartialResults
one_over_x = OneOverX(Value=ma_2.Result)
wlc_max_shadow = Number(flatten(one_over_x))

# ---- group: Maintain the footprint area between 0.3 to 0.8 squnit
# Maintain the footprint area between 0.3 to 0.8 sq unit area
area = Area(Geometry=pline)  # -> Area, Centroid
area_2 = Area(Geometry=rectangle.Rectangle)  # -> Area, Centroid
division = Division(A=area.Area, B=area_2.Area)
subtraction_3 = Subtraction(A=division, B="0.3")
subtraction_4 = Subtraction(A=division, B="0.8")
abs_4 = Absolute(Value=subtraction_3)
abs_5 = Absolute(Value=subtraction_4)
addition = Addition(A=abs_4, B=abs_5)
wlc_footprint = Number(flatten(addition))

# ---- group: Maintain the distance between the points of contact to the ground
dist = Distance(PointA=item_4, PointB=item_5)
subtraction_5 = Subtraction(A=dist, B="3")
wlc_dist = Number(flatten(subtraction_5))

# ---- group: Keep the the points of contact to the ground away from the corners
pt_9 = Point(item_4)
pt_10 = Point(item_5)
dist_2 = Distance(PointA=pt_9, PointB=pt_6)
dist_3 = Distance(PointA=pt_10, PointB=pt_6)
ma_3 = MassAddition(Input=dist_2)  # -> Result, PartialResults
ma_4 = MassAddition(Input=dist_3)  # -> Result, PartialResults
addition_2 = Addition(A=ma_3.Result, B=ma_4.Result)
one_over_x_2 = OneOverX(Value=addition_2)
wlc_away = Number(flatten(one_over_x_2))

# ----
mesh_2 = Geometry(zombie.GeometryOut)
lines = Geometry(wbfacepolys)
phenotype = Geometry([mesh_2, lines])
preview = CustomPreview(Geometry=wbfacepolys, Material=ColourSwatch(SwatchColor=RGB(0, 0, 0)))
preview_2 = CustomPreview(Geometry=pt_8, Shader=gradient)
preview_3 = CustomPreview(Geometry=zombie.GeometryOut, Shader=ColourSwatch(SwatchColor=RGB(255, 69, 156)))
wallacei_x = WallaceiX(
    Genes=[wlc_1, wlc_2, wlc_3, wlc_4],
    Objectives=[wlc_away, wlc_dist, wlc_eq, wlc_footprint, wlc_max_shadow],
    popGen="-1,-1",
    total="0",
    wlcDone=False)  # -> WallaceiGenomes, FitnessValues, Data, WPhenotypes

# ==== cluster SpringsFromMesh: Turns all edges of a mesh into springs
M = ClusterInput()
medges = MeshEdges(Mesh=M)  # -> NakedEdges, InteriorEdges, NonManifoldEdges
crv = Curve([medges.NakedEdges, medges.InteriorEdges])
B = ClusterInput()
len = Length(Curve=crv)
multiplication = Multiplication(A=len, B=B)
stiffness = ClusterInput()
springs = SpringsFromLine(Connection=crv, Stiffness=stiffness, Damping=10, RestLength=multiplication, UpperCutoff=0, LowerCutoff=0, Plasticity=0)
S = ClusterOutput(springs)

# ==== cluster Corners: Find the boundary corner points of a quad mesh
mesh = ClusterInput()
mesh_2 = Mesh(mesh)
nv = NakedVertices(Mesh=mesh_2)  # -> ClothedIndex, NakedIndex, ClothedPts, NakedPts
vn = VertexNeighbours(Mesh=mesh_2, VertexNumber=nv.NakedIndex)  # -> graft(Vertex), Neighbours, Normal
lng = ListLength(List=vn.Neighbours)
equals = Equality(FirstNumber=lng, SecondNumber=3)  # -> Equality, Inequality
cull = CullPattern(List=vn.Vertex, CullPattern=equals.Inequality)
pshift = ShiftPaths(Data=cull, Offset=-1)
D = ClusterOutput(pshift)
