# Grasshopper definition Wallacei X_Example File.gh (Grasshopper 1.0.7)
# plug-ins: Wallacei

wlc_2 = GenePool(Decimals=2, Maximum=0.95, Minimum=0.7, Value=[0.74, 0.72, 0.7, 0.71, 0.76, 0.7, 0.7, 0.71, 0.72])
wlc_3 = GenePool(Decimals=2, Maximum=0.8, Minimum=0.4, Value=[0.53, 0.42, 0.5, 0.45, 0.42, 0.45, 0.54, 0.58, 0.49])
wlc_4 = GenePool(Decimals=0, Maximum=10, Minimum=0, Value=[2, 1, 9, 4, 9, 0, 6, 4, 8, 6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])
wlc_1 = Slider(90, range=90..100)

number_slider = Slider(3, range=0..10)
sqgrid = Square(Plane=PlaneXY(0, 0, 0), Size=wlc_1, ExtentX=number_slider, ExtentY=number_slider)  # -> flatten(Cells), Points
area = Area(Geometry=sqgrid.Cells)  # -> Area, Centroid
panel = Panel("0.9")
scale = Scale(Geometry=sqgrid.Cells, Center=area.Centroid, Factor=wlc_2)  # -> Geometry, Transform
area_2 = Area(Geometry=scale.Geometry)  # -> Area, Centroid
scale_2 = Scale(Geometry=scale.Geometry, Center=area_2.Centroid, Factor=wlc_3)  # -> Geometry, Transform
explode = Explode(Curve=scale_2.Geometry, Recursive=True)  # -> Segments, Vertices
explode_2 = Explode(Curve=scale.Geometry, Recursive=True)  # -> Segments, Vertices
divide = DivideCurve(Curve=explode.Segments, Count="4", Kinks=False)  # -> Points, Tangents, Parameters
crv_cp = CurveClosestPoint(Point=divide.Points, Curve=graft(explode_2.Segments))  # -> Point, Parameter, Distance
disc = Discontinuity(Curve=scale.Geometry, Level=1)  # -> Points, Parameters
disc_2 = Discontinuity(Curve=scale_2.Geometry, Level=1)  # -> Points, Parameters
ln = Line(StartPoint=crv_cp.Point, EndPoint=divide.Points)
shift = ShiftList(List=ln, Shift=1, Wrap=False)
edgesrf = EdgeSurface(CurveA=ln, CurveB=shift)  # -> simplify(Surface)
rec_2pt = Rectangle2Pt(Plane=PlaneXY(0, 0, 0), PointA=disc.Points, PointB=disc_2.Points, Radius=0)  # -> simplify(Rectangle), Length
cull_i = CullIndex(List=reverse(edgesrf), Indices=0, Wrap=True)  # -> reverse(List)
trim = TrimTree(Tree=cull_i, Depth=2)
boundary = BoundarySurfaces(Edges=rec_2pt.Rectangle)
merge = Merge(Data1=simplify(trim), Data2=simplify(boundary))  # -> flatten(Result)
area_3 = Area(Geometry=merge)  # -> Area, Centroid
reldif = RelativeDifferences(Values=wlc_4)
abs = Absolute(Value=reldif)
ma = MassAddition(Input=abs)  # -> Result, PartialResults
one_over_x = OneOverX(Value=ma.Result)

multiplication = Multiplication(A=wlc_4, B="3.5")
multiplication_2 = Multiplication(A=area_3.Area, B=multiplication)

equals = Equality(FirstNumber=multiplication, SecondNumber="0")  # -> Equality, Inequality
dispatch = Dispatch(List=flatten(multiplication_2), DispatchPattern=equals.Equality)  # -> ListA, ListB
dispatch_2 = Dispatch(List=flatten(merge), DispatchPattern=equals.Equality)  # -> ListA, ListB
brep = Brep(dispatch_2.ListA)
ma_2 = MassAddition(Input=flatten(dispatch.ListB))  # -> Result, PartialResults
area_4 = Area(Geometry=[scale_2.Geometry, brep])  # -> Area, Centroid
int = Integer(ma_2.Result)
ma_3 = MassAddition(Input=flatten(area_4.Area))  # -> Result, PartialResults

# ---- group: Enable after you run the evolutionary simulation
Z = UnitZ(Factor=multiplication)  # disabled
extr = Extrude(Base=merge, Direction=Z)  # disabled
phenotype = Geometry(extr)  # disabled
mesh = Mesh(extr)  # disabled
entwine = Entwine(Branch00=phenotype, Branch01=mesh, FlattenInputs=True)  # -> simplify(flatten(Result)); disabled

# ----
ma_4 = MassAddition(Input=area_3.Area)  # -> Result, PartialResults
total_ground_floor_area = Number(ma_4.Result)

wlc_maximise_differences_between_heights = Number(one_over_x)
wlc_minimise_courtayrd_area = Number(ma_3.Result)
wlc_minimise_volume = Number(int)
wallacei_x = WallaceiX(
    Genes=[wlc_1, wlc_2, wlc_3, wlc_4],
    Objectives=[wlc_maximise_differences_between_heights, wlc_minimise_courtayrd_area, wlc_minimise_volume],
    Data=total_ground_floor_area,
    Phenotype=mesh,
    allFitness="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",
    allFrontIdx="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",
    allGenomes="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",
    curFrontIdx="99|0;99|1;99|2;99|3;99|4;99|5;99|6;99|7;99|8;99|9;99|10;99|11;99|12;99|13;99|14;99|15;99|16;99|17;99|18;99|19;99|20;99|21;99|22;99|23;99|24;99|25;99|26;99|27;99|28;99|29;99|30;99|31;99|32;99|33;99|34;99|35;99|36;99|37;99|38;99|39;99|40;99|41;99|42;99|43;99|44;99|45;99|46;99|47;99|48;99|49",
    curFrontIdxSave="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",
    popGen="50,100",
    total="497719",
    wlcDone=True)  # -> WallaceiGenomes, FitnessValues, Data, WPhenotypes
