# Grasshopper definition Wallacei X_Karamba_ExampleFile.gh (Grasshopper 1.0.7)
# plug-ins: MeshEdit Components, Wallacei, karambaGH

number_slider = Slider(5, range=0..10)
wlc = GenePool(
    Decimals=2,
    Maximum=0.8,
    Minimum=-0.8,
    Value=[0.26, 0.66, 0.05, -0.51, -0.15, -0.7, -0.12, 0.23, 0.33, -0.34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])
wlc_2 = GenePool(Decimals=1, Maximum=5, Minimum=2, Value=[3.4, 2.5, 4.3, 4, 2.6, 4.4, 3.5, 4, 3.9, 3.6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])
wlc_3 = GenePool(
    Decimals=2,
    Maximum=0.8,
    Minimum=-0.8,
    Value=[-0.01, 0.76, 0.59, 0.1, 0.77, -0.49, -0.27, -0.65, -0.28, -0.38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])
sqgrid = Square(Plane=PlaneXY(0, 0, 0), Size=Slider(2, range=0..100), ExtentX=number_slider, ExtentY=number_slider)  # -> Cells, Points
vec = VectorXYZ(XComponent=wlc_3, YComponent=wlc, ZComponent=wlc_2)  # -> Vector, Length
unflatten = UnflattenTree(Tree=vec.Vector, Guide=sqgrid.Points)
move = Move(Geometry=sqgrid.Points, Motion=unflatten)  # -> Geometry, Transform
flip = FlipMatrix(Data=move.Geometry)
pline = PolyLine(Vertices=move.Geometry, Closed=False)
pline_2 = PolyLine(Vertices=flip, Closed=False)
ln = Line(StartPoint=sqgrid.Points, EndPoint=move.Geometry)
explode = Explode(Curve=reverse([pline, pline_2]), Recursive=True)  # -> Segments, Vertices
frompoints = MeshFromPoints(Points=flatten(move.Geometry), UDirection=expr("x+1", number_slider), VDirection=expr("x+1", number_slider))
posts = Geometry(flatten(ln))
beams = Geometry(flatten(explode.Segments))
triangulate = MeshTriangulate(Mesh=frompoints, ShortDiagonal=True)
explode_2 = MeshExplode(Mesh=triangulate, Interpolate=False)
medges = MeshEdges(Mesh=explode_2)  # -> NakedEdges, InteriorEdges, NonManifoldEdges
boundary = BoundarySurfaces(Edges=medges.NakedEdges)

# ---- group: Karamba Analysis
linetobeam = LineToBeamKaramba3D(Line=posts, Identifier="Post", New=True, Remove=True, LimitDistance_m=0.005)  # -> Element, Points, Info
linetobeam_2 = LineToBeamKaramba3D(Line=beams, Identifier="Beam", New=True, Remove=True, LimitDistance_m=0.005)  # -> Element, Points, Info
wlc_4 = Slider(6.12, range=5..10)
wlc_5 = Slider(8.36, range=5..10)
wlc_6 = Slider(17, range=12..18)
cross_section = CrossSectionKaramba3D(
    FamilyNameOfCrossSection="DefaultCroSec",
    ElementIdentifier=[linetobeam.Element, linetobeam_2.Element],
    Height_cm=wlc_6,
    UpperFlangeWidth_cm=wlc_4,
    LowerFlangeWidth_cm=wlc_5,
    mode="Trapezoid")
matselect = MaterialSelectionKaramba3D(ElementIdentifier=["Post", "Beam"], menu=[dropdown(1), dropdown(1)])
Z = UnitZ(Factor=expr("-x", Slider(100, range=0..1000)))
loads = LoadsKaramba3D(Vector=Z, BeamIdentifiers="Beam", LCase=0, mode="Uniform Line", menu=[buttons(on, off, off)])
loads_2 = LoadsKaramba3D(Vector=Vector(0, 0, -1), LCase=0, mode="Gravity")
support_points = Point(flatten(sqgrid.Points))
supp = SupportKaramba3D(PosInd=support_points, menu=[buttons(on, on, on, on, on, on)])
crosec = CrossSectionKaramba3D(flatten(cross_section))
load = LoadKaramba3D(flatten([loads, loads_2]))
element = ElementKaramba3D(flatten([linetobeam.Element, linetobeam_2.Element]))
support = SupportKaramba3D(flatten(supp))
material = MaterialKaramba3D(flatten(matselect))
assemble = AssembleModelKaramba3D(Elem=element, Support=support, Load=load, CrossSection=crosec, Material=material, LimitDistance_m=0.005)  # -> Model, Info, Mass_kg, CenterOfGravity
analyze = AnalyzeKaramba3D(Model=assemble.Model)  # -> CalculatedModel, MaximumDisplacement_cm, ResultingForceOfGravity_kN, ElasticEnergy_kNm
beamview = BeamViewKaramba3D(Model=analyze.CalculatedModel)  # -> Model, MeshesOfRenderedBeams, DeformedBeamAxes, LegendColors, LegendTags

# ----
area = Area(Geometry=flatten(boundary))  # -> Area, Centroid
pdecon = Deconstruct(Point=area.Centroid)  # -> XComponent, YComponent, ZComponent
ma = MassAddition(Input=area.Area)  # -> Result, PartialResults
reldif = RelativeDifferences(Values=pdecon.ZComponent)
abs = Absolute(Value=reldif)
ma_2 = MassAddition(Input=abs)  # -> Result, PartialResults
one_over_x = OneOverX(Value=ma_2.Result)
mesh = Mesh(flatten(boundary))
wlc_maximise_height_variation_of_panels = Number(one_over_x)
wlc_minimise_structural_displacement = Number(analyze.MaximumDisplacement_cm)
wlc_minimise_area_of_roof_panels = Number(ma.Result)
entwine = Entwine(Branch00=flatten(mesh), Branch01=beamview.MeshesOfRenderedBeams, FlattenInputs=True)
phenotype = Geometry(entwine)

wallacei_x = WallaceiX(
    Genes=[wlc_6, wlc_4, wlc_5, wlc_3, wlc, wlc_2],
    Objectives=[wlc_maximise_height_variation_of_panels, wlc_minimise_area_of_roof_panels, wlc_minimise_structural_displacement],
    Phenotype=phenotype,
    allFitness="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",
    allFrontIdx="10|15;12|15;13|12;13|13;13|15;14|12;14|14;14|16;14|17;14|19;15|5;15|13;16|0;16|8;16|11;16|12;16|13;16|17;17|11;17|17;18|0;18|1;18|9;18|13;18|15;18|16;18|18;18|19;19|0;19|4;19|9;19|11;19|17",
    allGenomes="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",
    curFrontIdx="19|0;19|1;19|2;19|3;19|4;19|5;19|6;19|7;19|8;19|9;19|10;19|11;19|12;19|13;19|14;19|15;19|16;19|17;19|18;19|19",
    curFrontIdxSave="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",
    popGen="20,20",
    total="43250",
    wlcDone=True)  # -> WallaceiGenomes, FitnessValues, Data, WPhenotypes
shuffler = GenePoolAndSliderShuffler(BooleanButton=Button())
