# Grasshopper definition Wallacei X_Ladybug_ExampleFile.gh (Grasshopper 1.0.7)
# plug-ins: Wallacei

ladybug = Ladybug_Ladybug()  # -> Vviiiiiiiiiizzz; plug-in component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
panel = Panel("http://climate.onebuilding.org/WMO_Region_6_Europe/GBR_United_Kingdom/ENG_England/GBR_ENG_London-Biggin.Hill.AP.037663_TMYx.2003-2017.zip")
epw_stat = Ladybug_OpenEPWAndSTATWeatherFiles(weatherFileURL=panel)  # -> epwFile, statFile; plug-in component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

# ---- group: INPUT PATH TO EPW FILE HERE
path = FilePath()

# ----
gencumulativeskymtx = Ladybug_GenCumulativeSkyMtx(epwFile=epw_stat.epwFile, skyDensity=0, useOldRes=True, runIt=Toggle(True))  # -> readMe, cumulativeSkyMtx; plug-in component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
analysisperiod = Ladybug_AnalysisPeriod(
    fromMonth=Slider(6, range=0..10),
    fromDay=Slider(21, range=0..100),
    fromHour=Slider(6, range=0..24),
    toMonth=Slider(6, range=0..12),
    toDay=Slider(21, range=0..100),
    toHour=Slider(20, range=0..100))  # -> readMe, analysisPeriod; plug-in component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
importlocation = Ladybug_ImportLocation(epwFile=epw_stat.epwFile)  # -> location; plug-in component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
selectskymtx = Ladybug_selectSkyMtx(
    cumulativeSkyMtx=gencumulativeskymtx.cumulativeSkyMtx,
    analysisPeriod=analysisperiod.analysisPeriod,
    removeDiffuse=False,
    removeDirect=False)  # -> readMe, selectedSkyMtx; plug-in component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
Y = UnitY(Factor=1)
sunpath = Ladybug_SunPath(
    north=Y,
    location=importlocation,
    hour=12,
    day=21,
    month=12,
    timeStep=1,
    analysisPeriod=analysisperiod.analysisPeriod,
    sunPathScale=Slider(0.045, range=0..1),
    sunScale=Slider(1, range=0..1),
    dailyOrAnnualSunPath=True)  # -> readMe, sunVectors, sunAltitudes, sunAzimuths, port, sunSpheresMesh, sunPathCrvs, compassCrvs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; plug-in component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

number_slider = Slider(2, range=0..10)
sqgrid = Square(Plane=PlaneXY(0, 0, 0), Size=Slider(100, range=0..100), ExtentX=number_slider, ExtentY=number_slider)  # -> Cells, Points
area = Area(Geometry=flatten(sqgrid.Cells))  # -> Area, Centroid
wlc_genes = GenePool(Decimals=2, Maximum=0.8, Minimum=0.2, Value=[0.31, 0.68, 0.37, 0.29])
avr = Average(Input=area.Centroid)
wlc_genes_2 = GenePool(Decimals=2, Maximum=0.8, Minimum=0.2, Value=[0.61, 0.35, 0.25, 0.75])
boundary = BoundarySurfaces(Edges=flatten(sqgrid.Cells))
polar = ToPolar(Point=area.Centroid, System=avr)  # -> Phi, Theta, Radius
pt = ConstructPoint(XCoordinate=wlc_genes_2, YCoordinate=wlc_genes, ZCoordinate=0)
sort = SortList(Keys=polar.Phi, ValuesA=boundary)  # -> Keys, ValuesA
evalsrf = EvaluateSurface(Surface=reparameterize(sort.ValuesA), Point=pt)  # -> Point, Normal, UDirection, VDirection, Frame
runion = RegionUnion(Curves=flatten(sqgrid.Cells))
pline = PolyLine(Vertices=evalsrf.Point, Closed=True)
disc = Discontinuity(Curve=runion, Level=1)  # -> Points, Parameters
wlc_genes_3 = GenePool(Decimals=2, Maximum=0.75, Minimum=0.25, Value=[0.67, 0.41, 0.69, 0.34])
pline_2 = PolyLine(Vertices=disc.Points, Closed=True)
explode = Explode(Curve=pline_2, Recursive=True)  # -> Segments, Vertices
fillet = Fillet(Curve=pline, Radius=Slider(7, range=0..100))
eval = EvaluateCurve(Curve=reparameterize(explode.Segments), Parameter=wlc_genes_3)  # -> Point, Tangent, Angle
boundary_2 = BoundarySurfaces(Edges=fillet)
ln = Line(StartPoint=eval.Point, EndPoint=avr)
wlc_genes_4 = GenePool(Decimals=0, Maximum=70, Minimum=20, Value=[36, 31, 27, 30])
srfsplit = SurfaceSplit(Surface=boundary_2, Curves=ln)
multiplication = Multiplication(A=wlc_genes_4, B="3.5")
shuffler = GenePoolAndSliderShuffler(BooleanButton=Button())
Z = UnitZ(Factor=multiplication)
extr = Extrude(Base=srfsplit, Direction=Z)
mesh = Mesh(extr)
geo = Geometry([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])
volume = Volume(Geometry=geo)  # -> Volume, Centroid
contour = Contour(Shape=mesh, Point=Point(0, 0, 0), Direction=Vector(0, 0, 1), Distance="3.5")  # -> flatten(Contours)
project = Project(Geometry=volume.Centroid, Plane=PlaneXY(0, 0, 0))  # -> Geometry, Transform
area_2 = Area(Geometry=contour)  # -> Area, Centroid
ma = MassAddition(Input=area_2.Area)  # -> Result, PartialResults
srf_cp = SurfaceClosestPoint(Point=graft(project.Geometry), Surface=srfsplit)  # -> Point, UVPoint, Distance
sort_2 = SortList(Keys=srf_cp.Distance, ValuesA=srf_cp.Point)  # -> Keys, ValuesA
item = ListItem(List=sort_2.ValuesA, Index=0, Wrap=True)
ln_2 = Line(StartPoint=project.Geometry, EndPoint=flatten(item))
len = Length(Curve=ln_2)
ma_2 = MassAddition(Input=len)  # -> Result, PartialResults
radiationanalysis = Ladybug_RadiationAnalysis(
    geometry=flatten(extr),
    context=flatten(geo),
    gridSize=Slider(20, range=0..100),
    disFromBase=Slider(1, range=0..1),
    selectedSkyMtx=flatten(selectskymtx.selectedSkyMtx),
    runIt=Toggle(True))  # -> readMe, contextMesh, analysisMesh, testPts, testVec, port, radiationResult, radiationMesh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; plug-in component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

one_over_x = OneOverX(Value=ma.Result)
one_over_x_2 = OneOverX(Value=ma_2.Result)
wlc_minimise_distance_to_surrounding_bui = Number(one_over_x_2)  # "wlc_Minimise Distance to Surrounding Buildings"
wlc_maximise_total_floor_space = Number(one_over_x)
wlc_minimise_total_radiation = Number(radiationanalysis.totalRadiation)
wallacei_x = WallaceiX(
    Genes=[wlc_genes_2, wlc_genes, wlc_genes_3, wlc_genes_4],
    Objectives=[wlc_maximise_total_floor_space, wlc_minimise_total_radiation, wlc_minimise_distance_to_surrounding_bui],
    allFitness="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",
    allFrontIdx="0|0;0|1;0|2;0|4;0|5;0|6;0|8;0|9;0|11;0|12;0|13;0|15;0|17;0|18;1|2;1|6;1|14;1|17;2|1;2|7;2|10;2|12;2|13;2|15;2|16;2|19;3|0;3|1;3|3;3|4;3|7;3|13;3|19;4|1;4|3;4|17;5|3;5|8;5|10;5|16;6|3;6|12;6|14;7|1;7|11;7|12;7|18;7|19;8|4;8|10;8|13;8|14;8|18;8|19;9|9;9|15;9|19;10|1;10|12;10|14;10|15;10|17;11|7;11|10;11|11;11|15;11|16;11|18;12|1;12|8;12|14;12|16;12|17;12|18;13|0;13|1;13|3;13|13;13|19;14|9;14|11;14|17;15|1;15|4;15|9;15|10;15|11;15|12;15|17;16|2;16|3;16|5;16|6;16|10;16|11;16|12;16|14;17|8;17|10;17|13;17|15;17|18;18|4;18|7;18|11;18|16;19|2;19|4;19|5;19|13;19|15;19|17",
    allGenomes="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",
    curFrontIdx="19|0;19|1;19|2;19|3;19|4;19|5;19|6;19|7;19|8;19|9;19|10;19|11;19|12;19|13;19|14;19|15;19|16;19|17;19|18;19|19",
    curFrontIdxSave="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",
    popGen="20,20",
    total="514563",
    wlcDone=True)  # -> WallaceiGenomes, FitnessValues, Data, WPhenotypes
