# Grasshopper definition 20180209.gh (Grasshopper 0.9.76)
# plug-ins: Kangaroo Components

pt = ConstructPoint(XCoordinate=0, YCoordinate=0, ZCoordinate=0)
pt_2 = ConstructPoint(XCoordinate=0, YCoordinate=0, ZCoordinate=0)
pt_3 = Point(pt)
vec = Vector(Vector(65, 0, 150))
pt_4 = Point(pt_2)
anchorspring = AnchorSpring(Point=pt_3, Strength=Slider(3, range=0..3), Sticky=Slider(1546, range=0..10000))
uforce = UnaryForce(Point=pt_3, Force=vec)
button = Button()
uforce_2 = UnaryForce(Point=pt_4, Force=Vector(-25, 0, 140))
button_2 = Button()
anchorxyz = AnchorXYZ(Point=pt_4, ConstrainX=Toggle(True), ConstrainY=Toggle(False), ConstrainZ=Toggle(False))
timer = Timer(TimerInterval=500, Target=kangaroo_2)  # disabled
kangaroo = KangarooPhysics(ForceObjects=[uforce, anchorspring], Settings=null, SimulationReset=Toggle(True))  # -> Out, Iterations, ParticlesOut, GeometryOut
kangaroo_2 = KangarooPhysics(ForceObjects=[uforce_2, anchorxyz], Settings=null, SimulationReset=Toggle(True))  # -> Out, Iterations, ParticlesOut, GeometryOut
pt_5 = Point(kangaroo.ParticlesOut)
rec = DataRecorder(pt_5, DataLimit=-10, RecordData=True)
pt_6 = Point(kangaroo_2.ParticlesOut)
sph = Sphere(Base=pt_6, Radius=1)
intcrv = Interpolate(Vertices=rec, Degree=3, Periodic=False, KnotStyle=1)  # -> Curve, Length, Domain
panel = Panel(rec)
pt_7 = ConstructPoint(XCoordinate=0, YCoordinate=0, ZCoordinate=0)
Z = UnitZ(Factor=Slider(5, range=0..10))
pt_8 = Point(pt_7)
particle = Particle(Point=pt_8, Mass=Slider(10, range=0..10), Velocity=Z)
kangaroo_3 = KangarooPhysics(ForceObjects=particle, Settings=null, SimulationReset=Toggle(False))  # -> Out, Iterations, ParticlesOut, GeometryOut
timer_2 = Timer(TimerInterval=20, Target=kangaroo_3)
pt_9 = Point(kangaroo_3.ParticlesOut)
sph_2 = Sphere(Base=pt_9, Radius=1)
