# Grasshopper definition py_GHbake群组.gh (Grasshopper 0.9.76)
# plug-ins: Python Interpreter

panel = Panel("naruto@n-dda.cn")

visible = BooleanToggle(True)
visible_2 = BooleanToggle(True)
number = Number(1.8)
color = ColourSwatch(SwatchColor=RGB(114, 169, 182))
brep = Brep([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])
sph = Sphere(Base=PlaneXY(0, 0, 0), Radius=expr("x/2", number))
group = Group(Objects=brep)
python = PythonScript(
    obj=brep,
    bake=Button(),
    colorLayer=color,
    layerText="diamantBMB",
    diamondSize=number,
    visible=visible,
    group=visible_2,
    gp_name="筑梦NARUTO")  # -> out, c; inputs obj: list, group: Boolean
# ---------- python: Python ----------
import rhinoscriptsyntax as rs
import Rhino
import scriptcontext as sc
 
a = []
if bake:
    #create layer
    sc.doc = Rhino.RhinoDoc.ActiveDoc
    rs.AddLayer(name= layerText+str(diamondSize)+"mm", color=colorLayer, visible=visible, locked=False, parent=None)
     
    #create rhino object
    sc.doc = ghdoc
    obj_id = obj
    doc_object = [rs.coercerhinoobject(i) for i in obj_id]
    attributes = [i.Attributes for i in doc_object]
    geometry = [i.Geometry for i in doc_object]
     
    #select layer to bake and add to the attributes
    sc.doc = Rhino.RhinoDoc.ActiveDoc
    layertable = sc.doc.Layers
    layerindex = layertable.Find(layerText +str(diamondSize)+"mm",True)
    for i in attributes:
        i.LayerIndex = layerindex
     
    #bake object
    rhino_obj = [sc.doc.Objects.Add(geometry[i], attributes[i]) for i in xrange(len(geometry))]
    #create group
    if group:
        new_a = rs.coerceguidlist(rhino_obj)
        if not gp_name:
            gp_name = "NARUTO"
        else:
            gp_name = gp_name
        c = sc.doc.Groups.GroupNames(True)
        #返回rhino中组的名字
        if not c:
            group_name = rs.AddGroup(gp_name)
            new_c = sc.doc.Groups.GroupNames(True)
        else:
            new_c = c
        if gp_name in new_c:
            group_index = sc.doc.Groups.Find(gp_name,True)
        else:
            group_name = rs.AddGroup(gp_name)
            group_index = sc.doc.Groups.Find(group_name,True)
        [rs.DeleteGroup(i) for i in new_c]
        sc.doc.Groups.AddToGroup(group_index,new_a)
# ---------- end python ----------
panel_2 = Panel(python.c)
