# Grasshopper definition py_curve.gh (Grasshopper 1.0.7)

panel = Panel("这里注意下记得设置右键设置数据结构和数据类型")
crv = Curve(reparameterize(<curve referenced from the Rhino model>))
sph = Sphere(Base=PlaneXY(0, 0, 0), Radius=1)
xy = XYPlane(Origin=Point(0, 0, 0))
pt = Point(Point(70.50042192, 29.56633981, 0))
python = GhPythonScript(x=pt, y=crv)  # -> out, new_curve, len; inputs x: Point3d, y: Line
# ---------- python: Python ----------
__author__ = "billpower"
__version__ = "2018.08.22"

import rhinoscriptsyntax as rs
import Rhino.Geometry

new_curve = y[0].JoinCurves(y)
len = [j.GetLength() for j in a]
# ---------- end python ----------
python_2 = GhPythonScript(x=xy)  # -> out, a
# ---------- python_2: Python ----------
__author__ = "billpower"
__version__ = "2018.08.22"

import rhinoscriptsyntax as rs
print type(x)
# ---------- end python_2 ----------
python_3 = GhPythonScript(x=sph, y=xy, z=Toggle(True))  # -> out, a, b, c, d; inputs x: Brep, y: Plane
# ---------- python_3: Python ----------
__author__ = "billpower"
__version__ = "2018.08.22"

import rhinoscriptsyntax as rs
import ghpythonlib.components as ghc
import ghpythonlib.parallel as gp

a = ghc.BrepXPlane(x,y)
b = a.curves
c,p = a

if z == True:
    gp.run
# ---------- end python_3 ----------
sec = BrepPlane(Brep=sph, Plane=xy)  # -> Curves, Points
panel_2 = Panel(python_2.out)
panel_3 = Panel(python.len)
panel_4 = Panel(python_3.b)
