# Grasshopper definition py_tree.gh (Grasshopper 1.0.7)

python = GhPythonScript()  # -> out, a
# ---------- python: Python ----------
__author__ = "billpower"
__version__ = "2018.08.01"

import rhinoscriptsyntax as rs
import System as s
import Rhino as r

size = s.Drawing.Size(800,600)
doc = r.RhinoDoc.ActiveDoc.Views.ActiveView
bm = doc.CaptureToBitmap(size)

path = "D:/001.jpg"
bm.Save(path)
# ---------- end python ----------
python_2 = GhPythonScript()  # -> out, pts
# ---------- python_2: Python ----------
__author__ = "billpower"
__version__ = "2018.08.01"

import rhinoscriptsyntax as rs
from Grasshopper.Kernel.Data import GH_Path
from Grasshopper import DataTree
from Rhino.Geometry import Point3d
pts = DataTree[Point3d]()
a = []; b = []
for i in range(10):
    if (i%2 == 0):
        a.append(Point3d(i,0,0))
    else:
        b.append(Point3d(0,i,0))
pts.AddRange(a,GH_Path(0))
pts.AddRange(b,GH_Path(0,1))
# ---------- end python_2 ----------
panel = Panel("rhino截图")
panel_2 = Panel(python_2.pts)
