# Grasshopper definition py_【RhinoPython】自定义选择类型.gh (Grasshopper 1.0.7)

python = GhPythonScript()  # -> out, a
# ---------- python: Python ----------
__author__ = "billpower"
__version__ = "2018.08.30"

import rhinoscriptsyntax as rs
import scriptcontext as sc
import Rhino as r

def select_line(rhino_object,geo,geo_index):
    cv = rs.coercecurve(geo)
    return rs.IsLine(cv) and rs.CurveLength(cv)<40

def commond():
    geos = rs.GetObject("选择直线",rs.filter.curve,True,True,custom_filer=select_line)
    color = rs.GetColor(0)
    if feos and color:
        [rs.ObjectColor(i,color)for i in geos]

if__name__=="__main__":
    commond()
# ---------- end python ----------
