# Grasshopper definition py_电池插件.gh (Grasshopper 1.0.7)
# plug-ins: V-Ray For Grasshopper 6

number_slider = Slider(58, range=0..100)
neg = Negative(Value=number_slider)
series = Series(Start=0, Step=Slider(10, range=0..10), Count=10)
dom = ConstructDomain(DomainStart=neg, DomainEnd=number_slider)
pt = ConstructPoint(XCoordinate=0, YCoordinate=0, ZCoordinate=series)
xy = XYPlane(Origin=pt)
division = Division(A=series, B=Slider(110, range=0..110))
prot = RotatePlane(Plane=xy, Angle=division)
rectangle = Rectangle(Plane=prot, XSize=dom, YSize=dom, Radius=0)  # -> flatten(Rectangle), Length
neg_2 = Negative(Value=Slider(5, range=0..10))
offset = OffsetCurve(Curve=rectangle.Rectangle, Distance=neg_2, Plane=PlaneXY(0, 0, 0), Corners=1)  # -> flatten(Curve)
merge = Merge(Data1=graft(rectangle.Rectangle), Data2=graft(offset))
loft = Loft(Curves=merge, Options={Adjust=False, Closed=False, LoftEnds=0, LoftSimp=0, LoftType=0, Rebuild=10, Refit=0.01})  # -> flatten(Loft)
debrep = DeconstructBrep(Brep=loft)  # -> flatten(Faces), Edges, Vertices
cluster = Cluster(sur=debrep.Faces, y=Slider(2, range=0..10))
python = GhPythonScript(sur=debrep.Faces, y=Slider(2, range=0..10))  # -> out, ent; same code as python
brep = Brep(flatten(cluster))

number_slider_2 = Slider(246, range=0..1100)
brep_2 = Brep(flatten(brep))
open_file = Texture(
    "G:\architecture\收集\VFS3.4教程压缩包版\01.【基础篇】\01.【基础篇】\VRAY3.4第1节课：灯光系统\灯光文件夹\HDRI\overcast_sun36deg_0071-03.hdr",
    File_Picker=0,
    File_Types="All Image Files (*.png; *.bmp; *.tga; *.hdr; *.dgi; *.rgb; *.rgba; *.jpg; *.jpeg; *.exr; *.pic; *.tif; *.tiff)|*.png;*.bmp;*.tga;*.hdr;*.dgi;*.rgb;*.rgba;*.jpg;*.jpeg;*.exr;*.pic;*.tif;*.tiff|Portable Network Graphics (*.png)|*.png|Windows bitmap (*.bmp)|*.bmp|Targa Image (*.tga)|*.tga|Radiance High-Dynamyc Range (*.hdr)|*.hdr|Silicon Graphics (*.sgi; *.rgb; *.rgba)|*.dgi;*.rgb;*.rgba|JPEG image (*.jpg; *.jpeg)|*.jpg;*.jpeg|OpenEXR image (*.exr)|*.exr|SoftImage PICT (*.pic)|*.pic|Tagged image (*.tif; *.tiff)|*.tif;*.tiff",
    Has_Extract_Parameter=False,
    Has_Manage_Collection=True,
    Has_Multiple_Files_Menu=False,
    Has_Picker_File_Menu=False,
    Multiple_Files=False)
preset = Preset(
    0,
    Has_Extract_Parameter=False,
    Has_Manage_Collection=False,
    OptionsLength=5,
    Options=["Generic", "Plastic", "Paint", "Metal", "Glass"])
light_sphere = VRayLightSphere(
    On=Toggle(True),
    Color=ColourSwatch(SwatchColor=RGB(255, 255, 255)),
    Intensity=Slider(1100, range=0..1100),
    Invisible=Toggle(True))
sampler = Sampler(0, Has_Extract_Parameter=False, Has_Manage_Collection=False, OptionsLength=2, Options=["Progressive", "Bucket"])
quality = Quality(
    2,
    Has_Extract_Parameter=False,
    Has_Manage_Collection=False,
    OptionsLength=5,
    Options=["Draft", "Low", "Medium", "High", "Very High"])
engine = Engine(0, Has_Extract_Parameter=False, Has_Manage_Collection=False, OptionsLength=2, Options=["CPU", "GPU"])
rig_dome = VRayLightRigDome(
    LightOn=Toggle(True),
    Visible=Toggle(True),
    Texture=open_file,
    Intensity=1.4,
    Rotation=0,
    BackgroundIntensity=1,
    AdditionalLights=light_sphere)
camera = VRayCamera(
    Position=[Point(490.7237978, 101.4962611, 201.7724913), Point(452.2905122, -78.57387614, 64.92034523), Point(452.2905122, -78.57387614, 64.92034523), Point(360.5804327, -35.00183879, 19.81551593)],
    Target=[Point(-26.08101666, 74.41825095, 57.27829716), Point(-44.93829994, 124.3488111, 48.04141346), Point(-44.93829994, 124.3488111, 48.04141346), Point(-58.33298468, 77.25137619, 56.23231073)],
    FOV=56.90230686)  # -> Camera, Angle
mode = Mode(0, Has_Extract_Parameter=False, Has_Manage_Collection=False, OptionsLength=2, Options=["Interactive", "Production"])
mtl_preset = VRayMaterialPreset(Preset=preset, MaterialColor=ColourSwatch(SwatchColor=RGB(217, 217, 217)))
vgeo = VRayGeometry(Geo=brep_2, Material=mtl_preset)
panel = Panel(vgeo)
path = FilePath("C:\Users\billpower\Desktop\888")
render = VRayRender(
    Engine=engine,
    Mode=mode,
    Sampler=sampler,
    Quality=quality,
    OutputImage=path,
    OutputResolution=[960, 540],
    Camera=camera.Camera,
    LightRig=rig_dome,
    VGeometry=vgeo)
vrscene = VRayVRScene(Scene=render, OutputFile=path)

# ==== cluster Cluster
sur = ClusterInput()
y = ClusterInput()
python = GhPythonScript(sur=sur, y=y)  # -> out, ent
# ---------- python: Python ----------
__author__ = "billpower"
__version__ = "2018.08.24"

import rhinoscriptsyntax as rs

#rsur = rs.GetObject("sur",rs.filter.surface)
ent = rs.OffsetSurface(sur,y,None,False,True)
# ---------- end python ----------
ent = ClusterOutput(python.ent)
