# Grasshopper definition 向量表示.gh (Grasshopper 0.9.76)

pt = ConstructPoint(XCoordinate=0, YCoordinate=0, ZCoordinate=0)
sph = Sphere(Base=pt, Radius=Slider(37, range=0..100))
sdivide = DivideSurface(Surface=sph, UCount=10, VCount=10)  # -> Points, Normals, Parameters
pipeline = GeometryPipeline(
    GroupByLayer=False,
    GroupByType=False,
    IncludeHidden=True,
    IncludeLocked=True,
    LayerFilter="*",
    NameFilter="*",
    TypeFilter=0)
ln = Line(StartPoint=pt, EndPoint=sdivide.Points)
line = Line(flatten(ln))
