# Grasshopper definition 数据处理.gh (Grasshopper 0.9.76)
# plug-ins: Python Interpreter

series = Series(Start=0, Step=1, Count=Slider(346, range=0..1000))
python = PythonScript(x=series, y=Slider(619, range=0..1000))  # -> out, a
# ---------- python: Python ----------
i,j = divmod(x,2)
if j==0:
    a = y
else:
    a = -y
# ---------- end python ----------
