# Grasshopper definition 202003_WB.gh (Grasshopper 1.0.7)
# plug-ins: MeshEdit Components, Weaverbird

brep = Brep(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)
smooth = SettingsQuality()
mesh = MeshBrep(Brep=brep, Settings=smooth)
mesh_2 = Mesh(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)
wbcatmullclark = WeaverbirdsCatmullClarkSubdivision(MeshCurves=mesh_2, Level=Slider(1, range=0..10), SmoothNakedEdges=1)
explode = MeshExplode(Mesh=wbcatmullclark, Interpolate=False)
Y = UnitY(Factor=Slider(387, range=0..1100))
Y_2 = UnitY(Factor=Slider(726, range=0..1100))
Y_3 = UnitY(Factor=Slider(1066, range=0..1100))
wbtile = WeaverbirdsTile(MeshCurves=wbcatmullclark, FillStrategy=1, OptIn=2)
move = Move(Geometry=wbcatmullclark, Motion=Y_2)  # -> Geometry, Transform
move_2 = Move(Geometry=wbcatmullclark, Motion=Y)  # -> Geometry, Transform
move_3 = Move(Geometry=wbcatmullclark, Motion=Y_3)  # -> Geometry, Transform
panel = Panel(wbtile)
wbfacepolys = WeaverbirdsFacePolylines(Mesh=move_2.Geometry)
explode_2 = Explode(Curve=wbfacepolys, Recursive=True)  # -> Segments, Vertices
wbinnerpolygons = WeaverbirdsInnerPolygonsSubdivision(MeshCurves=move.Geometry, Level=1)
wbmidedge = WeaverbirdsMidedgeSubdivision(MeshCurves=move_3.Geometry, Level=1, SmoothNakedEdges=1)
wbweave = WeaverbirdsMeshFromLinesWeaveBack(Lines=explode_2.Segments, MaximumValence=4)
Y_4 = UnitY(Factor=Slider(1769, range=0..11100))
Y_5 = UnitY(Factor=Slider(1389, range=0..11100))
move_4 = Move(Geometry=wbcatmullclark, Motion=Y_4)  # -> Geometry, Transform
move_5 = Move(Geometry=wbcatmullclark, Motion=Y_5)  # -> Geometry, Transform
wbloop = WeaverbirdsLoopSubdivision(MeshCurves=move_5.Geometry, Level=Slider(3, range=0..10), SmoothNakedEdges=1)
wbcarpet = WeaverbirdsSierpinskiCarpet(MeshPolylines=move_4.Geometry, Distance=Slider(10, range=0..10), InsetType=0)
