# Grasshopper definition Light数据接入.gh (Grasshopper 1.0.7)

timer = Timer(TimerInterval=100, Target=python)  # disabled
python = GhPythonScript()  # -> out, a
# ---------- python: Python ----------
__author__ = "billpower"
__version__ = "2020.01.11"

import rhinoscriptsyntax as rs

fname = "D:\data.txt"
with open(fname, 'rb') as f:  #打开文件
    first_line = f.readline()  #读第一行
    off = -20      #设置偏移量
    while True:
        f.seek(off, 2) #seek(off, 2)表示文件指针：从文件末尾(2)开始向前50个字符(-50)
        lines = f.readlines() #读取文件指针范围内所有行
        if len(lines)>=2: #判断是否最后至少有两行，这样保证了最后一行是完整的
            last_line = lines[-1] #取最后一行
            break
        #如果off为50时得到的readlines只有一行内容，那么不能保证最后一行是完整的
        #所以off翻倍重新运行，直到readlines不止一行
        off *= 2
    last_line = float(last_line.decode('utf-8'))
    #print(first_line)
    print(last_line)
    #print(type(last_line))
# ---------- end python ----------
rec = DataRecorder(python.out, DataLimit=-10, RecordData=True)
number_slider = Slider(2, range=0..10)
bnd = Bounds(Numbers=rec)
sqgrid = Square(Plane=PlaneXY(0, 0, 0), Size=Slider(100, range=0..100), ExtentX=number_slider, ExtentY=number_slider)  # -> Cells, Points
remap = RemapNumbers(Value=python.out, Source=bnd, Target=Domain(0, 50))  # -> Mapped, Clipped
pt = Point(sqgrid.Points)
cir = Circle(Plane=pt, Radius=remap.Mapped)
panel = Panel(rec)
