# Grasshopper definition 20180802_太阳辐射.gh (Grasshopper 1.0.7)

number_slider = Slider(20, range=0..100)
neg = Negative(Value=number_slider)
pt = Point(Point(1.027731964, 2.334664277, 0))
number_slider_2 = Slider(40, range=0..100)
subtraction = Subtraction(A=number_slider_2, B=1)
pi = Pi(Factor=1)
line = LineSDL(Start=pt, Direction=Vector(0, 0, 1), Length=Slider(200, range=0..1000))
dom = ConstructDomain(DomainStart=neg, DomainEnd=number_slider)
division = Division(A=pi, B=subtraction)
division_2 = Division(A=pi, B=Slider(2, range=0..10))
divide = DivideCurve(Curve=line, Count=number_slider_2, Kinks=False)  # -> Points, Tangents, Parameters
rectangle = Rectangle(Plane=divide.Points, XSize=dom, YSize=dom, Radius=Slider(8, range=0..100))  # -> Rectangle, Length
series = Series(Start=0, Step=division, Count=number_slider_2)
rotate = Rotate(Geometry=rectangle.Rectangle, Angle=series, Plane=divide.Points)  # -> reverse(Geometry), Transform
item = ListItem(List=rotate.Geometry, Index=[0, -1], Wrap=True)
loft = Loft(Curves=rotate.Geometry, Options={Adjust=False, Closed=False, LoftEnds=0, LoftSimp=0, LoftType=0, Rebuild=10, Refit=0.01})
boundary = BoundarySurfaces(Edges=item)
smooth = SettingsQuality()
mesh = MeshBrep(Brep=[boundary, loft], Settings=smooth)
mjoin = MeshJoin(Meshes=mesh)

path = FilePath("G:\architecture\grasshopper\数字冥想\探索\CHN_Zhejiang.Hangzhou.584570_CSWD.epw")
gencumulativeskymtx = Ladybug_GenCumulativeSkyMtx(epwFile=path, skyDensity=0, useOldRes=True, runIt=Toggle(True))  # -> readMe, cumulativeSkyMtx; plug-in component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
ladybug = Ladybug_Ladybug()  # -> Vviiiiiiiiiizzz; plug-in component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

# ---- group: 时间日期设置
analysisperiod = Ladybug_AnalysisPeriod(
    fromMonth=Slider(7, range=0..10),
    fromHour=Slider(8, range=0..10),
    toMonth=Slider(9, range=0..10),
    toHour=Slider(19, range=0..100))  # -> readMe, analysisPeriod; plug-in component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

# ----
selectskymtx = Ladybug_selectSkyMtx(
    cumulativeSkyMtx=gencumulativeskymtx.cumulativeSkyMtx,
    analysisPeriod=analysisperiod.analysisPeriod,
    removeDiffuse=False,
    removeDirect=False)  # -> readMe, selectedSkyMtx; plug-in component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
geo = Geometry(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)
mesh_2 = Mesh(mjoin)
geo_2 = Geometry(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)

# ---- group: 网格尺寸，越小越准确
number_slider_3 = Slider(3, range=0..10)

# ----
mesh_3 = Mesh(geo)
toggle = BooleanToggle(False)
radiationanalysis = Ladybug_RadiationAnalysis(
    geometry=flatten([mesh_2, geo_2]),
    gridSize=number_slider_3,
    disFromBase=Slider(1, range=0..1),
    selectedSkyMtx=flatten(selectskymtx.selectedSkyMtx),
    parallel=Toggle(True),
    runIt=Toggle(True))  # -> readMe, contextMesh, analysisMesh, testPts, testVec, port, radiationResult, radiationMesh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; plug-in component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
radiationanalysis_2 = Ladybug_RadiationAnalysis(
    geometry=flatten(mesh_3),
    gridSize=Slider(2, range=0..10),
    disFromBase=Slider(0.1, range=0..1),
    selectedSkyMtx=flatten(selectskymtx.selectedSkyMtx),
    parallel=toggle,
    runIt=toggle)  # -> readMe, contextMesh, analysisMesh, testPts, testVec, port, radiationResult, radiationMesh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; plug-in component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
gradientlibrary = Ladybug_GradientLibrary(gradIndex=Slider(1, range=0..10))  # -> customColors; plug-in component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
pt_2 = Point(radiationanalysis.testPts)
legendpar = Ladybug_LegendParameters(customColors=flatten(gradientlibrary))  # -> legendPar; plug-in component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

mesh_4 = Mesh(radiationanalysis.radiationMesh)
num = Number(flatten(radiationanalysis.radiationResult))
avr = Average(Input=num)
faceb = FaceBoundaries(Mesh=mesh_4)  # -> flatten(Boundaries)
division_3 = Division(A=num, B=avr)
explode = Explode(Curve=faceb, Recursive=True)  # -> Segments, Vertices
lng = ListLength(List=explode.Segments)
equals = Equality(FirstNumber=flatten(lng), SecondNumber=3)  # -> Equality, Inequality
cull = CullPattern(List=graft(faceb), CullPattern=graft(equals.Inequality))
cull_2 = CullPattern(List=graft(faceb), CullPattern=graft(equals.Equality))
explode_2 = Explode(Curve=cull, Recursive=True)  # -> Segments, Vertices
item_2 = ListItem(List=explode_2.Vertices, Index=[0, 1, 2], Wrap=True)
item_3 = ListItem(List=explode_2.Vertices, Index=[0, 3, 2], Wrap=True)
pline = PolyLine(Vertices=item_2, Closed=True)
pline_2 = PolyLine(Vertices=item_3, Closed=True)
merge = Merge(Data1=pline, Data2=pline_2)
boundary_2 = BoundarySurfaces(Edges=cull_2)
boundary_3 = BoundarySurfaces(Edges=merge)
division_4 = Division(A=division_3, B=Slider(1.727, range=0..10))
trim = TrimTree(Tree=boundary_3, Depth=1)
merge_2 = Merge(Data1=boundary_2, Data2=trim)
mesh_5 = MeshBrep(
    Brep=merge_2,
    Settings={GridMaxCount=0, GridMinCount=16, JaggedSeams=False, MaxEdgeLength=0, MinEdgeLength=0.0001, MinTolerance=0, Refine=True, RefineAngle=0, RelativeTolerance=0.65, SimplePlanes=True, Tolerance=0})
mjoin_2 = MeshJoin(Meshes=mesh_5)
area = Area(Geometry=mjoin_2)  # -> Area, Centroid
scale = Scale(Geometry=mjoin_2, Center=area.Centroid, Factor=graft(division_4))  # -> Geometry, Transform
mesh_6 = Mesh(scale.Geometry)

recolormesh = Ladybug_RecolorMesh(analysisResult=radiationanalysis.radiationResult, legendPar=legendpar)  # -> readMe, newMesh, newLegend, legendBasePt, meshColors, legendColors; disabled; plug-in component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
