# Grasshopper definition 最大值.gh (Grasshopper 0.9.76)
# plug-ins: Python Interpreter

起始索引 = Slider(0, range=0..10)
结束索引 = Slider(3, range=0..10)
步长 = Slider(1, range=0..10)
series = Series(Start=0, Step=1, Count=10)
series_2 = Series(Start=0, Step=1, Count=10)
random = Random(Range=Domain(0, 100), Number=10, Seed=2)
series_3 = Series(Start=0, Step=1, Count=10)
series_4 = Series(Start=0, Step=1, Count=10)
int = Integer(起始索引)
int_2 = Integer(结束索引)
int_3 = Integer(步长)
# 冒泡取最大
int_4 = Integer(random)
int_5 = Integer(Slider(5, range=0..10))
python = PythonScript(source=int_4)  # -> out, a; inputs source: list
# ---------- python: Python ----------
num = len(source)
k = 1
while 1:
    for i in range(num-k):
        if source[i] > source[i+1]:
            temp = source[i]
            source[i] = source[i+1]
            source[i+1] = temp
    k += 1
    print(source)
    if k == num:
        break
# ---------- end python ----------
python_2 = PythonScript(x=series)  # -> out, a; inputs x: list
# ---------- python_2: Python ----------
if x > y:
    a = x
else:
    a = y
i = 0
for i in x:
    print(x)
# ---------- end python_2 ----------
python_3 = PythonScript(x=series_2)  # -> out, a; inputs x: list
# ---------- python_3: Python ----------
source = [12, 4, 67, 2, 34, 11, 89, 45, 76, 29]

num = len(source)
k = 1
while 1:

    for i in range(num-k):
        if source[i] > source[i+1]:
            temp = source[i]
            source[i] = source[i+1]
            source[i+1] = temp
    k += 1
    print(source)
    if k == num - 1:
        break
# ---------- end python_3 ----------
# list item
python_4 = PythonScript(lst=series_3, x=int_5)  # -> out, a; inputs lst: list
# ---------- python_4: Python ----------
k = x + 1
a = lst[x:k:1]
#数据输入的数据输入的时候，注意数据类型
#x值的数据类型就必须是整数
# ---------- end python_4 ----------
# 索引范围切片
python_5 = PythonScript(lst=series_4, x=int, y=int_2, z=int_3)  # -> out, a; inputs lst: list
# ---------- python_5: Python ----------
if x >= y:
    y = x + 1
else:
    y = y
a = lst[x:y:z]
# ---------- end python_5 ----------
python_6 = PythonScript()  # -> out, a
# ---------- python_6: Python ----------
import rhinoscriptsyntax as rs
a = rs.AddPoint(10,0,0)
# ---------- end python_6 ----------
panel = Panel(python.out)
panel_2 = Panel(python_3.out)
panel_3 = Panel(python_5.a)
panel_4 = Panel(python_4.a)
python_7 = PythonScript()  # -> out, a
# ---------- python_7: Python ----------
import rhinoscriptsyntax as rs
a = []
#多点就是点列表
for i in xrange(10):
    pt = rs.AddPoint(i,0,0)
    a.append(pt)
# ---------- end python_7 ----------
panel_5 = Panel(python_7.a)
